# Grasshopper definition revit-styles.ghx (Grasshopper 1.0.7)
# plug-ins: Rhino.Inside for Autodesk Revit

fill_pattern = FillPattern(<fill pattern referenced from the Revit model>)
panel = Panel(fill_pattern)
line_pattern = LinePattern(<line pattern referenced from the Revit model>)
panel_2 = Panel(line_pattern)
