# Grasshopper definition Create-Cube.gh (Grasshopper 1.0.7)
# plug-ins: Rhino.Inside for Autodesk Revit

number_slider = Slider(7, range=0..10)
model = ModelCategoriesPicker({"Air Systems": -2001008, "Air Terminals": -2008013, "Analysis Display Style": -2000304, "Analysis Results": -2000303, "Areas": -2003200, "Bridge Abutments": -2006130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}, selected="Generic Models": -2000151)
construct_point = ConstructPoint(XCoordinate=0, YCoordinate=0, ZCoordinate=0)
construct_point_2 = ConstructPoint(XCoordinate=number_slider, YCoordinate=number_slider, ZCoordinate=number_slider)
box_2pt = Box2Pt(PointA=construct_point, PointB=construct_point_2, Plane=PlaneXY(0, 0, 0))
add_geometry_directshape = AddGeometryDirectShape(Name="Test", Category=model, Geometry=box_2pt)
