# Grasshopper definition Create-Sphere.ghx (Grasshopper 1.0.7)
# plug-ins: Rhino.Inside for Autodesk Revit

model = ModelCategoriesPicker({"Air Systems": -2001008, "Air Terminals": -2008013, "Analysis Display Style": -2000304, "Analysis Results": -2000303, "Areas": -2003200, "Bridge Abutments": -2006130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}, selected="Generic Models": -2000151)
sphere = Sphere(Base=PlaneXY(0, 0, 0), Radius=Slider(7, range=0..10))
add_geometry_directshape = AddGeometryDirectShape(Name="Test", Category=model, Geometry=sphere)
