# Grasshopper definition AssetsPlayground.ghx (Grasshopper 1.0.7)
# plug-ins: Rhino.Inside for Autodesk Revit

query_materials = QueryMaterials()
value_set_picker = ValueSetPicker(query_materials)
extract_material_s_assets = ExtractMaterialsAssets(Material=value_set_picker)  # -> AppearanceAsset, PhysicalAsset, ThermalAsset

# ----
# Deconstructs given
# Appearance Asset
# 
# S = Schema
# LP = library path
# K = Parameter Keys
# V = Parameter Values
# VT = Parameter Value Types
# Disable to output
# all available
# Asset Parameters
asset_properties = GhPythonScript(A=extract_material_s_assets.AppearanceAsset)  # -> S, LP, K, V, VT; inputs F: list
# ---------- asset_properties: Python ----------
import os
import os.path as op
import clr
clr.AddReference('System.Core')
clr.AddReference('RhinoInside.Revit')
clr.AddReference('RevitAPI') 
clr.AddReference('RevitAPIUI')

from System import Enum
import ghpythonlib.treehelpers as th
import rhinoscriptsyntax as rs
import Rhino
import RhinoInside
import Grasshopper
from Grasshopper.Kernel import GH_RuntimeMessageLevel as RML
from RhinoInside.Revit import Revit, Convert
from Autodesk.Revit import DB

# active Revit verison
REVIT_VERSION = Revit.ActiveUIApplication.Application.VersionNumber

# access the active document object
doc = Revit.ActiveDBDocument

def show_warning(msg):
    ghenv.Component.AddRuntimeMessage(RML.Warning, msg)

def show_error(msg):
    ghenv.Component.AddRuntimeMessage(RML.Error, msg)

def show_remark(msg):
    ghenv.Component.AddRuntimeMessage(RML.Remark, msg)


SCHEMA_TYPES = [
    DB.Visual.SchemaCommon,
    DB.Visual.Generic,
    DB.Visual.BumpMap,
    DB.Visual.Ceramic,
    DB.Visual.Checker,
    DB.Visual.Concrete,
    DB.Visual.Glazing,
    DB.Visual.Gradient,
    DB.Visual.Hardwood,
    DB.Visual.Marble,
    DB.Visual.MasonryCMU,
    DB.Visual.Metal,
    DB.Visual.MetallicPaint,
    DB.Visual.Mirror,
    DB.Visual.Noise,
    DB.Visual.PlasticVinyl,
    DB.Visual.SolidGlass,
    DB.Visual.Speckle,
    DB.Visual.Stone,
    DB.Visual.Tile,
    DB.Visual.UnifiedBitmap,
    DB.Visual.WallPaint,
    DB.Visual.Water,
    DB.Visual.Wave,
    DB.Visual.Wood,
]


VALUE_ENUMS = {
    "bumpmap_Type": DB.Visual.BumpmapType,

    "ceramic_application": DB.Visual.CeramicApplicationType,
    "ceramic_bump": DB.Visual.CeramicBumpType,
    "ceramic_pattern": DB.Visual.CeramicPatternType,
    "ceramic_type": DB.Visual.CeramicType,
    "common_Shared_Asset": DB.Visual.CommonSharedAssetType,

    "concrete_brightmode": DB.Visual.ConcreteBrightmodeType,
    "concrete_finish": DB.Visual.ConcreteFinishType,
    "concrete_sealant": DB.Visual.ConcreteSealantType,

    "glazing_transmittance_color": DB.Visual.GlazingTransmittanceColorType,

    "gradient_interpolation": DB.Visual.GradientInterpolationType,
    "gradient_noise": DB.Visual.GradientNoiseType,
    "gradient_type": DB.Visual.GradientType,

    "hardwood_application": DB.Visual.HardwoodApplicationType,
    "hardwood_finish": DB.Visual.HardwoodFinishType,
    "hardwood_imperfections": DB.Visual.HardwoodImperfectionsType,
    "hardwood_tint_enabled": DB.Visual.HardwoodTintEnabledType,

    "layered_ndf_type": DB.Visual.LayeredNdfType,
    
    "masonrycmu_application": DB.Visual.MasonryCMUApplicationType,
    "masonrycmu_pattern": DB.Visual.MasonryCMUPatternType,
    "masonrycmu_type": DB.Visual.MasonryCMUType,
    
    "metal_finish": DB.Visual.MetalFinishType,
    "metal_pattern": DB.Visual.MetalPatternType,
    "metal_perforations": DB.Visual.MetalPerforationsType,
    "metal_type": DB.Visual.MetalType,

    "metallicpaint_finish": DB.Visual.MetallicpaintFinishType,
    "metallicpaint_flecks": DB.Visual.MetallicpaintFlecksType,
    "metallicpaint_pearl": DB.Visual.MetallicpaintPearlType,
    "metallicpaint_topcoat": DB.Visual.MetallicpaintTopcoatType,
    
    "noise_Type": DB.Visual.NoiseType,
    
    "plasticvinyl_application": DB.Visual.PlasticvinylApplicationType,
    "plasticvinyl_bump": DB.Visual.PlasticvinylBumpType,
    "plasticvinyl_pattern": DB.Visual.PlasticvinylPatternType,
    "plasticvinyl_type": DB.Visual.PlasticvinylType,
    
    "solidglass_bump_enable": DB.Visual.SolidglassBumpEnableType,
    "solidglass_transmittance": DB.Visual.SolidglassTransmittanceType,
    
    "stone_application": DB.Visual.StoneApplicationType,
    "stone_bump": DB.Visual.StoneBumpType,
    "stone_pattern": DB.Visual.StonePatternType,
    
    "surface_ndf_type": DB.Visual.SurfaceNdfType,
    
    "tile_BrickType": DB.Visual.TileBrickType,
    
    "wallpaint_application": DB.Visual.WallpaintApplicationType,
    "wallpaint_finish": DB.Visual.WallpaintFinishType,
    
    "water_tint_enable": DB.Visual.WaterTintEnableType,
    "water_type": DB.Visual.WaterType,
    
    "wave_Distribution": DB.Visual.WaveDistributionType,
    
    "wood_pore": DB.Visual.WoodPoreType,
}


LIBROOT = r'%COMMONPROGRAMFILES(x86)%\Autodesk Shared\Materials\{version}\{lib}'


def get_libpath(libname):
    return \
        op.expandvars(LIBROOT.format(version=REVIT_VERSION,
                                     lib=libname.replace('.fbx', '.fbm')))


def get_enum_from_int(enumtype, intval):
    for ev in Enum.GetValues(enumtype):
        if int(ev) == intval:
            return str(ev)


def find_prop_type(propname):
    for schema_t in SCHEMA_TYPES:
        for p in clr.GetClrType(schema_t).GetProperties():
            if p.Name == propname:
                return schema_type


def lookup_enum_value(propname, propint):
    enum = VALUE_ENUMS.get(propname, None)
    if enum:
        return get_enum_from_int(enum, propint)


def get_imagepath(img):
    if LP and img:
        return op.normpath(op.join(LP, img))
    return img


def get_assetprop_value(aprop):
    # check if any asset is connected
    # this also takes care of DB.Visual.AssetPropertyReference property types
    if isinstance(aprop, DB.Visual.AssetProperty):
        connected_asset = aprop.GetSingleConnectedAsset()
        if connected_asset:
            return connected_asset

    # otherwise try to extract the value
    if isinstance(aprop, DB.Visual.AssetPropertyString):
        val_as_path = get_imagepath(aprop.Value)
        if op.exists(val_as_path):
            return val_as_path
        else:
            return aprop.Value

    elif isinstance(aprop, DB.Visual.AssetPropertyInteger):
        # try to expand the integer to enum value
        enum_val = lookup_enum_value(aprop.Name, int(aprop.Value))
        return enum_val if enum_val else aprop.Value

    elif isinstance(aprop, DB.Visual.AssetPropertyList):
        assetprop_list = aprop.GetValue()
        # TODO: what is this list? can not find an example
        return assetprop_list

    elif isinstance(aprop, DB.Visual.AssetPropertyDoubleArray2d):
        double_tuple = aprop.Value
        return Rhino.Geometry.Vector2d(*double_tuple)

    elif isinstance(aprop, DB.Visual.AssetPropertyDoubleArray3d):
        # return aprop.GetValueAsDoubles()
        return 0

    elif isinstance(aprop, DB.Visual.AssetPropertyDoubleArray4d):
        # assume it is color
        double_tuple = aprop.GetValueAsDoubles()
        R,G,B,A = double_tuple
        return rs.CreateColor(R*255, G*255, B*255, A*255)

    elif isinstance(aprop, DB.Visual.AssetPropertyDoubleMatrix44):
        tform = Rhino.Geometry.Transform(0)
        rform.M00, rform.M01, rform.M02, rform.M03,
        rform.M10, rform.M11, rform.M12, rform.M13,
        rform.M20, rform.M21, rform.M22, rform.M23,
        rform.M30, rform.M31, rform.M32, rform.M43 = aprop.GetValue()
        return tform

    elif isinstance(aprop, DB.Visual.AssetPropertyFloatArray):
        # api says it will have 3 values. let's build a vector
        float_tuple = aprop.GetValue()
        return Rhino.Geometry.Vector3f(*float_tuple)

    elif hasattr(aprop, 'Value'):
        return aprop.Value


def expand_prop(aprop):
    if (not F) or (F and aprop.Name in F):
        return aprop.Name, get_assetprop_value(aprop), aprop.Type
    return None, None, None


def expand_props(aprops):
    keys = []
    values = []
    types = []
    for aprop in aprops:
        if aprop:
            k, v, t = expand_prop(aprop)
            if k:
                keys.append(k)
                values.append(v)
                types.append(t)
    return keys, values, types


def extract_props(aprops):
    global K, V, VT
    K, V, VT = expand_props(aprops)

asset = None
if isinstance(A, DB.AppearanceAssetElement):
    asset = A.GetRenderingAsset()
elif isinstance(A, DB.Visual.Asset):
    asset = A

if asset:
    S = asset.Name
    LP = get_libpath(asset.LibraryName)
    asset_props = [asset.Get(i) for i in range(0, asset.Size)]
    extract_props(asset_props)
# ---------- end asset_properties ----------

asset_schema = Panel(asset_properties.S)
asset_library_path = Panel(asset_properties.LP)
property_name = Panel(asset_properties.K)

# ----
# Asset Parameters
# can point to other assets.
# Add more components
# to selectively dig
# into the tree
# Analyze Nested Assets
value_set_picker_2 = ValueSetPicker(asset_properties.K)
match_text = MatchText(Text=asset_properties.K, Pattern=value_set_picker_2, Case=True)
cull_pattern = CullPattern(List=asset_properties.V, CullPattern=match_text)
asset_properties_2 = GhPythonScript(A=cull_pattern)  # -> S, LP, K, V, VT; inputs F: list; same code as asset_properties
library_path = Panel(asset_properties_2.LP)
property_value_type = Panel(asset_properties_2.VT)
asset_schema_2 = Panel(asset_properties_2.S)
property_value = Panel(asset_properties_2.V)
property_name_2 = Panel(asset_properties_2.K)

data_type = Panel(asset_properties.VT)
property_value_2 = Panel(asset_properties.V)
