# Grasshopper definition Curtain Walls_Native.ghx (Grasshopper 1.0.7)
# plug-ins: Rhino.Inside for Autodesk Revit

model = ModelCategoriesPicker({"Air Terminals": -2008013, "Analysis Display Style": -2000304, "Analysis Results": -2000303, "Areas": -2003200, "Bridge Abutments": -2006130, "Bridge Arches": -2006134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}, selected="Curtain Grids": -2000173)
model_2 = ModelCategoriesPicker({"Air Terminals": -2008013, "Analysis Display Style": -2000304, "Analysis Results": -2000303, "Areas": -2003200, "Bridge Abutments": -2006130, "Bridge Arches": -2006134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}, selected="Curtain Panels": -2000170)
model_3 = ModelCategoriesPicker({"Air Terminals": -2008013, "Analysis Display Style": -2000304, "Analysis Results": -2000303, "Areas": -2003200, "Bridge Abutments": -2006130, "Bridge Arches": -2006134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}, selected="Curtain Wall Mullions": -2000171)
# PARTS (TYPE, INSTANCE)
model_4 = ModelCategoriesPicker({"Air Terminals": -2008013, "Analysis Display Style": -2000304, "Analysis Results": -2000303, "Areas": -2003200, "Bridge Abutments": -2006130, "Bridge Arches": -2006134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}, selected="Curtain Grids": -2000173)
model_5 = ModelCategoriesPicker({"Air Terminals": -2008013, "Analysis Display Style": -2000304, "Analysis Results": -2000303, "Areas": -2003200, "Bridge Abutments": -2006130, "Bridge Arches": -2006134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}, selected="Curtain Panels": -2000170)
model_6 = ModelCategoriesPicker({"Air Terminals": -2008013, "Analysis Display Style": -2000304, "Analysis Results": -2000303, "Areas": -2003200, "Bridge Abutments": -2006130, "Bridge Arches": -2006134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}, selected="Curtain Wall Mullions": -2000171)
# CURTAIN WALLS AND TYPES
wall_system_family = WallSystemFamily({"Basic": 0, "Curtain": 1, "Stacked": 2}, selected="Curtain")
model_7 = ModelCategoriesPicker({"Air Terminals": -2008013, "Analysis Display Style": -2000304, "Analysis Results": -2000303, "Areas": -2003200, "Bridge Abutments": -2006130, "Bridge Arches": -2006134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}, selected="Curtain Systems": -2000340)
# CURTAIN SYSTEMS AND TYPES
model_8 = ModelCategoriesPicker({"Air Terminals": -2008013, "Analysis Display Style": -2000304, "Analysis Results": -2000303, "Areas": -2003200, "Bridge Abutments": -2006130, "Bridge Arches": -2006134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}, selected="Curtain Systems": -2000340)
walls = DocumentWalls(WallSystemFamily=wall_system_family)
bycategory = ElementCategoryFilter(Categories=model_4, Inverted=False)
bycategory_2 = ElementCategoryFilter(Categories=model_5, Inverted=False)
bycategory_3 = ElementCategoryFilter(Categories=model_6, Inverted=False)
bycategory_4 = ElementCategoryFilter(Categories=model, Inverted=False)
bycategory_5 = ElementCategoryFilter(Categories=model_2, Inverted=False)
bycategory_6 = ElementCategoryFilter(Categories=model_3, Inverted=False)
bycategory_7 = ElementCategoryFilter(Categories=model_8, Inverted=False)
bycategory_8 = ElementCategoryFilter(Categories=model_7, Inverted=False)
types = QueryTypes(Filter=bycategory)
types_2 = QueryTypes(Filter=bycategory_2)
types_3 = QueryTypes(Filter=bycategory_3)
elements = DocumentElements(Filter=bycategory_4)
elements_2 = DocumentElements(Filter=bycategory_5)
elements_3 = DocumentElements(Filter=bycategory_6)
identity = ElementIdentity(Element=walls)  # -> Category, Type, Name
panel = Panel(walls)
types_4 = QueryTypes(Filter=bycategory_7)
elements_4 = QueryElements(Filter=bycategory_8)
panel_2 = Panel(types)
panel_3 = Panel(types_2)
panel_4 = Panel(types_3)
panel_5 = Panel(identity.Type)
panel_6 = Panel(elements)
panel_7 = Panel(elements_2)
panel_8 = Panel(elements_3)
panel_9 = Panel(types_4)
panel_10 = Panel(elements_4)
wall_system_family_2 = WallSystemFamily({"Basic": 0, "Curtain": 1, "Stacked": 2}, selected="Curtain")
wall_system_family_3 = WallSystemFamily({"Basic": 0, "Curtain": 1, "Stacked": 2}, selected="Curtain")
# GRID CELLS
wall_system_family_4 = WallSystemFamily({"Basic": 0, "Curtain": 1, "Stacked": 2}, selected="Curtain")
wall_system_family_5 = WallSystemFamily({"Basic": 0, "Curtain": 1, "Stacked": 2}, selected="Curtain")
wall_system_family_6 = WallSystemFamily({"Basic": 0, "Curtain": 1, "Stacked": 2}, selected="Curtain")
wall_system_family_7 = WallSystemFamily({"Basic": 0, "Curtain": 1, "Stacked": 2}, selected="Curtain")
# CURTAIN GRID
wall_system_family_8 = WallSystemFamily({"Basic": 0, "Curtain": 1, "Stacked": 2}, selected="Curtain")
wall_system_family_9 = WallSystemFamily({"Basic": 0, "Curtain": 1, "Stacked": 2}, selected="Curtain")
wall_system_family_10 = WallSystemFamily({"Basic": 0, "Curtain": 1, "Stacked": 2}, selected="Curtain")
walls_2 = DocumentWalls(WallSystemFamily=wall_system_family_2)
# INSTANCES
level_of_detail = LevelOfDetail({"Coarse": 1, "Medium": 2, "Fine": 3}, selected="Fine")
walls_3 = DocumentWalls(WallSystemFamily=wall_system_family_3)
walls_4 = DocumentWalls(WallSystemFamily=wall_system_family_4)
walls_5 = DocumentWalls(WallSystemFamily=wall_system_family_6)
walls_6 = DocumentWalls(WallSystemFamily=wall_system_family_7)
walls_7 = DocumentWalls(WallSystemFamily=wall_system_family_8)
walls_8 = DocumentWalls(WallSystemFamily=wall_system_family_5)
walls_9 = DocumentWalls(WallSystemFamily=wall_system_family_9)
identity_2 = ElementIdentity(Element=walls_2)  # -> Category, Type, Name
walls_10 = DocumentWalls(WallSystemFamily=wall_system_family_10)
analyze_curtain_wall = AnalyzeCurtainWall(CurtainWall=walls_3)  # -> CurtainGrid, HostWall
analyze_curtain_wall_2 = AnalyzeCurtainWall(CurtainWall=walls_4)  # -> CurtainGrid, HostWall
analyze_curtain_wall_3 = AnalyzeCurtainWall(CurtainWall=walls_9)  # -> CurtainGrid, HostWall
# CURTAIN WALLS
# TYPES
a_cwt = AnalyzeCurtainWallType(CurtainWallType=identity_2.Type)  # -> Function, AutomaticallyEmbed, CurtainPanel, JoinCondition, VerticalGridLayout, VerticalGridSpacing, VerticalGridAdjustForMullionSize, HorizontalGridLayout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
geometry = ElementGeometry(DetailLevel=level_of_detail, Elements=walls_8)
ebg = ElementBoundingGeometry(Element=walls_5)
analyze_curtain_wall_4 = AnalyzeCurtainWall(CurtainWall=walls_6)  # -> CurtainGrid, HostWall
analyze_curtain_wall_5 = AnalyzeCurtainWall(CurtainWall=walls_7)  # -> CurtainGrid, HostWall
analyze_curtain_wall_6 = AnalyzeCurtainWall(CurtainWall=walls_10)  # -> CurtainGrid, HostWall
analyze_curtain_grid = AnalyzeCurtainGrid(CurtainGrid=analyze_curtain_wall.CurtainGrid)  # -> Cells, Mullions, Panels, VerticalLines, VerticalAngle, VerticalJustification, VerticalOffset, HorizontalLines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
analyze_curtain_grid_2 = AnalyzeCurtainGrid(CurtainGrid=analyze_curtain_wall_2.CurtainGrid)  # -> Cells, Mullions, Panels, VerticalLines, VerticalAngle, VerticalJustification, VerticalOffset, HorizontalLines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
analyze_curtain_grid_3 = AnalyzeCurtainGrid(CurtainGrid=analyze_curtain_wall_3.CurtainGrid)  # -> Cells, Mullions, Panels, VerticalLines, VerticalAngle, VerticalJustification, VerticalOffset, HorizontalLines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
analyze_curtain_grid_4 = AnalyzeCurtainGrid(CurtainGrid=analyze_curtain_wall_6.CurtainGrid)  # -> Cells, Mullions, Panels, VerticalLines, VerticalAngle, VerticalJustification, VerticalOffset, HorizontalLines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
panel_11 = Panel(geometry)
bounding_geometry = Panel(ebg)
host_wall = Panel(analyze_curtain_wall_5.HostWall)
curtain_grid = Panel(analyze_curtain_wall_4.CurtainGrid)
analyze_curtain_grid_cell = AnalyzeCurtainGridCell(CurtainGridCell=analyze_curtain_grid_3.Cells)  # -> Curves, PlanarizedCurves
analyze_curtain_grid_cell_2 = AnalyzeCurtainGridCell(CurtainGridCell=analyze_curtain_grid_4.Cells)  # -> Curves, PlanarizedCurves
path_mapper = PathMapper(
    [a_cwt.VerticalGridLayout, a_cwt.VerticalGridSpacing, a_cwt.VerticalGridAdjustForMullionSize],
    source="{A;B}(i)",
    target="{A;B;i}")
path_mapper_2 = PathMapper(
    [a_cwt.HorizontalGridLayout, a_cwt.HorizontalGridSpacing, a_cwt.HorizontalGridAdjustForMullionSize],
    source="{A;B}(i)",
    target="{A;B;i}")
path_mapper_3 = PathMapper(
    [a_cwt.VerticalMullionsInteriorType, a_cwt.VerticalMullionsBorder1Type, a_cwt.VerticalMullionsBorder2Type],
    source="{A;B}(i)",
    target="{A;B;i}")
path_mapper_4 = PathMapper(
    [a_cwt.HorizontalMullionsInteriorType, a_cwt.HorizontalMullionsBorder1Type, a_cwt.HorizontalMullionsBorder2Type],
    source="{A;B}(i)",
    target="{A;B;i}")
wall_function = Panel(a_cwt.Function)
automatically_embed = Panel(a_cwt.AutomaticallyEmbed)
curtain_panel_type = Panel(a_cwt.CurtainPanel)
curtain_join_condition = Panel(a_cwt.JoinCondition)
grid_cells = Panel(analyze_curtain_grid.Cells)
grid_mullions = Panel(analyze_curtain_grid.Mullions)
grid_inserts = Panel(analyze_curtain_grid.Panels)
u_grid_lines = Panel(analyze_curtain_grid.VerticalLines)
path_mapper_5 = PathMapper(
    [analyze_curtain_grid.VerticalAngle, analyze_curtain_grid.VerticalJustification, analyze_curtain_grid.VerticalOffset],
    source="{A;B}(i)",
    target="{A;B;i}")
v_grid_lines = Panel(analyze_curtain_grid.HorizontalLines)
path_mapper_6 = PathMapper(
    [analyze_curtain_grid.HorizontalAngle, analyze_curtain_grid.HorizontalJustification, analyze_curtain_grid.HorizontalOffset],
    source="{A;B}(i)",
    target="{A;B;i}")
cell_curve = Panel(analyze_curtain_grid_cell.Curves)
grid_cell_geom = CustomPreview(Geometry=analyze_curtain_grid_cell.Curves, Material=ColourSwatch(SwatchColor=RGB(255, 255, 255)))
lng = ListLength(List=analyze_curtain_grid_2.Cells)
cell_count = Panel(lng)
u_grid_info = Panel(path_mapper)
v_grid_info = Panel(path_mapper_2)
u_mullion_info = Panel(path_mapper_3)
v_mullion_info = Panel(path_mapper_4)
center_planes = BoundarySurfaces(Edges=analyze_curtain_grid_cell_2.PlanarizedCurves, UseTasks=False)
cell_panel_curve = Panel(analyze_curtain_grid_cell_2.PlanarizedCurves)
u_grid_info_2 = Panel(path_mapper_5)
v_grid_info_2 = Panel(path_mapper_6)
wf = WallFunction({"Interior": 0, "Exterior": 1, "Foundation": 2, "Retaining": 3, "Soffit": 4, "Core-Shaft": 5}, selected="Interior")
analyze_curtain_grid_cell_3 = AnalyzeCurtainGridCell(CurtainGridCell=analyze_curtain_grid_2.Cells)  # -> Curves, PlanarizedCurves
amoments = AreaMoments(Geometry=center_planes)  # -> Area, Centroid, Inertia, InertiaError, Secondary, SecondaryError, Gyration
cell_plane = CustomPreview(Geometry=center_planes, Material=ColourSwatch(SwatchColor=RGBA(219, 0, 255, 23)))
pshift = ShiftPaths(Data=amoments.Centroid, Offset=-1)
cgjc = CurtainGridJoinCondition({"Not Defined": 0, "Vertical Grid Continuous": 1, "Horizontal Grid Continuous": 2, "Border & Vertical Grid Continuous": 3, "Border & Horizontal Grid Continuous": 4}, selected="Not Defined")
cell_curve_2 = Panel(analyze_curtain_grid_cell_3.Curves)
cell_panel_curve_2 = Panel(analyze_curtain_grid_cell_3.PlanarizedCurves)
points = PointList(Points=pshift)
# = Layout
# = Spacing
# = Adjust for Mullion Size
cgl = CurtainGridLayout({"None": 0, "Fixed Distance": 1, "Fixed Number": 2, "Maximum Spacing": 3, "Minimum Spacing": 4}, selected="None")
# = Layout
# = Spacing
# = Adjust for Mullion Size
# = Inteiror Mullion Type
# = Start Mullion Type (Border 1)
# = End Mullion Type (Border 2)
# = Inteiror Mullion Type
# = Bottom Mullion Type (Border 1)
# = Top Mullion Type (Border 2)
cgl_2 = CurtainGridLayout({"None": 0, "Fixed Distance": 1, "Fixed Number": 2, "Maximum Spacing": 3, "Minimum Spacing": 4}, selected="None")
# = Grid Angle
# = Grid Justification
# = Grid Offset
cgat = CurtainGridAlignType({"No Justify": 0, "Beginning": 1, "Center": 2, "End": 3}, selected="No Justify")
# = Grid Angle
# = Grid Justification
# = Grid Offset
cgat_2 = CurtainGridAlignType({"No Justify": 0, "Beginning": 1, "Center": 2, "End": 3}, selected="No Justify")
wall_system_family_11 = WallSystemFamily({"Basic": 0, "Curtain": 1, "Stacked": 2}, selected="Curtain")
wall_system_family_12 = WallSystemFamily({"Basic": 0, "Curtain": 1, "Stacked": 2}, selected="Curtain")
# MULLIONS
wall_system_family_13 = WallSystemFamily({"Basic": 0, "Curtain": 1, "Stacked": 2}, selected="Curtain")
wall_system_family_14 = WallSystemFamily({"Basic": 0, "Curtain": 1, "Stacked": 2}, selected="Curtain")
# TYPES
wall_system_family_15 = WallSystemFamily({"Basic": 0, "Curtain": 1, "Stacked": 2}, selected="Curtain")
wall_system_family_16 = WallSystemFamily({"Basic": 0, "Curtain": 1, "Stacked": 2}, selected="Curtain")
walls_11 = DocumentWalls(WallSystemFamily=wall_system_family_11)
walls_12 = DocumentWalls(WallSystemFamily=wall_system_family_12)
walls_13 = DocumentWalls(WallSystemFamily=wall_system_family_13)
walls_14 = DocumentWalls(WallSystemFamily=wall_system_family_14)
walls_15 = DocumentWalls(WallSystemFamily=wall_system_family_15)
walls_16 = DocumentWalls(WallSystemFamily=wall_system_family_16)
analyze_curtain_wall_7 = AnalyzeCurtainWall(CurtainWall=walls_11)  # -> CurtainGrid, HostWall
analyze_curtain_wall_8 = AnalyzeCurtainWall(CurtainWall=walls_12)  # -> CurtainGrid, HostWall
analyze_curtain_wall_9 = AnalyzeCurtainWall(CurtainWall=walls_13)  # -> CurtainGrid, HostWall
analyze_curtain_wall_10 = AnalyzeCurtainWall(CurtainWall=walls_14)  # -> CurtainGrid, HostWall
analyze_curtain_wall_11 = AnalyzeCurtainWall(CurtainWall=walls_15)  # -> CurtainGrid, HostWall
analyze_curtain_wall_12 = AnalyzeCurtainWall(CurtainWall=walls_16)  # -> CurtainGrid, HostWall
analyze_curtain_grid_5 = AnalyzeCurtainGrid(CurtainGrid=analyze_curtain_wall_7.CurtainGrid)  # -> Cells, Mullions, Panels, VerticalLines, VerticalAngle, VerticalJustification, VerticalOffset, HorizontalLines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
analyze_curtain_grid_6 = AnalyzeCurtainGrid(CurtainGrid=analyze_curtain_wall_9.CurtainGrid)  # -> Cells, Mullions, Panels, VerticalLines, VerticalAngle, VerticalJustification, VerticalOffset, HorizontalLines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
analyze_curtain_grid_7 = AnalyzeCurtainGrid(CurtainGrid=analyze_curtain_wall_8.CurtainGrid)  # -> Cells, Mullions, Panels, VerticalLines, VerticalAngle, VerticalJustification, VerticalOffset, HorizontalLines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
analyze_curtain_grid_8 = AnalyzeCurtainGrid(CurtainGrid=analyze_curtain_wall_10.CurtainGrid)  # -> Cells, Mullions, Panels, VerticalLines, VerticalAngle, VerticalJustification, VerticalOffset, HorizontalLines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
analyze_curtain_grid_9 = AnalyzeCurtainGrid(CurtainGrid=analyze_curtain_wall_11.CurtainGrid)  # -> Cells, Mullions, Panels, VerticalLines, VerticalAngle, VerticalJustification, VerticalOffset, HorizontalLines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
analyze_curtain_grid_10 = AnalyzeCurtainGrid(CurtainGrid=analyze_curtain_wall_12.CurtainGrid)  # -> Cells, Mullions, Panels, VerticalLines, VerticalAngle, VerticalJustification, VerticalOffset, HorizontalLines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
crv = Curve(analyze_curtain_grid_6.Mullions)
geometry_2 = ElementGeometry(Elements=analyze_curtain_grid_5.Mullions)
analyze_mullion = AnalyzeMullion(Mullion=analyze_curtain_grid_7.Mullions)  # -> Type, AxisCurve, BasePoint
analyze_mullion_2 = AnalyzeMullion(Mullion=analyze_curtain_grid_8.Mullions)  # -> Type, AxisCurve, BasePoint
analyze_mullion_3 = AnalyzeMullion(Mullion=analyze_curtain_grid_9.Mullions)  # -> Type, AxisCurve, BasePoint
analyze_mullion_4 = AnalyzeMullion(Mullion=analyze_curtain_grid_10.Mullions)  # -> Type, AxisCurve, BasePoint
grid_mullion_geom = CustomPreview(Geometry=geometry_2, Material=ColourSwatch(SwatchColor=RGBA(0, 112, 255, 101)))
mullion_base_curves = Panel(crv)
len = Length(Curve=crv)
analyze_mullion_type = AnalyzeMullionType(MullionType=analyze_mullion_3.Type)  # -> MullionSystemFamily, Angle, Offset, Profile, Position, CornerMullion, Thickness, Depth1, Depth2, Radius
midpt = CurveMiddle(Curve=analyze_mullion.AxisCurve)
mullion_base_curves_2 = Panel(analyze_mullion.AxisCurve)
analyze_mullion_type_2 = AnalyzeMullionType(MullionType=analyze_mullion_4.Type)  # -> MullionSystemFamily, Angle, Offset, Profile, Position, CornerMullion, Thickness, Depth1, Depth2, Radius
path_mapper_7 = PathMapper(analyze_mullion_2.BasePoint, source="{A;B;C}(i)", target="{A;B;C;i}")
type = Panel(analyze_mullion_2.Type)
base_curve = Panel(analyze_mullion_2.AxisCurve)
bool = Boolean(invert(len))
points_2 = PointList(Points=midpt)
cull = CullPattern(List=len, CullPattern=bool)
path_mapper_8 = PathMapper(
    [analyze_mullion_type.MullionSystemFamily, analyze_mullion_type.Angle, analyze_mullion_type.Offset, analyze_mullion_type.Profile, analyze_mullion_type.Position, analyze_mullion_type.CornerMullion, analyze_mullion_type.Thickness, analyze_mullion_type.Depth1, analyze_mullion_type.Depth2, analyze_mullion_type.Radius],
    source="{A;B;C}(i)",
    target="{A;B;C;i}")
# = Base Point
# = Locked?
# = Lockable?
mullion_info = Panel(path_mapper_7)
mullion_base_curve_length = Panel(cull)
cmsf = CurtainMullionSystemFamily({"Unknown": -1, "Rectangular": 0, "Circular": 1, "L Corner": 2, "Trapezoid Corner": 3, "Quad Corner": 4, "V Corner": 5}, selected="L Corner")
mullion_type_properties = Panel(path_mapper_8)
equals = Equality(FirstNumber=analyze_mullion_type_2.MullionSystemFamily, SecondNumber=cmsf)  # -> Equality, Inequality
cull_2 = CullPattern(List=analyze_curtain_grid_10.Mullions, CullPattern=equals.Equality)
panel_12 = Panel(cull_2)
# = System Family
# = Angle
# = Offset
# = Profile
# = Position
# = Corner Mullion
# = Thickness
# = Dimension 1
# = Dimension 2
# = Radius
cmsf_2 = CurtainMullionSystemFamily({"Unknown": -1, "Rectangular": 0, "Circular": 1, "L Corner": 2, "Trapezoid Corner": 3, "Quad Corner": 4, "V Corner": 5}, selected="Unknown")
cmp = CurtainMullionPosition({"Parallel to Ground": 0, "Perpendicular to Face": 1}, selected="Parallel to Ground")
# PANELS
wall_system_family_17 = WallSystemFamily({"Basic": 0, "Curtain": 1, "Stacked": 2}, selected="Curtain")
wall_system_family_18 = WallSystemFamily({"Basic": 0, "Curtain": 1, "Stacked": 2}, selected="Curtain")
wall_system_family_19 = WallSystemFamily({"Basic": 0, "Curtain": 1, "Stacked": 2}, selected="Curtain")
wall_system_family_20 = WallSystemFamily({"Basic": 0, "Curtain": 1, "Stacked": 2}, selected="Curtain")
# TYPES
wall_system_family_21 = WallSystemFamily({"Basic": 0, "Curtain": 1, "Stacked": 2}, selected="Curtain")
wall_system_family_22 = WallSystemFamily({"Basic": 0, "Curtain": 1, "Stacked": 2}, selected="Curtain")
wall_system_family_23 = WallSystemFamily({"Basic": 0, "Curtain": 1, "Stacked": 2}, selected="Curtain")
walls_17 = DocumentWalls(WallSystemFamily=wall_system_family_17)
walls_18 = DocumentWalls(WallSystemFamily=wall_system_family_18)
walls_19 = DocumentWalls(WallSystemFamily=wall_system_family_19)
walls_20 = DocumentWalls(WallSystemFamily=wall_system_family_20)
walls_21 = DocumentWalls(WallSystemFamily=wall_system_family_21)
model_9 = ModelCategoriesPicker({"Air Terminals": -2008013, "Analysis Display Style": -2000304, "Analysis Results": -2000303, "Areas": -2003200, "Bridge Abutments": -2006130, "Bridge Arches": -2006134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}, selected="Curtain Panels": -2000170)
walls_22 = DocumentWalls(WallSystemFamily=wall_system_family_22)
walls_23 = DocumentWalls(WallSystemFamily=wall_system_family_23)
model_10 = ModelCategoriesPicker({"Air Terminals": -2008013, "Analysis Display Style": -2000304, "Analysis Results": -2000303, "Areas": -2003200, "Bridge Abutments": -2006130, "Bridge Arches": -2006134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}, selected="Curtain Panels": -2000170)
model_11 = ModelCategoriesPicker({"Air Terminals": -2008013, "Analysis Display Style": -2000304, "Analysis Results": -2000303, "Areas": -2003200, "Bridge Abutments": -2006130, "Bridge Arches": -2006134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}, selected="Curtain Panels": -2000170)
model_12 = ModelCategoriesPicker({"Air Terminals": -2008013, "Analysis Display Style": -2000304, "Analysis Results": -2000303, "Areas": -2003200, "Bridge Abutments": -2006130, "Bridge Arches": -2006134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}, selected="Curtain Panels": -2000170)
analyze_curtain_wall_13 = AnalyzeCurtainWall(CurtainWall=walls_17)  # -> CurtainGrid, HostWall
analyze_curtain_wall_14 = AnalyzeCurtainWall(CurtainWall=walls_18)  # -> CurtainGrid, HostWall
analyze_curtain_wall_15 = AnalyzeCurtainWall(CurtainWall=walls_19)  # -> CurtainGrid, HostWall
analyze_curtain_wall_16 = AnalyzeCurtainWall(CurtainWall=walls_20)  # -> CurtainGrid, HostWall
analyze_curtain_wall_17 = AnalyzeCurtainWall(CurtainWall=walls_21)  # -> CurtainGrid, HostWall
analyze_curtain_wall_18 = AnalyzeCurtainWall(CurtainWall=walls_22)  # -> CurtainGrid, HostWall
analyze_curtain_wall_19 = AnalyzeCurtainWall(CurtainWall=walls_23)  # -> CurtainGrid, HostWall
model_13 = ModelCategoriesPicker({"Air Terminals": -2008013, "Analysis Display Style": -2000304, "Analysis Results": -2000303, "Areas": -2003200, "Bridge Abutments": -2006130, "Bridge Arches": -2006134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}, selected="Curtain Systems": -2000340)
model_14 = ModelCategoriesPicker({"Air Terminals": -2008013, "Analysis Display Style": -2000304, "Analysis Results": -2000303, "Areas": -2003200, "Bridge Abutments": -2006130, "Bridge Arches": -2006134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}, selected="Curtain Systems": -2000340)
# CURTAIN SYSTEMS
model_15 = ModelCategoriesPicker({"Air Terminals": -2008013, "Analysis Display Style": -2000304, "Analysis Results": -2000303, "Areas": -2003200, "Bridge Abutments": -2006130, "Bridge Arches": -2006134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}, selected="Curtain Systems": -2000340)
analyze_curtain_grid_11 = AnalyzeCurtainGrid(CurtainGrid=analyze_curtain_wall_13.CurtainGrid)  # -> Cells, Mullions, Panels, VerticalLines, VerticalAngle, VerticalJustification, VerticalOffset, HorizontalLines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
analyze_curtain_grid_12 = AnalyzeCurtainGrid(CurtainGrid=analyze_curtain_wall_14.CurtainGrid)  # -> Cells, Mullions, Panels, VerticalLines, VerticalAngle, VerticalJustification, VerticalOffset, HorizontalLines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
analyze_curtain_grid_13 = AnalyzeCurtainGrid(CurtainGrid=analyze_curtain_wall_15.CurtainGrid)  # -> Cells, Mullions, Panels, VerticalLines, VerticalAngle, VerticalJustification, VerticalOffset, HorizontalLines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
analyze_curtain_grid_14 = AnalyzeCurtainGrid(CurtainGrid=analyze_curtain_wall_16.CurtainGrid)  # -> Cells, Mullions, Panels, VerticalLines, VerticalAngle, VerticalJustification, VerticalOffset, HorizontalLines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
analyze_curtain_grid_15 = AnalyzeCurtainGrid(CurtainGrid=analyze_curtain_wall_17.CurtainGrid)  # -> Cells, Mullions, Panels, VerticalLines, VerticalAngle, VerticalJustification, VerticalOffset, HorizontalLines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
bycategory_9 = CategoryFilter(Categories=model_9, Inverted=False)
analyze_curtain_grid_16 = AnalyzeCurtainGrid(CurtainGrid=analyze_curtain_wall_18.CurtainGrid)  # -> Cells, Mullions, Panels, VerticalLines, VerticalAngle, VerticalJustification, VerticalOffset, HorizontalLines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
analyze_curtain_grid_17 = AnalyzeCurtainGrid(CurtainGrid=analyze_curtain_wall_19.CurtainGrid)  # -> Cells, Mullions, Panels, VerticalLines, VerticalAngle, VerticalJustification, VerticalOffset, HorizontalLines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
bycategory_10 = CategoryFilter(Categories=model_10, Inverted=False)
bycategory_11 = CategoryFilter(Categories=model_11, Inverted=False)
bycategory_12 = CategoryFilter(Categories=model_12, Inverted=False)
analyze_panel = AnalyzePanel(Panel=analyze_curtain_grid_14.Panels)  # -> Type, HostPanel, BasePoint, Orientation, Width, Height
panel_13 = Panel(analyze_curtain_grid_13.Panels)
geometry_3 = ElementGeometry(Elements=analyze_curtain_grid_11.Panels)
filter_elements = GhPythonScript(FE=analyze_curtain_grid_15.Panels, F=bycategory_9)  # -> E; inputs FE: tree
# ---------- filter_elements: Python ----------
import clr
clr.AddReference('System.Core')
clr.AddReference('RhinoInside.Revit')
clr.AddReference('RhinoInside.Revit.GH')
clr.AddReference('RevitAPI') 
clr.AddReference('RevitAPIUI')

from System import Enum
from System.Collections.Generic import List

import rhinoscriptsyntax as rs
import ghpythonlib as gh
import Rhino
import RhinoInside
import Grasshopper
from Grasshopper.Kernel import GH_RuntimeMessageLevel as RML
from RhinoInside.Revit import Revit, Convert
from Autodesk.Revit import DB

# active Revit verison
REVIT_VERSION = Revit.ActiveUIApplication.Application.VersionNumber

# access the active document object
doc = Revit.ActiveDBDocument

def show_warning(msg):
    ghenv.Component.AddRuntimeMessage(RML.Warning, msg)

def show_error(msg):
    ghenv.Component.AddRuntimeMessage(RML.Error, msg)

def show_remark(msg):
    ghenv.Component.AddRuntimeMessage(RML.Remark, msg)


def filter_tree(child, filterfunc=None):
    branch = []
    for item in child:
        if isinstance(item, list):
            branch.append(filter_tree(item, filterfunc=filterfunc))
        elif filterfunc(item):
            branch.append(
                RhinoInside.Revit.GH.Types.Panel(item)
            )
    return branch

if FE and isinstance(F, DB.ElementFilter):
    # cleanup negative indices
    FE.RenumberPaths()
    # convert tree into list of lists
    fe_tree = gh.treehelpers.tree_to_list(FE)
    # filter tree by element_filtere
    ftree = filter_tree(fe_tree, filterfunc=lambda x: isinstance(x, DB.Element) and F.PassesFilter(x))
    E = gh.treehelpers.list_to_tree(ftree)
# ---------- end filter_elements ----------
filter_elements_2 = GhPythonScript(FE=analyze_curtain_grid_16.Panels, F=bycategory_10)  # -> E; inputs FE: tree; same code as filter_elements
filter_elements_3 = GhPythonScript(FE=analyze_curtain_grid_17.Panels, F=bycategory_11)  # -> E; inputs FE: tree; same code as filter_elements
bycategory_13 = ElementCategoryFilter(Categories=model_14, Inverted=False)
analyze_panel_2 = AnalyzePanel(Panel=filter_elements_2)  # -> Type, HostPanel, BasePoint, Orientation, Width, Height
bycategory_14 = ElementCategoryFilter(Categories=model_15, Inverted=False)
bycategory_15 = ElementCategoryFilter(Categories=model_13, Inverted=False)
analyze_panel_3 = AnalyzePanel(Panel=filter_elements)  # -> Type, HostPanel, BasePoint, Orientation, Width, Height
geometry_4 = ElementGeometry(Elements=filter_elements)
analyze_panel_4 = AnalyzePanel(Panel=filter_elements_3)  # -> Type, HostPanel, BasePoint, Orientation, Width, Height
filter_elements_4 = GhPythonScript(FE=analyze_curtain_grid_12.Panels, F=bycategory_12)  # -> E; inputs FE: tree; same code as filter_elements
grid_insert_geom = CustomPreview(Geometry=geometry_3, Material=ColourSwatch(SwatchColor=RGBA(219, 0, 255, 23)))
panel_symbol = Panel(analyze_panel.Type)
host_panel = Panel(analyze_panel.HostPanel)
panel_base_point = Panel(analyze_panel.BasePoint)
panel_orientation_vector = Panel(analyze_panel.Orientation)
elements_5 = DocumentElements(Filter=bycategory_14)
elements_6 = DocumentElements(Filter=bycategory_15)
types_5 = QueryTypes(Filter=bycategory_13)
path_mapper_9 = PathMapper([analyze_panel.Width, analyze_panel.Height], source="{A;B;C;D}(i)", target="{A;B;C;D;i}")
panel_14 = Panel(analyze_panel_2.Type)
analyze_panel_type = AnalyzePanelType(PanelType=analyze_panel_4.Type)  # -> Family, Offset, Thickness
analyze_panel_5 = AnalyzePanel(Panel=filter_elements_4)  # -> Type, HostPanel, BasePoint, Orientation, Width, Height
item = ListItem(List=geometry_4, Index=0, Wrap=True)
grid_insert_geom_2 = CustomPreview(Geometry=geometry_4, Material=ColourSwatch(SwatchColor=RGBA(219, 0, 255, 23)))
cset = CreateSet(List=panel_13)  # -> Set, Map
a_cst = AnalyzeCurtainSystemType(CurtainSystemType=types_5)  # -> CurtainPanel, JoinCondition, Grid1Layout, Grid1Spacing, Grid1AdjustForMullionSize, Grid2Layout, Grid2Spacing, Grid2AdjustForMullionSize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
analyze_curtain_system = AnalyzeCurtainSystem(CurtainSystem=elements_5)
analyze_curtain_system_2 = AnalyzeCurtainSystem(CurtainSystem=elements_6)
panel_symbol_2 = Panel(analyze_panel_5.Type)
pshift_2 = ShiftPaths(Data=item, Offset=-1)
path_mapper_10 = PathMapper(
    [analyze_panel_type.Family, analyze_panel_type.Offset, analyze_panel_type.Thickness],
    source="{A;B;C}(i)",
    target="{A;B;C;i}")
grid_insert_types = Panel(cset.Set)
panel_centroids = VolumeMoments(Geometry=pshift_2, UseTasks=True)  # -> Volume, Centroid, Inertia, InertiaError, Secondary, SecondaryError, Gyration
panel_15 = Panel(analyze_curtain_system)
analyze_curtain_grid_18 = AnalyzeCurtainGrid(CurtainGrid=analyze_curtain_system_2)  # -> CurtainGridCells, CurtainGridMullions, CurtainGridPanels, CurtainGridLinesAlongUAxis, CurtainGridAngleUAxisGrid1, CurtainGridAlignmentTypeUAxisGrid1, CurtainGridOffsetUAxisGrid1, CurtainGridLinesAlongVAxis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
# = Lockable?
# = Width
# = Height
panel_info = Panel(path_mapper_9)
mullion_type_properties_2 = Panel(path_mapper_10)
path_mapper_11 = PathMapper([a_cst.Grid1Layout, a_cst.Grid1Spacing, a_cst.Grid1AdjustForMullionSize], source="{A;B}(i)", target="{A;B;i}")
path_mapper_12 = PathMapper([a_cst.Grid2Layout, a_cst.Grid2Spacing, a_cst.Grid2AdjustForMullionSize], source="{A;B}(i)", target="{A;B;i}")
path_mapper_13 = PathMapper(
    [a_cst.Grid1MullionsInteriorType, a_cst.Grid1MullionsBorder1Type, a_cst.Grid1MullionsBorder2Type],
    source="{A;B}(i)",
    target="{A;B;i}")
path_mapper_14 = PathMapper(
    [a_cst.Grid2MullionsInteriorType, a_cst.Grid2MullionsBorder1Type, a_cst.Grid2MullionsBorder2Type],
    source="{A;B}(i)",
    target="{A;B;i}")
curtain_join_condition_2 = Panel(a_cst.JoinCondition)
curtain_panel_type_2 = Panel(a_cst.CurtainPanel)
panel_16 = Panel(analyze_curtain_grid_18.CurtainGridPanels)
panel_normals = VectorDisplayEx(
    Point=analyze_panel_3.BasePoint,
    Vector=analyze_panel_3.Orientation,
    Colour=ColourSwatch(SwatchColor=RGB(89, 0, 255)),
    Width=1)
panel_normals_2 = VectorDisplayEx(
    Point=panel_centroids.Centroid,
    Vector=analyze_panel_3.Orientation,
    Colour=ColourSwatch(SwatchColor=RGB(255, 255, 0)),
    Width=1)
cset_2 = CreateSet(List=panel_14)  # -> Set, Map
panel_17 = Panel(cset_2.Set)
u_grid_info_3 = Panel(path_mapper_11)
v_grid_info_3 = Panel(path_mapper_12)
u_mullion_info_2 = Panel(path_mapper_13)
v_mullion_info_2 = Panel(path_mapper_14)
cgjc_2 = CurtainGridJoinCondition({"Not Defined": 0, "Vertical Grid Continuous": 1, "Horizontal Grid Continuous": 2, "Border & Vertical Grid Continuous": 3, "Border & Horizontal Grid Continuous": 4}, selected="Not Defined")
# = Layout
# = Spacing
# = Adjust for Mullion Size
# = Grid 1 Inteiror Mullion Type
# = Start Mullion Type (Border 1)
# = End Mullion Type (Border 2)
# = Grid 2 Inteiror Mullion Type
# = Start Mullion Type (Border 1)
# = End Mullion Type (Border 2)
cgl_3 = CurtainGridLayout({"None": 0, "Fixed Distance": 1, "Fixed Number": 2, "Maximum Spacing": 3, "Minimum Spacing": 4}, selected="None")
# = Layout
# = Spacing
# = Adjust for Mullion Size
cgl_4 = CurtainGridLayout({"None": 0, "Fixed Distance": 1, "Fixed Number": 2, "Maximum Spacing": 3, "Minimum Spacing": 4}, selected="None")
# GRID LINES - MULLIONS AND PANELS
# = Panel System Family
# = Offset
# = Thickness
wall_system_family_24 = WallSystemFamily({"Basic": 0, "Curtain": 1, "Stacked": 2}, selected="Curtain")
wall_system_family_25 = WallSystemFamily({"Basic": 0, "Curtain": 1, "Stacked": 2}, selected="Curtain")
wall_system_family_26 = WallSystemFamily({"Basic": 0, "Curtain": 1, "Stacked": 2}, selected="Curtain")
# GRID LINES
wall_system_family_27 = WallSystemFamily({"Basic": 0, "Curtain": 1, "Stacked": 2}, selected="Curtain")
wall_system_family_28 = WallSystemFamily({"Basic": 0, "Curtain": 1, "Stacked": 2}, selected="Curtain")
wall_system_family_29 = WallSystemFamily({"Basic": 0, "Curtain": 1, "Stacked": 2}, selected="Curtain")
walls_24 = DocumentWalls(WallSystemFamily=wall_system_family_24)
walls_25 = DocumentWalls(WallSystemFamily=wall_system_family_25)
walls_26 = DocumentWalls(WallSystemFamily=wall_system_family_26)
walls_27 = DocumentWalls(WallSystemFamily=wall_system_family_27)
walls_28 = DocumentWalls(WallSystemFamily=wall_system_family_28)
walls_29 = DocumentWalls(WallSystemFamily=wall_system_family_29)
analyze_curtain_wall_20 = AnalyzeCurtainWall(CurtainWall=walls_24)  # -> CurtainGrid, HostWall
analyze_curtain_wall_21 = AnalyzeCurtainWall(CurtainWall=walls_25)  # -> CurtainGrid, HostWall
analyze_curtain_wall_22 = AnalyzeCurtainWall(CurtainWall=walls_26)  # -> CurtainGrid, HostWall
analyze_curtain_wall_23 = AnalyzeCurtainWall(CurtainWall=walls_27)  # -> CurtainGrid, HostWall
analyze_curtain_wall_24 = AnalyzeCurtainWall(CurtainWall=walls_28)  # -> CurtainGrid, HostWall
analyze_curtain_wall_25 = AnalyzeCurtainWall(CurtainWall=walls_29)  # -> CurtainGrid, HostWall
analyze_curtain_grid_19 = AnalyzeCurtainGrid(CurtainGrid=analyze_curtain_wall_20.CurtainGrid)  # -> Cells, Mullions, Panels, VerticalLines, VerticalAngle, VerticalJustification, VerticalOffset, HorizontalLines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
analyze_curtain_grid_20 = AnalyzeCurtainGrid(CurtainGrid=analyze_curtain_wall_21.CurtainGrid)  # -> Cells, Mullions, Panels, VerticalLines, VerticalAngle, VerticalJustification, VerticalOffset, HorizontalLines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
analyze_curtain_grid_21 = AnalyzeCurtainGrid(CurtainGrid=analyze_curtain_wall_22.CurtainGrid)  # -> Cells, Mullions, Panels, VerticalLines, VerticalAngle, VerticalJustification, VerticalOffset, HorizontalLines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
analyze_curtain_grid_22 = AnalyzeCurtainGrid(CurtainGrid=analyze_curtain_wall_23.CurtainGrid)  # -> Cells, Mullions, Panels, VerticalLines, VerticalAngle, VerticalJustification, VerticalOffset, HorizontalLines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
analyze_curtain_grid_23 = AnalyzeCurtainGrid(CurtainGrid=analyze_curtain_wall_24.CurtainGrid)  # -> Cells, Mullions, Panels, VerticalLines, VerticalAngle, VerticalJustification, VerticalOffset, HorizontalLines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
analyze_curtain_grid_24 = AnalyzeCurtainGrid(CurtainGrid=analyze_curtain_wall_25.CurtainGrid)  # -> Cells, Mullions, Panels, VerticalLines, VerticalAngle, VerticalJustification, VerticalOffset, HorizontalLines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
a_cgl = AnalyzeCurtainGridLine(CurtainGridLine=analyze_curtain_grid_19.VerticalLines)  # -> Curve, Segments, ExistingSegments, SkippedSegments, AttachedMullions, AttachedPanels
a_cgl_2 = AnalyzeCurtainGridLine(CurtainGridLine=analyze_curtain_grid_19.HorizontalLines)  # -> Curve, Segments, ExistingSegments, SkippedSegments, AttachedMullions, AttachedPanels
a_cgl_3 = AnalyzeCurtainGridLine(CurtainGridLine=analyze_curtain_grid_20.VerticalLines)  # -> Curve, Segments, ExistingSegments, SkippedSegments, AttachedMullions, AttachedPanels
a_cgl_4 = AnalyzeCurtainGridLine(CurtainGridLine=analyze_curtain_grid_20.HorizontalLines)  # -> Curve, Segments, ExistingSegments, SkippedSegments, AttachedMullions, AttachedPanels
crv_2 = Curve(analyze_curtain_grid_22.HorizontalLines)
crv_3 = Curve(analyze_curtain_grid_22.VerticalLines)
a_cgl_5 = AnalyzeCurtainGridLine(CurtainGridLine=analyze_curtain_grid_23.VerticalLines)  # -> Curve, Segments, ExistingSegments, SkippedSegments, AttachedMullions, AttachedPanels
a_cgl_6 = AnalyzeCurtainGridLine(CurtainGridLine=analyze_curtain_grid_21.VerticalLines)  # -> Curve, Segments, ExistingSegments, SkippedSegments, AttachedMullions, AttachedPanels
a_cgl_7 = AnalyzeCurtainGridLine(CurtainGridLine=analyze_curtain_grid_21.HorizontalLines)  # -> Curve, Segments, ExistingSegments, SkippedSegments, AttachedMullions, AttachedPanels
item_2 = ListItem(List=analyze_curtain_grid_24.VerticalLines, Index=Slider(1, range=0..1), Wrap=True)
item_3 = ListItem(List=analyze_curtain_grid_24.HorizontalLines, Index=Slider(0, range=0..5), Wrap=True)
grid_cell_geom_2 = CustomPreview(Geometry=crv_3, Material=ColourSwatch(SwatchColor=RGB(255, 255, 255)))
grid_cell_geom_3 = CustomPreview(Geometry=crv_2, Material=ColourSwatch(SwatchColor=RGB(255, 255, 255)))
grid_cell_geom_4 = CustomPreview(Geometry=a_cgl_3.Segments, Material=ColourSwatch(SwatchColor=RGB(255, 255, 255)))
grid_cell_geom_5 = CustomPreview(Geometry=a_cgl_4.Segments, Material=ColourSwatch(SwatchColor=RGB(222, 222, 222)))
a_cgl_8 = AnalyzeCurtainGridLine(CurtainGridLine=item_2)  # -> Curve, Segments, ExistingSegments, SkippedSegments, AttachedMullions, AttachedPanels
a_cgl_9 = AnalyzeCurtainGridLine(CurtainGridLine=item_3)  # -> Curve, Segments, ExistingSegments, SkippedSegments, AttachedMullions, AttachedPanels
grid_cell_geom_6 = CustomPreview(Geometry=a_cgl_7.Curve, Material=ColourSwatch(SwatchColor=RGB(222, 222, 222)))
grid_cell_geom_7 = CustomPreview(Geometry=a_cgl_6.Curve, Material=ColourSwatch(SwatchColor=RGB(255, 255, 255)))
geometry_5 = ElementGeometry(Elements=a_cgl.AttachedMullions)
mullion_geom = CustomPreview(Geometry=a_cgl.Curve, Material=ColourSwatch(SwatchColor=RGB(76, 76, 76)))
geometry_6 = ElementGeometry(Elements=a_cgl_2.AttachedMullions)
grid_line_curve = Panel(a_cgl_5.Curve)
grid_line_segments = Panel(a_cgl_5.Segments)
kept_line_segments = Panel(a_cgl_5.ExistingSegments)
skipped_line_segments = Panel(a_cgl_5.SkippedSegments)
attached_mullions = Panel(a_cgl_5.AttachedMullions)
attached_panels = Panel(a_cgl_5.AttachedPanels)
geometry_7 = ElementGeometry(Elements=a_cgl_9.AttachedPanels)
geometry_8 = ElementGeometry(Elements=a_cgl_8.AttachedPanels)
mullion_geom_2 = CustomPreview(Geometry=geometry_5, Material=ColourSwatch(SwatchColor=RGBA(0, 111, 255, 23)))
mullion_geom_3 = CustomPreview(Geometry=geometry_6, Material=ColourSwatch(SwatchColor=RGBA(0, 242, 255, 23)))
mullion_geom_4 = CustomPreview(Geometry=geometry_7, Material=ColourSwatch(SwatchColor=RGBA(255, 0, 119, 23)))
mullion_geom_5 = CustomPreview(Geometry=geometry_8, Material=ColourSwatch(SwatchColor=RGBA(221, 0, 255, 23)))
