# Grasshopper definition Links_Native.ghx (Grasshopper 1.0.7)
# plug-ins: Rhino.Inside for Autodesk Revit

model = ModelCategoriesPicker()
all_documents = AllDocuments()  # -> Projects, Families
model_2 = ModelCategoriesPicker()
dl = DocumentLinks()
dl_2 = DocumentLinks()
dl_3 = DocumentLinks(Document=all_documents.Projects)
bycategory = CategoryFilter(Categories=model, Inverted=False)
panel = Panel(dl)
panel_2 = Panel(dl_2)
bycategory_2 = CategoryFilter(Categories=model_2, Inverted=False)
elements = DocumentElements(Document=dl_2, Filter=bycategory)
panel_3 = Panel(dl_3)
elements_2 = DocumentElements(Document=dl_3, Filter=bycategory_2)
panel_4 = Panel(elements)
panel_5 = Panel(elements_2)
