# Grasshopper definition Materials_Native.ghx (Grasshopper 1.0.7)
# plug-ins: Rhino.Inside for Autodesk Revit

materials = QueryMaterials()
materials_2 = QueryMaterials(Name=";Analytical")
materials_3 = QueryMaterials(Name="Default Roof")
materials_4 = QueryMaterials(Name="Default Roof")
materials_5 = QueryMaterials(Name="Default Roof")
find_fill_pattern = FindFillPattern(F="Diagonal Up")  # -> FP
# ---------- find_fill_pattern: Python ----------
import clr
clr.AddReference('System.Core')
clr.AddReference('RhinoInside.Revit')
clr.AddReference('RevitAPI') 
clr.AddReference('RevitAPIUI')

from System import Enum

import rhinoscriptsyntax as rs
import Rhino
import RhinoInside
import Grasshopper
from RhinoInside.Revit import Revit, Convert
from Autodesk.Revit import DB

doc = Revit.ActiveDBDocument


views = DB.FilteredElementCollector(doc).OfClass(DB.View).WhereElementIsNotElementType().ToElements()

def get_all_fillpatterns():
    return DB.FilteredElementCollector(doc)\
             .OfClass(DB.FillPatternElement)\
             .ToElements()


def find_solid_fillpat():
    for pat in get_all_fillpatterns():
        fpat = pat.GetFillPattern()
        if fpat.IsSolidFill:
            if (M and fpat.Target == DB.FillPatternTarget.Model) or fpat.Target == DB.FillPatternTarget.Drafting:
                return pat

def find_matching_fillpat(filter_str):
    filter_str = filter_str.lower()
    for pat in get_all_fillpatterns():
        fpat = pat.GetFillPattern()
        if fpat.Name.lower() == filter_str:
            if (M and fpat.Target == DB.FillPatternTarget.Model) or fpat.Target == DB.FillPatternTarget.Drafting:
                return pat

if isinstance(F, str):
    if F.lower() == 'solid':
        FP = find_solid_fillpat()
    else:
        FP = find_matching_fillpat(F)
# ---------- end find_fill_pattern ----------
materials_6 = QueryMaterials(Name="Default Roof")
graphics = MaterialGraphics(Material=materials_5)  # -> Material, UseRenderAppearance, Color, SurfaceForegroundPattern, SurfaceForegroundColor, SurfaceBackgroundPattern, SurfaceBackgroundColor, CutForegroundPattern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
identity = MaterialIdentity(Material=materials_3)  # -> Name, Description, Class, Comments, Manufacturer, Model, Cost, URL, Keynote, Mark
identity_2 = MaterialIdentity(Material=materials_4, Manufacturer="Roof Manufacturer")  # -> Name, Description, Class, Comments, Manufacturer, Model, Cost, URL, Keynote, Mark
panel = Panel(materials)
panel_2 = Panel(materials_2)
graphics_2 = MaterialGraphics(Material=materials_6, SurfaceForegroundPattern=find_fill_pattern)  # -> Material, UseRenderAppearance, Color, SurfaceForegroundPattern, SurfaceForegroundColor, SurfaceBackgroundPattern, SurfaceBackgroundColor, CutForegroundPattern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
panel_3 = Panel([graphics.UseRenderAppearance, graphics.Color, graphics.SurfaceForegroundPattern, graphics.SurfaceForegroundColor, graphics.SurfaceBackgroundPattern, graphics.SurfaceBackgroundColor, graphics.CutForegroundPattern, graphics.CutForegroundColor, graphics.CutBackgroundPattern, graphics.CutBackgroundColor])
panel_4 = Panel([identity.Name, identity.Description, identity.Class, identity.Comments, identity.Manufacturer, identity.Model, identity.Cost, identity.URL, identity.Keynote, identity.Mark])
panel_5 = Panel([identity_2.Name, identity_2.Description, identity_2.Class, identity_2.Comments, identity_2.Manufacturer, identity_2.Model, identity_2.Cost, identity_2.URL, identity_2.Keynote, identity_2.Mark])
panel_6 = Panel([graphics_2.UseRenderAppearance, graphics_2.Color, graphics_2.SurfaceForegroundPattern, graphics_2.SurfaceForegroundColor, graphics_2.SurfaceBackgroundPattern, graphics_2.SurfaceBackgroundColor, graphics_2.CutForegroundPattern, graphics_2.CutForegroundColor, graphics_2.CutBackgroundPattern, graphics_2.CutBackgroundColor])
number_slider = Slider(12, range=0..100)
construct_checker_asset = ConstructCheckerAsset(
    Color1=ColourSwatch(SwatchColor=RGB(230, 28, 28)),
    Color2=ColourSwatch(SwatchColor=RGB(54, 173, 217)),
    SizeU=number_slider,
    SizeV=number_slider)
material = CreateMaterial(Name="New Material")
materials_7 = QueryMaterials(Name="Default")
materials_8 = QueryMaterials(Name="Default")
material_2 = CreateMaterial(Name="New Material")
create_appearance_asset_generic = CreateAppearanceAssetGeneric(Name="New Generic", Color=ColourSwatch(SwatchColor=RGB(0, 229, 255)))
create_appearance_asset_generic_2 = CreateAppearanceAssetGeneric(
    Name="Another Generic",
    Color=ColourSwatch(SwatchColor=RGB(97, 97, 97)),
    Image=construct_checker_asset,
    ImageFade=Slider(1, range=0..1))
graphics_3 = MaterialGraphics(Material=material, Color=ColourSwatch(SwatchColor=RGB(255, 94, 0)))  # -> Material, UseRenderAppearance, Color, SurfaceForegroundPattern, SurfaceForegroundColor, SurfaceBackgroundPattern, SurfaceBackgroundColor, CutForegroundPattern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
extract_material_s_assets = ExtractMaterialsAssets(Material=materials_7)  # -> AppearanceAsset, PhysicalAsset, ThermalAsset
extract_material_s_assets_2 = ExtractMaterialsAssets(Material=materials_8)  # -> AppearanceAsset, PhysicalAsset, ThermalAsset
panel_7 = Panel(create_appearance_asset_generic)
panel_8 = Panel(material_2)
panel_9 = Panel(create_appearance_asset_generic_2)
panel_10 = Panel(graphics_3.Material)
analyze_appearance_asset_generic = AnalyzeAppearanceAssetGeneric(AppearanceAssetGeneric=extract_material_s_assets.AppearanceAsset)  # -> Name, Description, Keywords, Color, Image, ImageFade, Glossiness, MetallicHighlights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
modify_appearance_asset_generic = ModifyAppearanceAssetGeneric(AppearanceAssetGeneric=extract_material_s_assets_2.AppearanceAsset, Color=ColourSwatch(SwatchColor=RGB(0, 30, 255)))
materials_9 = QueryMaterials(Name="Default")
materials_10 = QueryMaterials(Name="Default Roof")
panel_11 = Panel(modify_appearance_asset_generic)
panel_12 = Panel([analyze_appearance_asset_generic.Name, analyze_appearance_asset_generic.Description, analyze_appearance_asset_generic.Color])
r_mast = ReplaceMaterialsAssets(Material=materials_9, AppearanceAsset=create_appearance_asset_generic)
r_mast_2 = ReplaceMaterialsAssets(Material=materials_10, AppearanceAsset=create_appearance_asset_generic_2)
panel_13 = Panel(r_mast)
panel_14 = Panel(r_mast_2)
materials_11 = QueryMaterials(Name="Aluminum")
materials_12 = QueryMaterials(Name="Aluminum")
materials_13 = QueryMaterials(Name="Orange")
extract_material_s_assets_3 = ExtractMaterialsAssets(Material=materials_12)  # -> AppearanceAsset, PhysicalAsset, ThermalAsset
extract_material_s_assets_4 = ExtractMaterialsAssets(Material=materials_11)  # -> AppearanceAsset, PhysicalAsset, ThermalAsset
physical_thermal_asset_behaviour = MaterialBehaviour({"Isotropic": 0, "Orthotropic": 1, "Transverse Isotropic": 2}, selected="Orthotropic")
physical_thermal_asset_behaviour_2 = MaterialBehaviour({"Isotropic": 0, "Orthotropic": 1, "Transverse Isotropic": 2}, selected="Transverse Isotropic")
number_slider_2 = Slider(1.7e-05, range=0..2.8e-05)
number_slider_3 = Slider(798.2, range=-1000..1000)
r_mast_3 = ReplaceMaterialsAssets(Material=materials_13, AppearanceAsset=extract_material_s_assets_3.AppearanceAsset)
physical_asset_type = PhysicalMaterialType({"Generic": 2, "Basic": 1, "Concrete": 4, "Gas": 7, "Liquid": 6, "Metal": 3, "Plastic": 8, "Wood": 5}, selected="Wood")
panel_15 = Panel(extract_material_s_assets_4.AppearanceAsset)
panel_16 = Panel(extract_material_s_assets_4.ThermalAsset)
panel_17 = Panel(extract_material_s_assets_4.PhysicalAsset)
thermal_asset_type = ThermalMaterialType({"Gas": 1, "Liquid": 2, "Solid": 3}, selected="Gas")
panel_18 = Panel(r_mast_3)
create_physical_asset = CreatePhysicalAsset(
    Name="Custom Physical Asset",
    Type=physical_asset_type,
    Behaviour=physical_thermal_asset_behaviour,
    ThermalExpansionCoefficientX=number_slider_2,
    ThermalExpansionCoefficientY=number_slider_2,
    ThermalExpansionCoefficientZ=number_slider_2,
    YoungsModulusX=number_slider_3,
    YoungsModulusY=number_slider_3,
    YoungsModulusZ=Slider(188549.06, range=0..1000000),
    Density=Slider(4.3, range=0..10))
create_thermal_asset = CreateThermalAsset(
    Name="Custom Thermal Asset",
    Type=thermal_asset_type,
    Behaviour=physical_thermal_asset_behaviour_2,
    ThermalConductivity=Slider(2819, range=0..10000),
    GasViscosity=Slider(4.3, range=0..10))
panel_19 = Panel(create_thermal_asset)
panel_20 = Panel(create_physical_asset)
