# Grasshopper definition rir-nodeincode.ghx (Grasshopper 1.0.7)

brep = Brep([<brep referenced from the Rhino model> x2])
brep_2 = Brep([<brep referenced from the Rhino model> x2])
make_directshape = GhPythonScript(BREP=brep)  # -> DS; inputs BREP: list of Brep; disabled
# ---------- make_directshape: Python ----------
import clr
clr.AddReference('System.Core')
clr.AddReference('RhinoInside.Revit')
clr.AddReference('RevitAPI') 
clr.AddReference('RevitAPIUI')

import System
import Rhino
from Grasshopper.Kernel import GH_RuntimeMessageLevel as RML

# bring in the node-in-code handle
from Rhino.NodeInCode import Components

# Revit API
from Autodesk.Revit import DB

from RhinoInside.Revit import Revit


def show_warning(msg):
    ghenv.Component.AddRuntimeMessage(RML.Warning, msg)

def show_error(msg):
    ghenv.Component.AddRuntimeMessage(RML.Error, msg)

def show_remark(msg):
    ghenv.Component.AddRuntimeMessage(RML.Remark, msg)


add_material = Components.FindComponent("RhinoInside_AddMaterial")
# and AddGeometryDirectShape to create a DirectShape element in Revit
add_geom_directshape = Components.FindComponent("RhinoInside_AddGeometryDirectShape")


def get_category(category_name):
    doc = Revit.ActiveDBDocument
    for cat in doc.Settings.Categories:
        if cat.Name == category_name:
            return cat



if not (add_material and add_geom_directshape):
    show_error("One or more of the necessary components are not available as node-in-code")

if BREP:
    # create a color object. modify the logic as you wish
    color = System.Drawing.Color.FromName("DeepSkyBlue")
    
    # now create the material using the node-in-code
    # note that just like the Grasshopper component, the node-in-code also
    # takes 3 inputs in the exact same order (top to bottom)
    new_material = add_material.Invoke("Sky Material", True, color)

    # and now use the AddGeometryDirectShape node-in-code to
    # create the DirectShape element in Revit
    # note that BREP is our input Brep object
    ds_element = add_geom_directshape.Invoke(
        "Custom DS",
        get_category("Walls"),
        BREP,
        new_material[0]
        )
    
    # assign the new DirectShape element to output
    DS = ds_element[0]
# ---------- end make_directshape ----------
make_directshape_2 = CSharpScript(
    BREP=brep_2,
    Reference=["C:\Users\ehsan\AppData\Roaming\Autodesk\Revit\Addins\2020\RhinoInside.Revit\RhinoInside.Revit.dll", "C:\Program Files\Autodesk\Revit 2020\RevitAPI.dll", "C:\Program Files\Autodesk\Revit 2020\RevitAPIUI.dll"])  # -> out, DS; disabled
# ---------- make_directshape_2: C# usings ----------
using DB = Autodesk.Revit.DB;
using UI = Autodesk.Revit.UI;

using RIR = RhinoInside.Revit;
// add extensions methods as well
// this allows calling .ToXXX() convertor methods on Revit objects
using RhinoInside.Revit.Convert.Geometry;

using Rhino.NodeInCode;
# ---------- make_directshape_2: C# ----------
    // AddMaterial component to create a material
    var addMaterial = Components.FindComponent("RhinoInside_AddMaterial");
    // and AddGeometryDirectShape to create a DirectShape element in Revit
    var addGeomDirectshape = Components.FindComponent("RhinoInside_AddGeometryDirectShape");
    
    if (addMaterial == null || addGeomDirectshape == null) {
      throw new Exception("One or more of the necessary components are not available as node-in-code");
    }

    if(BREP != null) {
      // create a color object. modify the logic as you wish
      var color = System.Drawing.Color.FromName("DeepSkyBlue");
  
      // now create the material using the node-in-code
      // note that just like the Grasshopper component, the node-in-code also
      // takes 3 inputs in the exact same order (top to bottom)
      var newMaterials = addMaterial.Invoke("Sky Material", true, color);

      // and now use the AddGeometryDirectShape node-in-code to
      // create the DirectShape element in Revit
      // Notes:
      //    - BREP is our input Brep object
      //    - new_materials is a list of new materials so we are grabbing the first element
      //    - get_category is a function that finds a Revit category from its name
      var dsElements = addGeomDirectshape.Invoke(
        "Custom DS",
        GetCategory("Walls"),
        BREP,
        newMaterials[0]
        );
  
        // assign the new DirectShape element to output
      DS = dsElements[0];
    }
# ---------- make_directshape_2: C# additional code ----------
  public DB.Category GetCategory(string categoryName){
    var doc = RIR.Revit.ActiveDBDocument;
    foreach(DB.Category cat in doc.Settings.Categories) {
      if (cat.Name == categoryName)
        return cat;
    }
    return null;
  }
# ---------- end make_directshape_2 ----------
panel = Panel(make_directshape)
panel_2 = Panel(make_directshape_2.out)
panel_3 = Panel(make_directshape_2.DS)
