# Grasshopper definition script_example.gh (Grasshopper 1.0.7)
# plug-ins: Rhino.Inside for Autodesk Revit

graphical_element = GraphicalElement(<graphical element referenced from the Revit model>)
ghpython_script = GhPythonScript(E=graphical_element)  # -> G
# ---------- ghpython_script: Python ----------
import clr
clr.AddReference('RhinoInside.Revit')
clr.AddReference('RevitAPI') 

from RhinoInside.Revit import Convert
from Autodesk.Revit import DB


G = Convert.ToRhino(
        E.Geometry[DB.Options()]
    )
# ---------- end ghpython_script ----------
panel = Panel(ghpython_script)
