# Grasshopper definition wall_example.gh (Grasshopper 1.0.7)
# plug-ins: Rhino.Inside for Autodesk Revit

model = ModelCategoriesPicker({"Air Terminals": -2008013, "Analysis Display Style": -2000304, "Analysis Results": -2000303, "Areas": -2003200, "Bridge Abutments": -2006130, "Bridge Arches": -2006134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}, selected="Walls": -2000011)
elementtype_picker = ElementTypePicker(
    model,
    {": # Template": 291958, ": # Template - 1HR Fire Barrier": 598418, ": # Template - 1HR Fire Barrier - Bearing": 608727, ": # Template - 1HR Fire Barrier - Shear": 608728, ": # Template - 1HR Fire Barrier - ShearBearing": 608729, ": # Template - 1HR Fire Partition": 598467, ": # Template - 1HR Fire Partition - Bearing": 612451, ": # Template - 1HR Fire Partition - Shear": 612454, ": # Template - 1HR Fire Partition - ShearBearing": 612457, ": # Template - 1HR Fire Wall": 612450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}, selected="Curtain Wall : Grid Butt-Join": 1369832)
level = DocumentLevelsPicker({"ROOF": 526693, "MID-LEVEL": 1366453, "1ST FLOOR": 1299}, selected="1ST FLOOR")
crv = Curve(<curve referenced from the Rhino model>)
wall = AddWall(Curve=crv, Type=elementtype_picker, Level=level, Height=Slider(10, range=0..10))
geometry = ElementGeometry(Element=wall)
