# Grasshopper definition column-family-rotation.gh (Grasshopper 1.0.7)
# plug-ins: RhinoInside.Revit

# ---- group: Move the objects to the origin to create the Family definition
brep = Brep([<brep referenced from the Rhino model> x3])
pt = Point([<point referenced from the Rhino model> x9])
item = ListItem(List=pt, Index=0, Wrap=True)
vec2pt = Vector2Pt(PointA=item, PointB=Point(0, 0, 0), Unitize=False)  # -> Vector, Length
move = Move(Geometry=brep, Motion=vec2pt.Vector)  # -> Geometry, Transform

# ----
model = ModelCategoriesPicker({"Air Terminals": -2008013, "Cable Tray Fittings": -2008126, "Cable Trays": -2008130, "Casework": -2001000, "Ceilings": -2000038, "Columns": -2000100, "Communication Devices": -2008081, "Conduit Fittings": -2008128, "Conduits": -2008132, "Curtain Panels": -2000170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}, selected="Columns")
path = FilePath("C:\ProgramData\Autodesk\RVT 2019\Family Templates\English_I\Column.rft")

# ---- group: Create a plane frame that represents rotation on insertion
crv = Curve(<curve referenced from the Rhino model>)
crv_cp = CurveClosestPoint(Point=pt, Curve=crv)  # -> Point, Parameter, Distance
eval = EvaluateCurve(Curve=crv, Parameter=crv_cp.Parameter)  # -> Point, Tangent, Angle
pl = ConstructPlane(Origin=eval.Point, XAxis=eval.Tangent, YAxis=Vector(0, 1, 0))

# ----
level = DocumentLevelsPicker({"Roof": 8808, "Level 2": 2794, "Level 1": 355, "Level 04 - T.O. Fnd. Wall": 5562, "Level 03 - T.O. Basement Slab": 5608, "Level 02 - T.O. Footing": 5631, "Level 01 - B.O. Footing": 5661}, selected="Level 1")
family_new = FamilyNew(
    Template=path,
    OverrideFamily=Toggle(True),
    OverrideParameters=False,
    Name="ColumnRight",
    Category=model,
    Geometry=move.Geometry)
family_gettypes = FamilyGetTypes(Family=family_new)
bylocation = AddFamilyInstanceByLocation(Location=pl, Type=family_gettypes, Level=level)
