# Grasshopper definition structural_revit_to_rhino.gh (Grasshopper 1.0.7)
# plug-ins: RhinoInside.Revit, karambaGH

model = ModelCategoriesPicker({"Air Terminals": -2008013, "Analysis Display Style": -2000304, "Analysis Results": -2000303, "Areas": -2003200, "Bridge Abutments": -2006130, "Bridge Arches": -2006134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}, selected="Structural Framing": -2001320)
model_2 = ModelCategoriesPicker({"Air Terminals": -2008013, "Analysis Display Style": -2000304, "Analysis Results": -2000303, "Areas": -2003200, "Bridge Abutments": -2006130, "Bridge Arches": -2006134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}, selected="Structural Framing": -2001320)
analytical = AnalyticalCategoriesPicker({"Analytical Beams": -2009630, "Analytical Braces": -2009633, "Analytical Columns": -2009636, "Analytical Floors": -2009639, "Analytical Foundation Slabs": -2009643, "Analytical Isolated Foundations": -2009641, "Analytical Links": -2009657, "Analytical Nodes": -2009645, "Analytical Pipe Connections": -2000983, "Analytical Spaces": -2008185, "Analytical Surfaces": -2008186, "Analytical Wall Foundations": -2009642, "Analytical Walls": -2009640, "Boundary Conditions": -2005301, "Structural Internal Loads": -2005204, "Structural Load Cases": -2005210, "Structural Loads": -2005200}, selected="Analytical Columns")
analytical_2 = AnalyticalCategoriesPicker({"Analytical Beams": -2009630, "Analytical Braces": -2009633, "Analytical Columns": -2009636, "Analytical Floors": -2009639, "Analytical Foundation Slabs": -2009643, "Analytical Isolated Foundations": -2009641, "Analytical Links": -2009657, "Analytical Nodes": -2009645, "Analytical Pipe Connections": -2000983, "Analytical Spaces": -2008185, "Analytical Surfaces": -2008186, "Analytical Wall Foundations": -2009642, "Analytical Walls": -2009640, "Boundary Conditions": -2005301, "Structural Internal Loads": -2005204, "Structural Load Cases": -2005210, "Structural Loads": -2005200}, selected="Analytical Beams")
analytical_3 = AnalyticalCategoriesPicker({"Analytical Beams": -2009630, "Analytical Braces": -2009633, "Analytical Columns": -2009636, "Analytical Floors": -2009639, "Analytical Foundation Slabs": -2009643, "Analytical Isolated Foundations": -2009641, "Analytical Links": -2009657, "Analytical Nodes": -2009645, "Analytical Pipe Connections": -2000983, "Analytical Spaces": -2008185, "Analytical Surfaces": -2008186, "Analytical Wall Foundations": -2009642, "Analytical Walls": -2009640, "Boundary Conditions": -2005301, "Structural Internal Loads": -2005204, "Structural Load Cases": -2005210, "Structural Loads": -2005200}, selected="Analytical Walls")
analytical_4 = AnalyticalCategoriesPicker({"Analytical Beams": -2009630, "Analytical Braces": -2009633, "Analytical Columns": -2009636, "Analytical Floors": -2009639, "Analytical Foundation Slabs": -2009643, "Analytical Isolated Foundations": -2009641, "Analytical Links": -2009657, "Analytical Nodes": -2009645, "Analytical Pipe Connections": -2000983, "Analytical Spaces": -2008185, "Analytical Surfaces": -2008186, "Analytical Wall Foundations": -2009642, "Analytical Walls": -2009640, "Boundary Conditions": -2005301, "Structural Internal Loads": -2005204, "Structural Load Cases": -2005210, "Structural Loads": -2005200}, selected="Analytical Floors")
elementtype_byname = ElementTypeByName(
    model,
    {"CHS-Circular Hollow Sections (AS 1163_C250L0) : 88.9x5.0CHS": 1042830, "Light Gauge-Joists : SC15012": 1040899, "M_TJL Wood Open Web Joist : 356mm": 984452, "PFC-Parallel Flange Channels (AS 3679_1) : 200PFC": 1203643, "Rectangular(Timber)-Beam : Timber_50 x150 _ContentGenerator": 1160690, "Rectangular(Timber)-Beam : Timber_50 x200": 1202450, "Round Bar : 30mm": 1030516, "UB-Universal Beams (AS 3679_1) : 200UB25.4": 1042289}, selected="Round Bar : 30mm")
elementtype_byname_2 = ElementTypeByName(
    model_2,
    {"CHS-Circular Hollow Sections (AS 1163_C250L0) : 88.9x5.0CHS": 1042830, "Light Gauge-Joists : SC15012": 1040899, "M_TJL Wood Open Web Joist : 356mm": 984452, "PFC-Parallel Flange Channels (AS 3679_1) : 200PFC": 1203643, "Rectangular(Timber)-Beam : Timber_50 x150 _ContentGenerator": 1160690, "Rectangular(Timber)-Beam : Timber_50 x200": 1202450, "Round Bar : 30mm": 1030516, "UB-Universal Beams (AS 3679_1) : 200UB25.4": 1042289}, selected="Light Gauge-Joists : SC15012")
category_identity = CategoryIdentity(Category=analytical)  # -> Name, Parent, Type, AllowsSubcategories, AllowsParameters, HasMaterialQuantities
category_filter = ElementCategoryFilter(Categories=analytical, Inverted=False)
category_filter_2 = ElementCategoryFilter(Categories=analytical_2, Inverted=False)
category_filter_3 = ElementCategoryFilter(Categories=analytical_3, Inverted=False)
category_identity_2 = CategoryIdentity(Category=analytical_3)  # -> Name, Parent, Type, AllowsSubcategories, AllowsParameters, HasMaterialQuantities
category_identity_3 = CategoryIdentity(Category=analytical_4)  # -> Name, Parent, Type, AllowsSubcategories, AllowsParameters, HasMaterialQuantities
category_filter_4 = ElementCategoryFilter(Categories=analytical_4, Inverted=False)
elements = DocumentElements(Filter=category_filter)
elements_2 = DocumentElements(Filter=category_filter_2)
category_identity_4 = CategoryIdentity(Category=analytical_2)  # -> Name, Parent, Type, AllowsSubcategories, AllowsParameters, HasMaterialQuantities
elements_3 = DocumentElements(Filter=category_filter_3)
elements_4 = DocumentElements(Filter=category_filter_4)
geometry = ElementGeometry(Element=elements)
geometry_2 = ElementGeometry(Element=elements_2)
geometry_3 = ElementGeometry(Element=elements_3)
geometry_4 = ElementGeometry(Element=elements_4)
number_slider = Slider(1, range=0..1)
python = GhPythonScript(G=flatten(geometry), L=category_identity.Name, B=Button())  # -> out, a; inputs B: Boolean
# ---------- python: Python ----------
"""Provides a scripting component.
    Inputs:
        G: Geometry to bake
        L: Layer name for bake
        B: Bake Activate
    Output:
        a: The a output variable"""

__author__ = "ScottD"
__version__ = "2019.08.10"

import rhinoscriptsyntax as rs
import scriptcontext
import Rhino


scriptcontext.doc = ghdoc


if B:
    
    #debug message to Python output
    print(type(G))
    
    #we obtain the reference in the Rhino doc
    doc_object = rs.coercerhinoobject(G, True, True)
    print(type(doc_object))
    
    attributes = doc_object.Attributes
    print('the type of attributes is: ' + str(type(attributes)))
    geometry = doc_object.Geometry
    print('the type of geometry is: ' + str(type(doc_object)))
    
    #we change the scriptcontext
    scriptcontext.doc = Rhino.RhinoDoc.ActiveDoc
    
    #we add both the geometry and the attributes to the Rhino doc
    rhino_brep = scriptcontext.doc.Objects.Add(geometry, attributes)
    print('the Rhino doc ID is: ' + str(rhino_brep))
    
    #we can for example change color in Rhino...
    # rs.ObjectColor(rhino_line, color)
    if not rs.IsLayer(L): 
        rs.AddLayer(L)
    rs.ObjectLayer(rhino_brep, L)
    
    #we put back the original Grasshopper document as default
    scriptcontext.doc = ghdoc
    a = rhino_brep
# ---------- end python ----------
python_2 = GhPythonScript(G=flatten(geometry_3), L=category_identity_2.Name, B=Button())  # -> out, a; inputs B: Boolean; same code as python
python_3 = GhPythonScript(G=flatten(geometry_4), L=category_identity_3.Name, B=Button())  # -> out, a; inputs B: Boolean; same code as python
join = JoinCurves(Curves=geometry_2, Preserve=False)

# ---- group: Original Points
end = EndPoints(Curve=geometry_2)  # -> Start, End

# ---- group: Build Analysis model
number_slider_2 = Slider(1, range=0..1)
join_2 = JoinCurves(Curves=geometry, Preserve=False)
simplify = SimplifyCurve(Curve=join_2, Tolerance=number_slider_2, AngleTolerance=number_slider_2)  # -> Curve, Simplified
end_2 = EndPoints(Curve=simplify.Curve)  # -> Start, End
linetobeam = LineToBeamKaramba3D(Line=simplify.Curve, New=True, Remove=True, LimitDistance_m=0.005)  # -> Element, Points, Info
pt = Point(end_2.Start)
supp = SupportKaramba3D(PosInd=pt, menu=[buttons(on, on, on, on, on, on)])
loads = LoadsKaramba3D(Vector=Vector(0, 0, -1), LCase=0, mode="Gravity")
assemble = AssembleModelKaramba3D(Elem=linetobeam.Element, Support=supp, Load=loads, LimitDistance_m=0.005)  # -> Model, Info, Mass_kg, CenterOfGravity

# ----
type_filter = ElementTypeFilter(Types=elementtype_byname, Inverted=False)
simplify_2 = SimplifyCurve(Curve=join, Tolerance=number_slider, AngleTolerance=number_slider)  # -> Curve, Simplified

# ---- group: Create Model Based on Type
decompose = ElementDecompose(Element=elements_2)
enable_button = Button()
txt = Text(decompose)
python_4 = GhPythonScript(G=flatten(simplify_2.Curve), L=category_identity_4.Name, T=txt, B=enable_button)  # -> out, a; inputs B: Boolean
# ---------- python_4: Python ----------
"""Provides a scripting component.
    Inputs:
        G: Geometry to bake
        L: Layer name for bake
        B: Bake Activate
    Output:
        a: The a output variable"""

__author__ = "ScottD"
__version__ = "2019.08.10"

import rhinoscriptsyntax as rs
import scriptcontext
import Rhino


scriptcontext.doc = ghdoc


if B:
    
    #debug message to Python output
    #print(type(G))
    
    #we obtain the reference in the Rhino doc
    doc_object = rs.coercerhinoobject(G, True, True)
    #print(type(doc_object))
    
    attributes = doc_object.Attributes
    #print('the type of attributes is: ' + str(type(attributes)))
    geometry = doc_object.Geometry
    #print('the type of geometry is: ' + str(type(doc_object)))
    
    #we change the scriptcontext
    scriptcontext.doc = Rhino.RhinoDoc.ActiveDoc
    
    #we add both the geometry and the attributes to the Rhino doc
    rhino_brep = scriptcontext.doc.Objects.Add(geometry, attributes)
    #print('the Rhino doc ID is: ' + str(rhino_brep))
    
    #we can for example change color in Rhino...
    # rs.ObjectColor(rhino_line, color)
    if not rs.IsLayer(L):
        rs.AddLayer(L)

    LT = str(L) + "::" + str(T)
    
    print(str(T))

    if not rs.IsLayer(LT):
        rs.AddLayer(T,parent=L)

    rs.ObjectLayer(rhino_brep, str(T))
    
    #we put back the original Grasshopper document as default
    scriptcontext.doc = ghdoc
    a = rhino_brep
# ---------- end python_4 ----------

# ----
type_filter_2 = ElementTypeFilter(Types=elementtype_byname_2, Inverted=False)

# ---- group: Cleaned points
end_3 = EndPoints(Curve=simplify_2.Curve)  # -> Start, End

# ---- group: Needs to be enabled then re-calculate
elements_5 = DocumentElements(Filter=type_filter)
elements_6 = DocumentElements(Filter=type_filter_2)

# ----
panel = Panel(decompose)
panel_2 = Panel(txt)
int = Integer(1)
int_2 = Integer(1)
parameterset = ElementParameterSet(Element=elements_5, ParameterKey="Enable Analytical Model", ParameterValue=int)
parameterset_2 = ElementParameterSet(Element=elements_6, ParameterKey="Enable Analytical Model", ParameterValue=int_2)
