# Grasshopper definition revit-curtainwall-byprofile.gh (Grasshopper 1.0.7)
# plug-ins: Rhino.Inside for Autodesk Revit

unit_z = UnitZ(Factor=1)
brep = Brep(<brep referenced from the Rhino model>)
curve = Curve(<curve referenced from the Rhino model>)
project = Project(Curve=curve, Brep=brep, Direction=unit_z)
model = ModelCategoriesPicker({"Abutments": -2006130, "Air Systems": -2001008, "Air Terminals": -2008013, "Analysis Display Style": -2000304, "Analysis Results": -2000303, "Areas": -2003200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}, selected="Walls": -2000011)
brep_2 = Brep(<brep referenced from the Rhino model>)
end_points = EndPoints(Curve=curve)  # -> Start, End
end_points_2 = EndPoints(Curve=project)  # -> Start, End
add_brep_directshape = AddBrepDirectShape(Brep=brep_2)
line = Line(StartPoint=end_points.End, EndPoint=end_points_2.Start)
line_2 = Line(StartPoint=end_points.Start, EndPoint=end_points_2.End)
merge = Merge(Data1=curve, Data2=line, Data3=project, Data4=line_2)  # -> flatten(Result)
query_types = QueryTypes(Category=model)
join_curves = JoinCurves(Curves=merge, Preserve=False)
value_set_picker = ValueSetPicker(query_types)
add_wall_profile = AddWallProfile(Profile=join_curves, Type=value_set_picker)
