# Grasshopper definition revit-designopts.ghx (Grasshopper 1.0.7)
# plug-ins: Rhino.Inside for Autodesk Revit

active_design_option = ActiveDesignOption()
active_design_option_2 = ActiveDesignOption()
active_design_option_3 = ActiveDesignOption()
query_design_option_sets = QueryDesignOptionSets()
query_design_option_sets_2 = QueryDesignOptionSets()
query_design_option_sets_3 = QueryDesignOptionSets(Name="Option Set 1")
panel = Panel(active_design_option)
design_option_identity = DesignOptionIdentity(DesignOption=active_design_option_2)  # -> DesignOptionSet, Name, Primary
design_option_identity_2 = DesignOptionIdentity(DesignOption=active_design_option_3)  # -> DesignOptionSet, Name, Primary
value_set_picker = ValueSetPicker(query_design_option_sets_2)
panel_2 = Panel(query_design_option_sets)
query_design_options = QueryDesignOptions(DesignOptionSet=query_design_option_sets_3, Name="Option 1")
design_option_set_identity = DesignOptionSetIdentity(DesignOptionSet=design_option_identity_2.DesignOptionSet)  # -> Name, DesignOptions
panel_3 = Panel([design_option_identity.DesignOptionSet, design_option_identity.Name, design_option_identity.Primary])
query_design_options_2 = QueryDesignOptions(DesignOptionSet=value_set_picker)
design_option_filter = DesignOptionFilter(DesignOption=query_design_options, Inverted=False)
panel_4 = Panel(design_option_set_identity.Name)
panel_5 = Panel(design_option_set_identity.DesignOptions)
query_elements = QueryElements(Filter=design_option_filter, Limit=100)  # -> Elements, Count
panel_6 = Panel(query_design_options_2)
panel_7 = Panel(query_elements.Elements)
