# Grasshopper definition revit-docs.ghx (Grasshopper 1.0.7)
# plug-ins: Rhino.Inside for Autodesk Revit

open_documents = OpenDocuments()  # -> Projects, Families
model = ModelCategoriesPicker({"Air Systems": -2001008, "Air Terminals": -2008013, "Analysis Display Style": -2000304, "Analysis Results": -2000303, "Areas": -2003200, "Bridge Abutments": -2006130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}, selected="Walls": -2000011)
open_documents_2 = OpenDocuments()  # -> Projects, Families
active = ActiveDocument()
open_documents_3 = OpenDocuments()  # -> Projects, Families
open_documents_4 = OpenDocuments()  # -> Projects, Families
panel = Panel(open_documents.Projects)
panel_2 = Panel(open_documents.Families)
value_set_picker = ValueSetPicker(open_documents_2.Projects)
open_documents_5 = OpenDocuments()  # -> Projects, Families
document_identity = DocumentIdentity()  # -> Title, IsFamily, UnitSystem
panel_3 = Panel(active)
document_identity_2 = DocumentIdentity(Document=open_documents_3.Projects)  # -> Title, IsFamily, UnitSystem
document_file = DocumentFile(Document=open_documents_4.Projects)  # -> DocumentGUID, PathName, ReadOnly, Modified, NumberOfSaves, VersionGUID
value_set_picker_2 = ValueSetPicker(open_documents_5.Projects)
category_filter = CategoryFilter(Categories=model, Inverted=False)
open_documents_6 = OpenDocuments()  # -> Projects, Families
panel_4 = Panel([document_identity.Title, document_identity.IsFamily, document_identity.UnitSystem])
query_elements = QueryElements(Document=open_documents_6.Projects, Filter=category_filter)
panel_5 = Panel([document_identity_2.Title, document_identity_2.IsFamily, document_identity_2.UnitSystem])
panel_6 = Panel([document_file.DocumentGUID, document_file.PathName, document_file.ReadOnly, document_file.Modified, document_file.NumberOfSaves, document_file.VersionGUID])
save_document = SaveDocument(
    Document=value_set_picker,
    Path="C:\Users\ehsan\Desktop\TestSave2.rvt",
    OverrideFile=Toggle(True),
    Compact=False,
    Backups=-1)
panel_7 = Panel(query_elements)
document_worksharing = DocumentWorksharing(Document=value_set_picker_2)  # -> IsWorkshared, ServerPath, CentralGUID, Detached
panel_8 = Panel(save_document)
panel_9 = Panel([document_worksharing.IsWorkshared, document_worksharing.ServerPath, document_worksharing.CentralGUID, document_worksharing.Detached])
