# Grasshopper definition revit-elements.ghx (Grasshopper 1.0.7)
# plug-ins: Rhino.Inside for Autodesk Revit

detail_level = DetailLevel({"Coarse": 1, "Medium": 2, "Fine": 3}, selected="Fine")
model = ModelCategoriesPicker({"Air Systems": -2001008, "Air Terminals": -2008013, "Analysis Display Style": -2000304, "Analysis Results": -2000303, "Areas": -2003200, "Bridge Abutments": -2006130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}, selected="Walls": -2000011)
graphical_element = GraphicalElement(<wall referenced from the Revit model>)
model_2 = ModelCategoriesPicker({"Air Systems": -2001008, "Air Terminals": -2008013, "Analysis Display Style": -2000304, "Analysis Results": -2000303, "Areas": -2003200, "Bridge Abutments": -2006130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}, selected="Furniture": -2000080)
model_3 = ModelCategoriesPicker({"Air Systems": -2001008, "Air Terminals": -2008013, "Analysis Display Style": -2000304, "Analysis Results": -2000303, "Areas": -2003200, "Bridge Abutments": -2006130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}, selected="Doors": -2000023)
graphical_element_2 = GraphicalElement(<wall referenced from the Revit model>)
graphical_element_3 = GraphicalElement(<wall referenced from the Revit model>)
element_geometry = ElementGeometry(DetailLevel=detail_level, Elements=graphical_element)
element_bounding_geometry = ElementBoundingGeometry(Element=graphical_element_2)
box = Box(graphical_element_3)
elementtype_picker = ElementTypePicker(
    model,
    {"Basic Wall : Wall 1": "2854c41c-af19-44e5-a32e-5a863e7338d2-11c4b914-9995-45e8-bb43-4f123f033ffc-000006ae", "Basic Wall : Wall 2": "2854c41c-af19-44e5-a32e-5a863e7338d2-11c4b914-9995-45e8-bb43-4f123f033ffc-00000a43", "Curtain Wall : Curtain Wall 1": "2854c41c-af19-44e5-a32e-5a863e7338d2-11c4b914-9995-45e8-bb43-4f123f033ffc-000006af"}, selected="Basic Wall : Wall 1")
elements = Panel(box)
elementtype_picker_2 = ElementTypePicker(
    model_3,
    {"Door-Single-Panel : 36\" x 84": "2854c41c-af19-44e5-a32e-5a863e7338d2-f8ac1170-70ab-4aea-924d-d079bc37b8d5-0000109c"}, selected="Door-Single-Panel : 36\" x 84")
elementtype_picker_3 = ElementTypePicker(
    model_2,
    {"Chair-Task : Chair-Task": "2854c41c-af19-44e5-a32e-5a863e7338d2-ce4bc222-622d-4212-a506-3b955238d305-000013e4"}, selected="Chair-Task : Chair-Task")
elements_2 = Panel(element_geometry)
construct_point = ConstructPoint(XCoordinate=Slider(4, range=0..10), YCoordinate=Slider(7, range=0..10), ZCoordinate=0)
construct_point_2 = ConstructPoint(XCoordinate=Slider(0, range=0..10), YCoordinate=Slider(0, range=0..10), ZCoordinate=0)
level = LevelsPicker({"Level 1": "2854c41c-af19-44e5-a32e-5a863e7338d2-11c4b914-9995-45e8-bb43-4f123f033ffc-0000068f"}, selected="Level 1")
level_2 = LevelsPicker({"Level 1": "2854c41c-af19-44e5-a32e-5a863e7338d2-11c4b914-9995-45e8-bb43-4f123f033ffc-0000068f"}, selected="Level 1")
elements_3 = Panel(element_bounding_geometry)
graphical_element_4 = GraphicalElement(<wall referenced from the Revit model>)
type_filter = TypeFilter(Types=elementtype_picker, Inverted=False)
add_component_location = AddComponentLocation(Location=construct_point, Type=elementtype_picker_3, Level=level)
add_component_location_2 = AddComponentLocation(Location=construct_point_2, Type=elementtype_picker_2, Level=level_2, Host=graphical_element_4)
query_elements = QueryElements(Filter=type_filter, Limit=100)  # -> Elements, Count
elements_4 = Panel(add_component_location)
elements_5 = Panel(add_component_location_2)
elements_6 = Panel(query_elements.Elements)
model_4 = ModelCategoriesPicker({"Air Systems": -2001008, "Air Terminals": -2008013, "Analysis Display Style": -2000304, "Analysis Results": -2000303, "Areas": -2003200, "Bridge Abutments": -2006130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}, selected="Furniture": -2000080)
elementtype_picker_4 = ElementTypePicker(
    model_4,
    {"Chair-Task : Chair-Task": "2854c41c-af19-44e5-a32e-5a863e7338d2-ce4bc222-622d-4212-a506-3b955238d305-000013e4"}, selected="Chair-Task : Chair-Task")
graphical_element_5 = GraphicalElement(<familyinstance referenced from the Revit model>)
graphical_element_6 = GraphicalElement(<familyinstance referenced from the Revit model>)
parameter_key = ParameterKey(<parameter key referenced from the Revit model>)
value = Panel("10")
integer = Integer(value)
element_type = ElementType(Element=graphical_element_5)  # -> Element, Type
element_type_2 = ElementType(Element=graphical_element_6, Type=elementtype_picker_4)  # -> Element, Type
panel = Panel(parameter_key)
less_or_equal_rule = LessOrEqualRule(ParameterKey=parameter_key, Value=integer)
panel_2 = Panel(element_type.Element)
panel_3 = Panel(element_type_2.Element)
parameter_filter = ParameterFilter(Rules=less_or_equal_rule, Inverted=False)
graphical_element_7 = GraphicalElement(<curveelement referenced from the Revit model>)
curve = Curve(graphical_element_7)
graphical_element_8 = GraphicalElement(<wall referenced from the Revit model>)
graphical_element_9 = GraphicalElement(<wall referenced from the Revit model>)
query_elements_2 = QueryElements(Filter=parameter_filter, Limit=100)  # -> Elements, Count
element_curve = ElementCurve(Element=graphical_element_8)  # -> Element, Curve
element_curve_2 = ElementCurve(Element=graphical_element_9, Curve=curve)  # -> Element, Curve
panel_4 = Panel(query_elements_2.Elements)
panel_5 = Panel(element_curve.Curve)
panel_6 = Panel(element_curve_2.Element)
