# Grasshopper definition revit-filters.ghx (Grasshopper 1.0.7)
# plug-ins: Rhino.Inside for Autodesk Revit

built_in_categories = BuiltInCategories("autodesk.revit.category.local:walls-1.0.0", LayoutLevel=2, SearchPattern="Walls")
wall = Wall([<wall referenced from the Revit model> x2])
exclusion_filter = ExclusionFilter(Elements=wall)
category_filter = CategoryFilter(Categories=built_in_categories, Inverted=False)
logical_and_filter = LogicalAndFilter(FilterA=exclusion_filter, FilterB=category_filter)
query_elements = QueryElements(Filter=logical_and_filter, Limit=100)  # -> Elements, Count
panel = Panel(query_elements.Elements)
