# Grasshopper definition revit-links.ghx (Grasshopper 1.0.7)
# plug-ins: Rhino.Inside for Autodesk Revit

model = ModelCategoriesPicker({"Air Systems": -2001008, "Air Terminals": -2008013, "Analysis Display Style": -2000304, "Analysis Results": -2000303, "Areas": -2003200, "Bridge Abutments": -2006130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}, selected="Walls": -2000011)
open_documents = OpenDocuments()  # -> Projects, Families
document_links = DocumentLinks()
model_2 = ModelCategoriesPicker({"Air Systems": -2001008, "Air Terminals": -2008013, "Analysis Display Style": -2000304, "Analysis Results": -2000303, "Areas": -2003200, "Bridge Abutments": -2006130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}, selected="Walls": -2000011)
document_links_2 = DocumentLinks()
document_links_3 = DocumentLinks(Document=open_documents.Projects)
bycategory = CategoryFilter(Categories=model, Inverted=False)
panel = Panel(document_links)
panel_2 = Panel(document_links_2)
elements = DocumentElements(Document=document_links, Filter=bycategory)
bycategory_2 = CategoryFilter(Categories=model_2, Inverted=False)
panel_3 = Panel(document_links_3)
elements_2 = DocumentElements(Document=document_links_3, Filter=bycategory_2)
panel_4 = Panel(elements)
panel_5 = Panel(elements_2)
