# Grasshopper definition revit-materials.ghx (Grasshopper 1.0.7)
# plug-ins: Rhino.Inside for Autodesk Revit

query_materials = QueryMaterials(Name="Default Roof")
query_materials_2 = QueryMaterials(Name="Default Roof")
query_materials_3 = QueryMaterials(Name="Default Roof")
query_materials_4 = QueryMaterials()
query_materials_5 = QueryMaterials(Name=";Analytical")
query_materials_6 = QueryMaterials(Name="Default Roof")
find_fill_pattern = FindFillPattern(F="Diagonal Up")  # -> FP
# ---------- find_fill_pattern: Python ----------
import clr
clr.AddReference('System.Core')
clr.AddReference('RhinoInside.Revit')
clr.AddReference('RevitAPI') 
clr.AddReference('RevitAPIUI')

from System import Enum

import rhinoscriptsyntax as rs
import Rhino
import RhinoInside
import Grasshopper
from RhinoInside.Revit import Revit, Convert
from Autodesk.Revit import DB

doc = Revit.ActiveDBDocument


views = DB.FilteredElementCollector(doc).OfClass(DB.View).WhereElementIsNotElementType().ToElements()

def get_all_fillpatterns():
    return DB.FilteredElementCollector(doc)\
             .OfClass(DB.FillPatternElement)\
             .ToElements()


def find_solid_fillpat():
    for pat in get_all_fillpatterns():
        fpat = pat.GetFillPattern()
        if fpat.IsSolidFill:
            if (M and fpat.Target == DB.FillPatternTarget.Model) or fpat.Target == DB.FillPatternTarget.Drafting:
                return pat

def find_matching_fillpat(filter_str):
    filter_str = filter_str.lower()
    for pat in get_all_fillpatterns():
        fpat = pat.GetFillPattern()
        if fpat.Name.lower() == filter_str:
            if (M and fpat.Target == DB.FillPatternTarget.Model) or fpat.Target == DB.FillPatternTarget.Drafting:
                return pat

if isinstance(F, str):
    if F.lower() == 'solid':
        FP = find_solid_fillpat()
    else:
        FP = find_matching_fillpat(F)
# ---------- end find_fill_pattern ----------
material_identity = MaterialIdentity(Material=query_materials, Manufacturer="Roof Manufacturer")  # -> Name, Description, Class, Comments, Manufacturer, Model, Cost, URL, Keynote, Mark
material_identity_2 = MaterialIdentity(Material=query_materials_2)  # -> Name, Description, Class, Comments, Manufacturer, Model, Cost, URL, Keynote, Mark
material_graphics = MaterialGraphics(Material=query_materials_3)  # -> Material, UseRenderAppearance, Color, SurfaceForegroundPattern, SurfaceForegroundColor, SurfaceBackgroundPattern, SurfaceBackgroundColor, CutForegroundPattern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
panel = Panel(query_materials_4)
panel_2 = Panel(query_materials_5)
material_graphics_2 = MaterialGraphics(Material=query_materials_6, SurfaceForegroundPattern=find_fill_pattern)  # -> Material, UseRenderAppearance, Color, SurfaceForegroundPattern, SurfaceForegroundColor, SurfaceBackgroundPattern, SurfaceBackgroundColor, CutForegroundPattern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
panel_3 = Panel([material_identity_2.Name, material_identity_2.Description, material_identity_2.Class, material_identity_2.Comments, material_identity_2.Manufacturer, material_identity_2.Model, material_identity_2.Cost, material_identity_2.URL, material_identity_2.Keynote, material_identity_2.Mark])
panel_4 = Panel([material_identity.Name, material_identity.Description, material_identity.Class, material_identity.Comments, material_identity.Manufacturer, material_identity.Model, material_identity.Cost, material_identity.URL, material_identity.Keynote, material_identity.Mark])
panel_5 = Panel([material_graphics.UseRenderAppearance, material_graphics.Color, material_graphics.SurfaceForegroundPattern, material_graphics.SurfaceForegroundColor, material_graphics.SurfaceBackgroundPattern, material_graphics.SurfaceBackgroundColor, material_graphics.CutForegroundPattern, material_graphics.CutForegroundColor, material_graphics.CutBackgroundPattern, material_graphics.CutBackgroundColor])
panel_6 = Panel([material_graphics_2.UseRenderAppearance, material_graphics_2.Color, material_graphics_2.SurfaceForegroundPattern, material_graphics_2.SurfaceForegroundColor, material_graphics_2.SurfaceBackgroundPattern, material_graphics_2.SurfaceBackgroundColor, material_graphics_2.CutForegroundPattern, material_graphics_2.CutForegroundColor, material_graphics_2.CutBackgroundPattern, material_graphics_2.CutBackgroundColor])
number_slider = Slider(12, range=0..100)
construct_checker_asset = ConstructCheckerAsset(
    Color1=ColourSwatch(SwatchColor=RGB(230, 28, 28)),
    Color2=ColourSwatch(SwatchColor=RGB(54, 173, 217)),
    SizeU=number_slider,
    SizeV=number_slider)
create_appearance_asset_generic = CreateAppearanceAssetGeneric(
    Name="Another Generic",
    Color=ColourSwatch(SwatchColor=RGB(97, 97, 97)),
    Image=construct_checker_asset,
    ImageFade=Slider(1, range=0..1))
create_material = CreateMaterial(Name="New Material")
create_appearance_asset_generic_2 = CreateAppearanceAssetGeneric(Name="New Generic", Color=ColourSwatch(SwatchColor=RGB(0, 229, 255)))
create_material_2 = CreateMaterial(Name="New Material")
query_materials_7 = QueryMaterials(Name="Default")
query_materials_8 = QueryMaterials(Name="Default")
material_graphics_3 = MaterialGraphics(Material=create_material, Color=ColourSwatch(SwatchColor=RGB(255, 94, 0)))  # -> Material, UseRenderAppearance, Color, SurfaceForegroundPattern, SurfaceForegroundColor, SurfaceBackgroundPattern, SurfaceBackgroundColor, CutForegroundPattern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
panel_7 = Panel(create_material_2)
extract_material_s_assets = ExtractMaterialsAssets(Material=query_materials_7)  # -> AppearanceAsset, PhysicalAsset, ThermalAsset
extract_material_s_assets_2 = ExtractMaterialsAssets(Material=query_materials_8)  # -> AppearanceAsset, PhysicalAsset, ThermalAsset
panel_8 = Panel(create_appearance_asset_generic)
panel_9 = Panel(create_appearance_asset_generic_2)
modify_appearance_asset_generic = ModifyAppearanceAssetGeneric(AppearanceAssetGeneric=extract_material_s_assets.AppearanceAsset, Color=ColourSwatch(SwatchColor=RGB(0, 30, 255)))
query_materials_9 = QueryMaterials(Name="Default")
analyze_appearance_asset_generic = AnalyzeAppearanceAssetGeneric(AppearanceAssetGeneric=extract_material_s_assets_2.AppearanceAsset)  # -> Name, Description, Keywords, Color, Image, ImageFade, Glossiness, MetallicHighlights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
query_materials_10 = QueryMaterials(Name="Default Roof")
panel_10 = Panel(material_graphics_3.Material)
replace_material_s_assets = ReplaceMaterialsAssets(Material=query_materials_9, AppearanceAsset=create_appearance_asset_generic_2)
replace_material_s_assets_2 = ReplaceMaterialsAssets(Material=query_materials_10, AppearanceAsset=create_appearance_asset_generic)
panel_11 = Panel(replace_material_s_assets)
panel_12 = Panel(modify_appearance_asset_generic)
panel_13 = Panel([analyze_appearance_asset_generic.Name, analyze_appearance_asset_generic.Description, analyze_appearance_asset_generic.Color])
panel_14 = Panel(replace_material_s_assets_2)
query_materials_11 = QueryMaterials(Name="Orange")
query_materials_12 = QueryMaterials(Name="Aluminum")
query_materials_13 = QueryMaterials(Name="Aluminum")
extract_material_s_assets_3 = ExtractMaterialsAssets(Material=query_materials_12)  # -> AppearanceAsset, PhysicalAsset, ThermalAsset
extract_material_s_assets_4 = ExtractMaterialsAssets(Material=query_materials_13)  # -> AppearanceAsset, PhysicalAsset, ThermalAsset
physical_thermal_asset_behaviour = MaterialBehaviour({"Isotropic": 0, "Orthotropic": 1, "Transverse Isotropic": 2}, selected="Orthotropic")
physical_thermal_asset_behaviour_2 = MaterialBehaviour({"Isotropic": 0, "Orthotropic": 1, "Transverse Isotropic": 2}, selected="Transverse Isotropic")
number_slider_2 = Slider(1.7e-05, range=0..2.8e-05)
number_slider_3 = Slider(798.2, range=-1000..1000)
physical_asset_type = PhysicalMaterialType({"Generic": 2, "Basic": 1, "Concrete": 4, "Gas": 7, "Liquid": 6, "Metal": 3, "Plastic": 8, "Wood": 5}, selected="Wood")
panel_15 = Panel(extract_material_s_assets_4.AppearanceAsset)
panel_16 = Panel(extract_material_s_assets_4.PhysicalAsset)
panel_17 = Panel(extract_material_s_assets_4.ThermalAsset)
replace_material_s_assets_3 = ReplaceMaterialsAssets(Material=query_materials_11, AppearanceAsset=extract_material_s_assets_3.AppearanceAsset)
thermal_asset_type = ThermalMaterialType({"Gas": 1, "Liquid": 2, "Solid": 3}, selected="Gas")
panel_18 = Panel(replace_material_s_assets_3)
create_physical_asset = CreatePhysicalAsset(
    Name="Custom Physical Asset",
    Type=physical_asset_type,
    Behaviour=physical_thermal_asset_behaviour,
    ThermalExpansionCoefficientX=number_slider_2,
    ThermalExpansionCoefficientY=number_slider_2,
    ThermalExpansionCoefficientZ=number_slider_2,
    YoungsModulusX=number_slider_3,
    YoungsModulusY=number_slider_3,
    YoungsModulusZ=Slider(188549.06, range=0..1000000),
    Density=Slider(4.3, range=0..10))
create_thermal_asset = CreateThermalAsset(
    Name="Custom Thermal Asset",
    Type=thermal_asset_type,
    Behaviour=physical_thermal_asset_behaviour_2,
    ThermalConductivity=Slider(2819, range=0..10000),
    GasViscosity=Slider(4.3, range=0..10))
panel_19 = Panel(create_thermal_asset)
panel_20 = Panel(create_physical_asset)
