# Grasshopper definition revit-openings.ghx (Grasshopper 1.0.7)
# plug-ins: Rhino.Inside for Autodesk Revit

element_classes = ElementClasses("Autodesk.Revit.DB.SketchBase", SearchPattern="?Sketch")
wall = Wall(<wall referenced from the Revit model>)
wall_2 = Wall(<wall referenced from the Revit model>)
point = Point(<point referenced from the Rhino model>)
point_2 = Point(<point referenced from the Rhino model>)
levels_picker = LevelsPicker(<levels picker referenced from the Revit model>)
levels_picker_2 = LevelsPicker(<levels picker referenced from the Revit model>)
levels_picker_3 = LevelsPicker(<levels picker referenced from the Revit model>)
levels_picker_4 = LevelsPicker(<levels picker referenced from the Revit model>)
add_wall_opening = AddWallOpening(Wall=[wall, wall_2], PointA=point, PointB=point_2, TrackingMode=2)
curve = Curve(<curve referenced from the Rhino model>)
floor = Floor(<floor referenced from the Revit model>)
class_filter = ClassFilter(Classes=element_classes)
curve_2 = Curve(<curve referenced from the Rhino model>)
roof = Roof(<roof referenced from the Revit model>)
panel = Panel(add_wall_opening)
element_geometry = ElementGeometry(Elements=floor)
opening = Opening(add_wall_opening)
level_constraint = LevelConstraint(Level=levels_picker_3, Offset=Slider(50, range=0..100))
host_faces = HostFaces(Host=floor)  # -> Top, Interior, Exterior, Bottom
level_constraint_2 = LevelConstraint(Level=levels_picker_4, Offset=Slider(-20, range=-50..0))
add_shaft_opening = AddShaftOpening(
    Boundary=curve,
    BaseConstraint=levels_picker,
    BaseOffset=Slider(-3, range=-5..0),
    TopConstraint=levels_picker_2,
    TrackingMode=2)
query_elements = QueryElements(Filter=class_filter, Limit=100)  # -> Elements, Count
panel_2 = Panel(query_elements.Elements)
add_vertical_opening = AddVerticalOpening(Host=roof, Boundary=curve_2, TrackingMode=2)
inspect_element = InspectElement(Element=opening)  # -> ConstraintsBaseConstraint, ConstraintsBaseOffset, ConstraintsTopConstraint, ConstraintsTopOffset, ConstraintsUnconnectedHeight, PhasingPhaseCreated, PhasingPhaseDemolished
opening_boundary_profile = OpeningBoundaryProfile(Opening=opening)  # -> Plane, Profile

# ---- group: BAD
box_corners = BoxCorners(Box=opening)  # -> CornerA, CornerB, CornerC, CornerD, CornerE, CornerF, CornerG, CornerH
point_3 = Point([box_corners.CornerA, box_corners.CornerB, box_corners.CornerC, box_corners.CornerD, box_corners.CornerE, box_corners.CornerF, box_corners.CornerG, box_corners.CornerH])
custom_preview = CustomPreview(Geometry=point_3, Material=ColourSwatch(SwatchColor=RGB(255, 255, 255)))

# ----
brep = Brep(host_faces.Top)
curve_3 = Curve(<curve referenced from the Rhino model>)
custom_preview_2 = CustomPreview(Geometry=element_geometry, Material=ColourSwatch(SwatchColor=RGBA(255, 255, 255, 11)))
floor_2 = Floor(<floor referenced from the Revit model>)
delete_element = DeleteElement()
add_shaft_opening_2 = AddShaftOpening(Boundary=curve_3, Base=level_constraint_2, Top=level_constraint, TrackingMode=2)
panel_3 = Panel(add_shaft_opening)
opening_boundary_profile_2 = OpeningBoundaryProfile(Opening=add_shaft_opening)  # -> Plane, Profile
host_boundary_profile = HostBoundaryProfile(Host=floor_2)  # -> Plane, Profile
custom_preview_3 = CustomPreview(Geometry=opening_boundary_profile.Profile, Material=ColourSwatch(SwatchColor=RGB(255, 255, 255)))
match_text = MatchText(Text=query_elements.Elements, Pattern="*not associated*", Case=True)
panel_4 = Panel(inspect_element.PhasingPhaseDemolished)
cull_pattern = CullPattern(List=query_elements.Elements, CullPattern=match_text)
custom_preview_4 = CustomPreview(
    Geometry=[host_boundary_profile.Profile, opening_boundary_profile_2.Profile],
    Material=ColourSwatch(SwatchColor=RGB(255, 255, 255)))
graphical_element = GraphicalElement([<floor referenced from the Revit model> x3, <ceiling referenced from the Revit model>])
graphical_element_2 = GraphicalElement(<roof referenced from the Revit model>)
built_in_categories = BuiltInCategories(
    ["autodesk.revit.category.local:arcWallRectOpening-1.0.0", "autodesk.revit.category.local:sWallRectOpening-1.0.0"],
    LayoutLevel=2,
    SearchPattern="?Opening")
built_in_categories_2 = BuiltInCategories("autodesk.revit.category.local:shaftOpening-1.0.0", LayoutLevel=2, SearchPattern="?Opening")
wall_3 = Wall(<wall referenced from the Revit model>)
wall_4 = Wall(<wall referenced from the Revit model>)
roof_2 = Roof(<roof referenced from the Revit model>)
floor_3 = Floor(<floor referenced from the Revit model>)
wall_5 = Wall(<wall referenced from the Revit model>)
levels_picker_5 = LevelsPicker(<levels picker referenced from the Revit model>)
roof_3 = Roof(<roof referenced from the Revit model>)
roof_4 = Roof(<roof referenced from the Revit model>)
levels_picker_6 = LevelsPicker(<levels picker referenced from the Revit model>)
levels_picker_7 = LevelsPicker(<levels picker referenced from the Revit model>)
levels_picker_8 = LevelsPicker(<levels picker referenced from the Revit model>)
wall_6 = Wall(<wall referenced from the Revit model>)
point_4 = Point(<point referenced from the Rhino model>)
point_5 = Point(<point referenced from the Rhino model>)
host_inserts = HostInserts(Host=roof_3)  # -> Inserts, Shared, Shadows, Openings, Walls
host_inserts_2 = HostInserts(Host=wall_3)  # -> Inserts, Shared, Shadows, Openings, Walls
host_inserts_3 = HostInserts(Host=wall_4)  # -> Inserts, Shared, Shadows, Openings, Walls
host_inserts_4 = HostInserts(Host=roof_2)  # -> Inserts, Shared, Shadows, Openings, Walls
host_inserts_5 = HostInserts(Host=floor_3)  # -> Inserts, Shared, Shadows, Openings, Walls
host_inserts_6 = HostInserts(Host=wall_5)  # -> Inserts, Shared, Shadows, Openings, Walls
host_inserts_7 = HostInserts(Host=roof_4)  # -> Inserts, Shared, Shadows, Openings, Walls
roof_5 = Roof(<roof referenced from the Revit model>)
roof_6 = Roof(<roof referenced from the Revit model>)
ceiling = Ceiling(<ceiling referenced from the Revit model>)
floor_4 = Floor(<floor referenced from the Revit model>)
curve_4 = Curve(<curve referenced from the Rhino model>)
curve_5 = Curve(<curve referenced from the Rhino model>)
add_wall_opening_2 = AddWallOpening(Wall=wall_6, PointA=point_4, PointB=point_5, TrackingMode=2)
category_filter = CategoryFilter(Categories=built_in_categories, Inverted=False)
category_filter_2 = CategoryFilter(Categories=built_in_categories_2, Inverted=False)
curve_6 = Curve(<curve referenced from the Rhino model>)
value_picker = ValuePicker(host_inserts.Openings)
value_picker_2 = ValuePicker(host_inserts_7.Openings)
panel_5 = Panel(host_inserts_4.Openings)
panel_6 = Panel(host_inserts_3.Openings)
panel_7 = Panel(host_inserts_5.Openings)
opening_boundary_profile_3 = OpeningBoundaryProfile(Opening=host_inserts_6.Openings)  # -> Plane, Profile
inspect_element_2 = InspectElement(Element=host_inserts_2.Openings)  # -> ConstraintsBaseConstraint, ConstraintsBaseOffset, ConstraintsTopConstraint, ConstraintsTopOffset, ConstraintsUnconnectedHeight, PhasingPhaseCreated, PhasingPhaseDemolished
add_vertical_opening_2 = AddVerticalOpening(Host=roof_5, Boundary=curve_4, TrackingMode=2)
add_vertical_opening_3 = AddVerticalOpening(Host=[roof_6, ceiling, floor_4], Boundary=curve_5, TrackingMode=2)
level_constraint_3 = LevelConstraint(Level=levels_picker_7, Offset=Slider(-3, range=-5..0))
level_constraint_4 = LevelConstraint(Level=levels_picker_6, Offset=Slider(3, range=0..5))
curve_7 = Curve(<curve referenced from the Rhino model>)
panel_8 = Panel(add_wall_opening_2)
query_elements_2 = QueryElements(Filter=category_filter, Limit=100)  # -> Elements, Count
query_elements_3 = QueryElements(Filter=category_filter_2, Limit=100)  # -> Elements, Count
add_shaft_opening_3 = AddShaftOpening(Boundary=curve_6, Base=levels_picker_5, Top=levels_picker_8, TrackingMode=2)
panel_9 = Panel(opening_boundary_profile_3.Profile)
panel_10 = Panel(add_vertical_opening_3)
panel_11 = Panel(add_vertical_opening_2)
add_shaft_opening_4 = AddShaftOpening(Boundary=curve_7, Base=level_constraint_3, Top=level_constraint_4, TrackingMode=2)
opening_boundary_profile_4 = OpeningBoundaryProfile(Opening=value_picker)  # -> Plane, Profile
inspect_element_3 = InspectElement(Element=value_picker_2)  # -> PhasingPhaseCreated, PhasingPhaseDemolished
panel_12 = Panel(query_elements_2.Elements)
panel_13 = Panel(query_elements_3.Elements)
panel_14 = Panel(add_shaft_opening_3)
panel_15 = Panel([inspect_element_2.ConstraintsBaseConstraint, inspect_element_2.ConstraintsBaseOffset, inspect_element_2.ConstraintsTopConstraint, inspect_element_2.ConstraintsTopOffset, inspect_element_2.ConstraintsUnconnectedHeight])
phase = Phase(inspect_element_2.PhasingPhaseCreated)
panel_16 = Panel(opening_boundary_profile_4.Profile)
panel_17 = Panel(add_shaft_opening_4)
panel_18 = Panel(phase)
built_in_categories_3 = BuiltInCategories("autodesk.revit.category.local:arcWallRectOpening-1.0.0", LayoutLevel=2, SearchPattern="?Opening")
built_in_categories_4 = BuiltInCategories("autodesk.revit.category.local:floors-1.0.0", LayoutLevel=2, SearchPattern="Floors")
floor_5 = Floor(<floor referenced from the Revit model>)
host_faces_2 = HostFaces(Host=floor_5)  # -> Top, Interior, Exterior, Bottom
opening_2 = Opening(<opening referenced from the Revit model>)
brep_2 = Brep(host_faces_2.Top)
category_filter_3 = CategoryFilter(Categories=built_in_categories_3, Inverted=False)
bounding_box_filter = BoundingBoxFilter(BoundingBox=opening_2, Union=True, Strict=False, Tolerance=0, Inverted=False)  # -> Filter, Target
category_filter_4 = CategoryFilter(Categories=built_in_categories_4, Inverted=False)
query_elements_4 = QueryElements(Filter=category_filter_3, Limit=100)  # -> Elements, Count
logical_and_filter = LogicalAndFilter(FilterA=bounding_box_filter.Filter, FilterB=category_filter_4)
element_host = ElementHost(Element=query_elements_4.Elements)
query_elements_5 = QueryElements(Filter=logical_and_filter, Limit=100)  # -> Elements, Count
panel_19 = Panel(element_host)
panel_20 = Panel(query_elements_5.Elements)
