# Grasshopper definition revit-params.ghx (Grasshopper 1.0.7)
# plug-ins: Rhino.Inside for Autodesk Revit

shared_parameter_guid = Panel("0a8f2769-7031-47d8-b2e3-cb6345608516")
parameter_name = Panel("Volume")
graphical_element = GraphicalElement(<wall referenced from the Revit model>)
graphical_element_2 = GraphicalElement(<wall referenced from the Revit model>)
graphical_element_3 = GraphicalElement(<wall referenced from the Revit model>)
graphical_element_4 = GraphicalElement(<wall referenced from the Revit model>)
parameterkey = ParameterKey(<parameterkey referenced from the Revit model>)
graphical_element_5 = GraphicalElement(<wall referenced from the Revit model>)
inspect_element = InspectElement(Element=graphical_element_3)  # -> DimensionsVolume, DimensionsArea
inspect_element_2 = InspectElement(Element=graphical_element)
inspect_element_3 = InspectElement(Element=graphical_element_2)  # -> ConstraintsBaseExtensionDistance, ConstraintsTopExtensionDistance, ConstraintsRelatedToMass, ConstraintsLocationLine, ConstraintsBaseIsAttached, ConstraintsTopIsAttached, ConstraintsTopOffset, ConstraintsBaseOffset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
element_parameter = ElementParameter(Element=graphical_element_5, Parameter=parameter_name)  # -> Element, Value
element_parameter_2 = ElementParameter(Element=graphical_element_4, Parameter=parameterkey)  # -> Element, Value
graphical_element_6 = GraphicalElement(<wall referenced from the Revit model>)
guid = Guid(shared_parameter_guid)
volume = Panel(inspect_element.DimensionsVolume)
area = Panel(inspect_element.DimensionsArea)
panel = Panel(element_parameter_2.Value)
panel_2 = Panel(element_parameter.Value)
element_parameter_3 = ElementParameter(Element=graphical_element_6, Parameter=guid)  # -> Element, Value
parameter_name_2 = Panel("Base Constraint")
built_in_parameters = BuiltInParameters("autodesk.revit.parameter:wallBaseConstraint-1.0.0", LayoutLevel=2, SearchPattern="*Base Constraint")
panel_3 = Panel(element_parameter_3.Value)
graphical_element_7 = GraphicalElement(<wall referenced from the Revit model>)
find_builtinparameter = FindBuiltInParameter(E=graphical_element_7, N=parameter_name_2)  # -> BIP
# ---------- find_builtinparameter: Python ----------
import clr
clr.AddReference('System.Core')
clr.AddReference('RhinoInside.Revit')
clr.AddReference('RevitAPI') 
clr.AddReference('RevitAPIUI')

from System import Enum

import rhinoscriptsyntax as rs
import Rhino
import RhinoInside
import Grasshopper
from RhinoInside.Revit import Revit, Convert
from Autodesk.Revit import DB

doc = Revit.ActiveDBDocument

def get_builtinparameter(element, param_name):
    eparam = element.LookupParameter(param_name)
    if eparam:
        for biparam in DB.BuiltInParameter.GetValues(DB.BuiltInParameter):
            if int(biparam) == eparam.Definition.Id.IntegerValue:
                return biparam

BIP = get_builtinparameter(E, N)
# ---------- end find_builtinparameter ----------
panel_4 = Panel(built_in_parameters)
db_builtinparameter = Panel(find_builtinparameter)
parameter_name_3 = Panel("Unconnected Height")
parameter_name_4 = Panel("Unconnected Height")
graphical_element_8 = GraphicalElement(<wall referenced from the Revit model>)
graphical_element_9 = GraphicalElement(<wall referenced from the Revit model>)
element_parameter_4 = ElementParameter(Element=graphical_element_8, Parameter=parameter_name_3, Value=Slider(8, range=0..10))  # -> Element, Value
element_parameter_5 = ElementParameter(Element=graphical_element_9, Parameter=parameter_name_4, Value=Slider(8, range=0..10))  # -> Element, Value
panel_5 = Panel(element_parameter_4.Element)
panel_6 = Panel(element_parameter_5.Element)
element_parameter_6 = ElementParameter(Element=element_parameter_5.Element, Parameter=parameter_name_4)  # -> Element, Value
unconnected_height = Panel(element_parameter_6.Value)
parameter_name_5 = Panel("Item Price")
built_in_parameter_groups = BuiltInParameterGroups("autodesk.parameter.group:identityData-1.0.0", LayoutLevel=2, SearchPattern="*Identity")
built_in_parameter_types_common = BuiltInParameterTypes("autodesk.spec.measurable:currency-2.0.0", DisciplineType="autodesk.spec:discipline", SearchPattern="*Currency")
define_parameter = DefineParameter(Name=parameter_name_5, Type=built_in_parameter_types_common, Group=built_in_parameter_groups)
graphical_element_10 = GraphicalElement(<wall referenced from the Revit model>)
add_parameter = AddParameter(Definition=define_parameter, Binding=Toggle(True), TrackingMode=2)
inspect_element_4 = InspectElement(Element=graphical_element_10)
custom_shared_parameter = Panel(add_parameter)
parameter_identity = ParameterIdentity(Parameter=add_parameter)  # -> Guid, Name, Type, Group
parameter_identity_2 = ParameterIdentity(Parameter=inspect_element_4)  # -> Guid, Name, Type, Group
parameter_info = Panel([parameter_identity.Guid, parameter_identity.Name, parameter_identity.Type, parameter_identity.Group])
parameter_value_info = Panel([parameter_identity_2.Guid, parameter_identity_2.Name, parameter_identity_2.Type, parameter_identity_2.Group])
