# Grasshopper definition revit-psettings.ghx (Grasshopper 1.0.7)
# plug-ins: Rhino.Inside for Autodesk Revit

active_document = ActiveDocument()
project_location = ProjectLocation()  # -> SiteLocation, SharedSite, SurveyPoint, ProjectBasePoint
panel = Panel("New Site")
project_location_2 = ProjectLocation()  # -> SiteLocation, SharedSite, SurveyPoint, ProjectBasePoint
project_information = ProjectInformation(Project=active_document)  # -> OrganizationName, OrganizationDescription, BuildingName, Author, ClientName, ProjectIssueDate, ProjectStatus, ProjectAddress, ProjectName, ProjectNumber
query_site_locations = QuerySiteLocations()
query_shared_sites = QuerySharedSites()
panel_2 = Panel(project_location.SiteLocation)
panel_3 = Panel(project_location.SharedSite)
panel_4 = Panel(project_location.SurveyPoint)
panel_5 = Panel(project_location.ProjectBasePoint)
site_location_identity = SiteLocationIdentity(SiteLocation=project_location_2.SiteLocation)  # -> Elevation, PlaceName, TimeZone, Latitude, Longitude
panel_6 = Panel(query_shared_sites)
panel_7 = Panel(query_site_locations)
project_info = Panel([project_information.OrganizationName, project_information.OrganizationDescription, project_information.BuildingName, project_information.Author, project_information.ClientName, project_information.ProjectIssueDate, project_information.ProjectStatus, project_information.ProjectAddress, project_information.ProjectName, project_information.ProjectNumber])
panel_8 = Panel(site_location_identity.Elevation)
panel_9 = Panel(site_location_identity.PlaceName)
panel_10 = Panel(site_location_identity.TimeZone)
panel_11 = Panel([site_location_identity.Latitude, site_location_identity.Longitude])
ghpython_script = GhPythonScript()  # -> O
# ---------- ghpython_script: Python ----------
import clr
clr.AddReference('System.Core')
clr.AddReference('RhinoInside.Revit')
clr.AddReference('RevitAPI') 
clr.AddReference('RevitAPIUI')

from System import Enum

import rhinoscriptsyntax as rs
import Rhino
import RhinoInside
import Grasshopper
from Grasshopper.Kernel import GH_RuntimeMessageLevel as RML
from RhinoInside.Revit import Revit, Convert
# add extensions methods as well
# this allows calling .ToXXX() convertor methods on Revit objects
clr.ImportExtensions(Convert.Geometry)
from Autodesk.Revit import DB

# active Revit verison
REVIT_VERSION = Revit.ActiveUIApplication.Application.VersionNumber

# access the active document object
doc = Revit.ActiveDBDocument

def show_warning(msg):
    ghenv.Component.AddRuntimeMessage(RML.Warning, msg)

def show_error(msg):
    ghenv.Component.AddRuntimeMessage(RML.Error, msg)

def show_remark(msg):
    ghenv.Component.AddRuntimeMessage(RML.Remark, msg)


O = I
# ---------- end ghpython_script ----------
panel_12 = Panel(ghpython_script)
