# Grasshopper definition revit-types.ghx (Grasshopper 1.0.7)
# plug-ins: Rhino.Inside for Autodesk Revit

built_in_categories = BuiltInCategories("autodesk.revit.category.local:walls-1.0.0", LayoutLevel=2, SearchPattern="Walls")
built_in_categories_2 = BuiltInCategories("autodesk.revit.category.family:doors-1.0.0", LayoutLevel=2, SearchPattern="Doors")
default_type = DefaultType(Category=built_in_categories)
default_type_2 = DefaultType(Category=built_in_categories_2)
ghpython_script = GhPythonScript(I=default_type_2)  # -> O
# ---------- ghpython_script: Python ----------
import clr
clr.AddReference('System.Core')
clr.AddReference('RhinoInside.Revit')
clr.AddReference('RevitAPI') 
clr.AddReference('RevitAPIUI')

from System import Enum

import rhinoscriptsyntax as rs
import Rhino
import RhinoInside
import Grasshopper
from Grasshopper.Kernel import GH_RuntimeMessageLevel as RML
from RhinoInside.Revit import Revit, Convert
from Autodesk.Revit import DB

# access the active document object
doc = Revit.ActiveDBDocument

def show_warning(msg):
    ghenv.Component.AddRuntimeMessage(RML.Warning, msg)

def show_error(msg):
    ghenv.Component.AddRuntimeMessage(RML.Error, msg)

def show_remark(msg):
    ghenv.Component.AddRuntimeMessage(RML.Remark, msg)


O = I
# ---------- end ghpython_script ----------
panel = Panel(default_type)
panel_2 = Panel(default_type_2)
panel_3 = Panel(ghpython_script)
