# Grasshopper definition rir-ghpython.ghx (Grasshopper 1.0.7)

ghpython_script = GhPythonScript(Radius=Slider(0.1, range=0..10), Trigger=Toggle(True))  # -> O
# ---------- ghpython_script: Python ----------
import clr
clr.AddReference('System.Core')
clr.AddReference('RhinoInside.Revit')
clr.AddReference('RevitAPI') 
clr.AddReference('RevitAPIUI')

from System import Enum, Action

import rhinoscriptsyntax as rs
import Rhino
import RhinoInside
import Grasshopper
from RhinoInside.Revit import Revit, Convert
from Autodesk.Revit import DB

doc = Revit.ActiveDBDocument

def create_geometry(doc):
    brep = Sphere.ToBrep()
    revit_category = DB.ElementId(DB.BuiltInCategory.OST_GenericModel)
    ds = DB.DirectShape.CreateElement(doc, revit_category)
    ds.AppendShape([brep.ToSolid()])

Sphere = Rhino.Geometry.Sphere(Rhino.Geometry.Point3d.Origin, Radius)

if Trigger:
    Revit.EnqueueAction(
        Action[DB.Document](create_geometry)
    )
# ---------- end ghpython_script ----------
