# Grasshopper definition rir-grasshopper.ghx (Grasshopper 1.0.7)
# plug-ins: Rhino.Inside for Autodesk Revit

model = ModelCategoriesPicker({"Air Systems": -2001008, "Air Terminals": -2008013, "Analysis Display Style": -2000304, "Analysis Results": -2000303, "Areas": -2003200, "Bridge Abutments": -2006130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}, selected="Generic Models": -2000151)
model_2 = ModelCategoriesPicker({"Air Systems": -2001008, "Air Terminals": -2008013, "Analysis Display Style": -2000304, "Analysis Results": -2000303, "Areas": -2003200, "Bridge Abutments": -2006130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}, selected="Furniture": -2000080)
model_3 = ModelCategoriesPicker({"Air Systems": -2001008, "Air Terminals": -2008013, "Analysis Display Style": -2000304, "Analysis Results": -2000303, "Areas": -2003200, "Bridge Abutments": -2006130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}, selected="Furniture": -2000080)
model_4 = ModelCategoriesPicker({"Air Systems": -2001008, "Air Terminals": -2008013, "Analysis Display Style": -2000304, "Analysis Results": -2000303, "Areas": -2003200, "Bridge Abutments": -2006130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}, selected="Furniture": -2000080)
elementtype_picker = ElementTypePicker(
    model,
    {"Model Text : Model Text 1": "440eddbd-6b7b-4ef1-93cb-a9f7f0eec27e-0baf5d74-2ba5-473e-abba-238a1988bf18-000006d2"}, selected="Model Text : Model Text 1")
category_filter = CategoryFilter(Categories=model, Inverted=False)
elementtype_picker_2 = ElementTypePicker(
    model_2,
    {"TV Stand : TV Stand_Large": "440eddbd-6b7b-4ef1-93cb-a9f7f0eec27e-0baf5d74-2ba5-473e-abba-238a1988bf18-00000db3"}, selected="TV Stand : TV Stand_Large")
category_filter_2 = CategoryFilter(Categories=model_2, Inverted=False)
elementtype_picker_3 = ElementTypePicker(
    model_3,
    {"TV Stand : TV Stand_Large": "440eddbd-6b7b-4ef1-93cb-a9f7f0eec27e-0baf5d74-2ba5-473e-abba-238a1988bf18-00000db3"}, selected="TV Stand : TV Stand_Large")
category_filter_3 = CategoryFilter(Categories=model_3, Inverted=False)
elementtype_picker_4 = ElementTypePicker(
    model_4,
    {"TV Stand : TV Stand_Large": "440eddbd-6b7b-4ef1-93cb-a9f7f0eec27e-0baf5d74-2ba5-473e-abba-238a1988bf18-00000db3"}, selected="TV Stand : TV Stand_Large")
category_filter_4 = CategoryFilter(Categories=model_4, Inverted=False)
query_elements = QueryElements(Filter=category_filter, Limit=100)  # -> Elements, Count
query_elements_2 = QueryElements(Filter=category_filter_2, Limit=100)  # -> Elements, Count
query_elements_3 = QueryElements(Filter=category_filter_3, Limit=100)  # -> Elements, Count
query_elements_4 = QueryElements(Filter=category_filter_4, Limit=100)  # -> Elements, Count
trigger = Trigger(Interval=-1000, TimerInterval=1000, Target=element_type_4)
element_type = ElementType(Element=query_elements.Elements, Type=elementtype_picker)  # -> Element, Type
element_type_2 = ElementType(Element=query_elements_2.Elements, Type=elementtype_picker_2)  # -> Element, Type
element_type_3 = ElementType(Element=query_elements_3.Elements, Type=elementtype_picker_3)  # -> Element, Type
element_type_4 = ElementType(Element=query_elements_4.Elements, Type=elementtype_picker_4)  # -> Element, Type; disabled
get_element_parameter = GetElementParameter(Element=element_type.Type, ParameterKey="Finish")
panel = Panel(element_type_3.Element)
panel_2 = Panel(element_type_4.Element)
element_name = ElementName(Element=element_type_2.Element, Name="Custom TV")  # -> Element, Name
material_identity = MaterialIdentity(Material=get_element_parameter, Manufacturer="MyFurnitures", Model="MyTVStand")  # -> Material, Name, Description, Class, Comments, Manufacturer, Model, Cost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
panel_3 = Panel(element_name.Element)
panel_4 = Panel([material_identity.Material, material_identity.Manufacturer, material_identity.Model])
