# Grasshopper definition revit-curtainwalls.ghx (Grasshopper 1.0.7)
# plug-ins: Rhino.Inside for Autodesk Revit

# CURTAIN SYSTEMS AND TYPES
model = ModelCategoriesPicker({"Air Systems": -2001008, "Air Terminals": -2008013, "Analysis Display Style": -2000304, "Analysis Results": -2000303, "Areas": -2003200, "Bridge Abutments": -2006130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}, selected="Curtain Systems": -2000340)
model_2 = ModelCategoriesPicker({"Air Systems": -2001008, "Air Terminals": -2008013, "Analysis Display Style": -2000304, "Analysis Results": -2000303, "Areas": -2003200, "Bridge Abutments": -2006130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}, selected="Curtain Systems": -2000340)
# CURTAIN WALLS AND TYPES
wall_system_family = WallSystemFamily({"Basic": 0, "Curtain": 1, "Stacked": 2}, selected="Curtain")
# PARTS (TYPE, INSTANCE)
model_3 = ModelCategoriesPicker({"Air Systems": -2001008, "Air Terminals": -2008013, "Analysis Display Style": -2000304, "Analysis Results": -2000303, "Areas": -2003200, "Bridge Abutments": -2006130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}, selected="Curtain Grids": -2000173)
model_4 = ModelCategoriesPicker({"Air Systems": -2001008, "Air Terminals": -2008013, "Analysis Display Style": -2000304, "Analysis Results": -2000303, "Areas": -2003200, "Bridge Abutments": -2006130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}, selected="Curtain Panels": -2000170)
model_5 = ModelCategoriesPicker({"Air Systems": -2001008, "Air Terminals": -2008013, "Analysis Display Style": -2000304, "Analysis Results": -2000303, "Areas": -2003200, "Bridge Abutments": -2006130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}, selected="Curtain Wall Mullions": -2000171)
model_6 = ModelCategoriesPicker({"Air Systems": -2001008, "Air Terminals": -2008013, "Analysis Display Style": -2000304, "Analysis Results": -2000303, "Areas": -2003200, "Bridge Abutments": -2006130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}, selected="Curtain Grids": -2000173)
model_7 = ModelCategoriesPicker({"Air Systems": -2001008, "Air Terminals": -2008013, "Analysis Display Style": -2000304, "Analysis Results": -2000303, "Areas": -2003200, "Bridge Abutments": -2006130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}, selected="Curtain Panels": -2000170)
model_8 = ModelCategoriesPicker({"Air Systems": -2001008, "Air Terminals": -2008013, "Analysis Display Style": -2000304, "Analysis Results": -2000303, "Areas": -2003200, "Bridge Abutments": -2006130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}, selected="Curtain Wall Mullions": -2000171)
query_walls = DocumentWalls(WallSystemFamily=wall_system_family)
bycategory = ElementCategoryFilter(Categories=model, Inverted=False)
bycategory_2 = ElementCategoryFilter(Categories=model_2, Inverted=False)
bycategory_3 = ElementCategoryFilter(Categories=model_3, Inverted=False)
bycategory_4 = ElementCategoryFilter(Categories=model_4, Inverted=False)
bycategory_5 = ElementCategoryFilter(Categories=model_5, Inverted=False)
bycategory_6 = ElementCategoryFilter(Categories=model_6, Inverted=False)
bycategory_7 = ElementCategoryFilter(Categories=model_7, Inverted=False)
bycategory_8 = ElementCategoryFilter(Categories=model_8, Inverted=False)
query_types = QueryTypes(Filter=bycategory)
query_elements = QueryElements(Filter=bycategory_2)
panel = Panel(query_walls)
element_type = ElementType(Element=query_walls)  # -> Element, Type
query_types_2 = QueryTypes(Filter=bycategory_3)
query_types_3 = QueryTypes(Filter=bycategory_4)
query_types_4 = QueryTypes(Filter=bycategory_5)
query_elements_2 = DocumentElements(Filter=bycategory_6)
query_elements_3 = DocumentElements(Filter=bycategory_7)
query_elements_4 = DocumentElements(Filter=bycategory_8)
panel_2 = Panel(element_type.Type)
panel_3 = Panel(query_types)
panel_4 = Panel(query_elements)
panel_5 = Panel(query_types_2)
panel_6 = Panel(query_types_3)
panel_7 = Panel(query_types_4)
panel_8 = Panel(query_elements_2)
panel_9 = Panel(query_elements_3)
panel_10 = Panel(query_elements_4)
wall_system_family_2 = WallSystemFamily({"Basic": 0, "Curtain": 1, "Stacked": 2}, selected="Curtain")
wall_system_family_3 = WallSystemFamily({"Basic": 0, "Curtain": 1, "Stacked": 2}, selected="Curtain")
wall_system_family_4 = WallSystemFamily({"Basic": 0, "Curtain": 1, "Stacked": 2}, selected="Curtain")
wall_system_family_5 = WallSystemFamily({"Basic": 0, "Curtain": 1, "Stacked": 2}, selected="Curtain")
wall_system_family_6 = WallSystemFamily({"Basic": 0, "Curtain": 1, "Stacked": 2}, selected="Curtain")
# INSTANCES
wall_system_family_7 = WallSystemFamily({"Basic": 0, "Curtain": 1, "Stacked": 2}, selected="Curtain")
query_walls_2 = DocumentWalls(WallSystemFamily=wall_system_family_2)
wall_system_family_8 = WallSystemFamily({"Basic": 0, "Curtain": 1, "Stacked": 2}, selected="Curtain")
wall_system_family_9 = WallSystemFamily({"Basic": 0, "Curtain": 1, "Stacked": 2}, selected="Curtain")
# CURTAIN GRID
wall_system_family_10 = WallSystemFamily({"Basic": 0, "Curtain": 1, "Stacked": 2}, selected="Curtain")
query_walls_3 = DocumentWalls(WallSystemFamily=wall_system_family_3)
query_walls_4 = DocumentWalls(WallSystemFamily=wall_system_family_4)
# GRID CELLS
query_walls_5 = DocumentWalls(WallSystemFamily=wall_system_family_5)
query_walls_6 = DocumentWalls(WallSystemFamily=wall_system_family_6)
query_walls_7 = DocumentWalls(WallSystemFamily=wall_system_family_7)
level_of_detail = LevelOfDetail({"Coarse": 1, "Medium": 2, "Fine": 3}, selected="Fine")
element_type_2 = ElementType(Element=query_walls_2)  # -> Element, Type
query_walls_8 = DocumentWalls(WallSystemFamily=wall_system_family_8)
query_walls_9 = DocumentWalls(WallSystemFamily=wall_system_family_9)
query_walls_10 = DocumentWalls(WallSystemFamily=wall_system_family_10)
analyze_curtain_wall = AnalyzeCurtainWall(CurtainWall=query_walls_3)  # -> CurtainGrid, HostWall
analyze_curtain_wall_2 = AnalyzeCurtainWall(CurtainWall=query_walls_4)  # -> CurtainGrid, HostWall
analyze_curtain_wall_3 = AnalyzeCurtainWall(CurtainWall=query_walls_5)  # -> CurtainGrid, HostWall
analyze_curtain_wall_4 = AnalyzeCurtainWall(CurtainWall=query_walls_6)  # -> CurtainGrid, HostWall
# CURTAIN WALLS
# TYPES
analyze_curtain_wall_type = AnalyzeCurtainWallType(CurtainWallType=element_type_2.Type)  # -> Function, AutomaticallyEmbed, CurtainPanel, JoinCondition, VerticalGridLayout, VerticalGridSpacing, VerticalGridAdjustForMullionSize, HorizontalGridLayout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
element_geometry = ElementGeometry(DetailLevel=level_of_detail, Elements=query_walls_7)
element_bounding_geometry = ElementBoundingGeometry(Element=query_walls_8)
analyze_curtain_wall_5 = AnalyzeCurtainWall(CurtainWall=query_walls_9)  # -> CurtainGrid, HostWall
analyze_curtain_wall_6 = AnalyzeCurtainWall(CurtainWall=query_walls_10)  # -> CurtainGrid, HostWall
analyze_curtain_grid = AnalyzeCurtainGrid(CurtainGrid=analyze_curtain_wall.CurtainGrid)  # -> Cells, Mullions, Panels, VerticalLines, VerticalAngle, VerticalJustification, VerticalOffset, HorizontalLines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
analyze_curtain_grid_2 = AnalyzeCurtainGrid(CurtainGrid=analyze_curtain_wall_2.CurtainGrid)  # -> Cells, Mullions, Panels, VerticalLines, VerticalAngle, VerticalJustification, VerticalOffset, HorizontalLines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
analyze_curtain_grid_3 = AnalyzeCurtainGrid(CurtainGrid=analyze_curtain_wall_3.CurtainGrid)  # -> Cells, Mullions, Panels, VerticalLines, VerticalAngle, VerticalJustification, VerticalOffset, HorizontalLines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
analyze_curtain_grid_4 = AnalyzeCurtainGrid(CurtainGrid=analyze_curtain_wall_4.CurtainGrid)  # -> Cells, Mullions, Panels, VerticalLines, VerticalAngle, VerticalJustification, VerticalOffset, HorizontalLines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
panel_11 = Panel(element_geometry)
bounding_geometry = Panel(element_bounding_geometry)
curtain_grid = Panel(analyze_curtain_wall_5.CurtainGrid)
host_wall = Panel(analyze_curtain_wall_6.HostWall)
analyze_curtain_grid_cell = AnalyzeCurtainGridCell(CurtainGridCell=analyze_curtain_grid_2.Cells)  # -> Curves, PlanarizedCurves
analyze_curtain_grid_cell_2 = AnalyzeCurtainGridCell(CurtainGridCell=analyze_curtain_grid_4.Cells)  # -> Curves, PlanarizedCurves
path_mapper = PathMapper(
    [analyze_curtain_wall_type.VerticalGridLayout, analyze_curtain_wall_type.VerticalGridSpacing, analyze_curtain_wall_type.VerticalGridAdjustForMullionSize],
    source="{A;B}(i)",
    target="{A;B;i}")
path_mapper_2 = PathMapper(
    [analyze_curtain_wall_type.HorizontalGridLayout, analyze_curtain_wall_type.HorizontalGridSpacing, analyze_curtain_wall_type.HorizontalGridAdjustForMullionSize],
    source="{A;B}(i)",
    target="{A;B;i}")
path_mapper_3 = PathMapper(
    [analyze_curtain_wall_type.VerticalMullionsInteriorType, analyze_curtain_wall_type.VerticalMullionsBorder1Type, analyze_curtain_wall_type.VerticalMullionsBorder2Type],
    source="{A;B}(i)",
    target="{A;B;i}")
path_mapper_4 = PathMapper(
    [analyze_curtain_wall_type.HorizontalMullionsInteriorType, analyze_curtain_wall_type.HorizontalMullionsBorder1Type, analyze_curtain_wall_type.HorizontalMullionsBorder2Type],
    source="{A;B}(i)",
    target="{A;B;i}")
wall_function = Panel(analyze_curtain_wall_type.Function)
automatically_embed = Panel(analyze_curtain_wall_type.AutomaticallyEmbed)
curtain_panel_type = Panel(analyze_curtain_wall_type.CurtainPanel)
curtain_join_condition = Panel(analyze_curtain_wall_type.JoinCondition)
grid_cells = Panel(analyze_curtain_grid.Cells)
grid_mullions = Panel(analyze_curtain_grid.Mullions)
grid_inserts = Panel(analyze_curtain_grid.Panels)
u_grid_lines = Panel(analyze_curtain_grid.VerticalLines)
path_mapper_5 = PathMapper(
    [analyze_curtain_grid.VerticalAngle, analyze_curtain_grid.VerticalJustification, analyze_curtain_grid.VerticalOffset],
    source="{A;B}(i)",
    target="{A;B;i}")
v_grid_lines = Panel(analyze_curtain_grid.HorizontalLines)
path_mapper_6 = PathMapper(
    [analyze_curtain_grid.HorizontalAngle, analyze_curtain_grid.HorizontalJustification, analyze_curtain_grid.HorizontalOffset],
    source="{A;B}(i)",
    target="{A;B;i}")
list_length = ListLength(List=analyze_curtain_grid_3.Cells)
analyze_curtain_grid_cell_3 = AnalyzeCurtainGridCell(CurtainGridCell=analyze_curtain_grid_3.Cells)  # -> Curves, PlanarizedCurves
center_planes = BoundarySurfaces(Edges=analyze_curtain_grid_cell_2.PlanarizedCurves, UseTasks=False)
cell_count = Panel(list_length)
cell_curve = Panel(analyze_curtain_grid_cell.Curves)
u_grid_info = Panel(path_mapper)
v_grid_info = Panel(path_mapper_2)
u_mullion_info = Panel(path_mapper_3)
v_mullion_info = Panel(path_mapper_4)
grid_cell_geom = CustomPreview(Geometry=analyze_curtain_grid_cell.Curves, Material=ColourSwatch(SwatchColor=RGB(255, 255, 255)))
u_grid_info_2 = Panel(path_mapper_5)
v_grid_info_2 = Panel(path_mapper_6)
cell_panel_curve = Panel(analyze_curtain_grid_cell_2.PlanarizedCurves)
wall_function_2 = WallFunction({"Interior": 0, "Exterior": 1, "Foundation": 2, "Retaining": 3, "Soffit": 4, "Core-Shaft": 5}, selected="Interior")
area_moments = AreaMoments(Geometry=center_planes)  # -> Area, Centroid, Inertia, InertiaError, Secondary, SecondaryError, Gyration
cell_plane = CustomPreview(Geometry=center_planes, Material=ColourSwatch(SwatchColor=RGBA(219, 0, 255, 23)))
cell_curve_2 = Panel(analyze_curtain_grid_cell_3.Curves)
cell_panel_curve_2 = Panel(analyze_curtain_grid_cell_3.PlanarizedCurves)
curtain_grid_join_condition = CurtainGridJoinCondition({"Not Defined": 0, "Vertical Grid Continuous": 1, "Horizontal Grid Continuous": 2, "Border & Vertical Grid Continuous": 3, "Border & Horizontal Grid Continuous": 4}, selected="Not Defined")
shift_paths = ShiftPaths(Data=area_moments.Centroid, Offset=-1)
# = Layout
# = Spacing
# = Adjust for Mullion Size
curtain_grid_layout = CurtainGridLayout({"None": 0, "Fixed Distance": 1, "Fixed Number": 2, "Maximum Spacing": 3, "Minimum Spacing": 4}, selected="None")
# = Layout
# = Spacing
# = Adjust for Mullion Size
# = Inteiror Mullion Type
# = Start Mullion Type (Border 1)
# = End Mullion Type (Border 2)
# = Inteiror Mullion Type
# = Bottom Mullion Type (Border 1)
# = Top Mullion Type (Border 2)
curtain_grid_layout_2 = CurtainGridLayout({"None": 0, "Fixed Distance": 1, "Fixed Number": 2, "Maximum Spacing": 3, "Minimum Spacing": 4}, selected="None")
point_list = PointList(Points=shift_paths)
# = Grid Angle
# = Grid Justification
# = Grid Offset
curtain_grid_align_type = CurtainGridAlignType({"No Justify": 0, "Beginning": 1, "Center": 2, "End": 3}, selected="No Justify")
# = Grid Angle
# = Grid Justification
# = Grid Offset
curtain_grid_align_type_2 = CurtainGridAlignType({"No Justify": 0, "Beginning": 1, "Center": 2, "End": 3}, selected="No Justify")
wall_system_family_11 = WallSystemFamily({"Basic": 0, "Curtain": 1, "Stacked": 2}, selected="Curtain")
wall_system_family_12 = WallSystemFamily({"Basic": 0, "Curtain": 1, "Stacked": 2}, selected="Curtain")
wall_system_family_13 = WallSystemFamily({"Basic": 0, "Curtain": 1, "Stacked": 2}, selected="Curtain")
wall_system_family_14 = WallSystemFamily({"Basic": 0, "Curtain": 1, "Stacked": 2}, selected="Curtain")
wall_system_family_15 = WallSystemFamily({"Basic": 0, "Curtain": 1, "Stacked": 2}, selected="Curtain")
wall_system_family_16 = WallSystemFamily({"Basic": 0, "Curtain": 1, "Stacked": 2}, selected="Curtain")
# TYPES
query_walls_11 = DocumentWalls(WallSystemFamily=wall_system_family_11)
query_walls_12 = DocumentWalls(WallSystemFamily=wall_system_family_12)
# MULLIONS
query_walls_13 = DocumentWalls(WallSystemFamily=wall_system_family_13)
query_walls_14 = DocumentWalls(WallSystemFamily=wall_system_family_14)
query_walls_15 = DocumentWalls(WallSystemFamily=wall_system_family_15)
query_walls_16 = DocumentWalls(WallSystemFamily=wall_system_family_16)
analyze_curtain_wall_7 = AnalyzeCurtainWall(CurtainWall=query_walls_11)  # -> CurtainGrid, HostWall
analyze_curtain_wall_8 = AnalyzeCurtainWall(CurtainWall=query_walls_12)  # -> CurtainGrid, HostWall
analyze_curtain_wall_9 = AnalyzeCurtainWall(CurtainWall=query_walls_13)  # -> CurtainGrid, HostWall
analyze_curtain_wall_10 = AnalyzeCurtainWall(CurtainWall=query_walls_14)  # -> CurtainGrid, HostWall
analyze_curtain_wall_11 = AnalyzeCurtainWall(CurtainWall=query_walls_15)  # -> CurtainGrid, HostWall
analyze_curtain_wall_12 = AnalyzeCurtainWall(CurtainWall=query_walls_16)  # -> CurtainGrid, HostWall
analyze_curtain_grid_5 = AnalyzeCurtainGrid(CurtainGrid=analyze_curtain_wall_7.CurtainGrid)  # -> Cells, Mullions, Panels, VerticalLines, VerticalAngle, VerticalJustification, VerticalOffset, HorizontalLines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
analyze_curtain_grid_6 = AnalyzeCurtainGrid(CurtainGrid=analyze_curtain_wall_8.CurtainGrid)  # -> Cells, Mullions, Panels, VerticalLines, VerticalAngle, VerticalJustification, VerticalOffset, HorizontalLines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
analyze_curtain_grid_7 = AnalyzeCurtainGrid(CurtainGrid=analyze_curtain_wall_9.CurtainGrid)  # -> Cells, Mullions, Panels, VerticalLines, VerticalAngle, VerticalJustification, VerticalOffset, HorizontalLines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
analyze_curtain_grid_8 = AnalyzeCurtainGrid(CurtainGrid=analyze_curtain_wall_10.CurtainGrid)  # -> Cells, Mullions, Panels, VerticalLines, VerticalAngle, VerticalJustification, VerticalOffset, HorizontalLines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
analyze_curtain_grid_9 = AnalyzeCurtainGrid(CurtainGrid=analyze_curtain_wall_11.CurtainGrid)  # -> Cells, Mullions, Panels, VerticalLines, VerticalAngle, VerticalJustification, VerticalOffset, HorizontalLines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
analyze_curtain_grid_10 = AnalyzeCurtainGrid(CurtainGrid=analyze_curtain_wall_12.CurtainGrid)  # -> Cells, Mullions, Panels, VerticalLines, VerticalAngle, VerticalJustification, VerticalOffset, HorizontalLines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
curve = Curve(analyze_curtain_grid_7.Mullions)
analyze_mullion = AnalyzeMullion(Mullion=analyze_curtain_grid_5.Mullions)  # -> Type, AxisCurve, BasePoint
analyze_mullion_2 = AnalyzeMullion(Mullion=analyze_curtain_grid_6.Mullions)  # -> Type, AxisCurve, BasePoint
element_geometry_2 = ElementGeometry(Elements=analyze_curtain_grid_8.Mullions)
analyze_mullion_3 = AnalyzeMullion(Mullion=analyze_curtain_grid_9.Mullions)  # -> Type, AxisCurve, BasePoint
analyze_mullion_4 = AnalyzeMullion(Mullion=analyze_curtain_grid_10.Mullions)  # -> Type, AxisCurve, BasePoint
length = Length(Curve=curve)
mullion_base_curves = Panel(curve)
analyze_mullion_type = AnalyzeMullionType(MullionType=analyze_mullion.Type)  # -> MullionSystemFamily, Angle, Offset, Profile, Position, CornerMullion, Thickness, Depth1, Depth2, Radius
curtain_mullion_system_family = CurtainMullionSystemFamily({"Unknown": -1, "Rectangular": 0, "Circular": 1, "L Corner": 2, "Trapezoid Corner": 3, "Quad Corner": 4, "V Corner": 5}, selected="L Corner")
analyze_mullion_type_2 = AnalyzeMullionType(MullionType=analyze_mullion_2.Type)  # -> MullionSystemFamily, Angle, Offset, Profile, Position, CornerMullion, Thickness, Depth1, Depth2, Radius
boolean = Boolean(invert(length))
grid_mullion_geom = CustomPreview(Geometry=element_geometry_2, Material=ColourSwatch(SwatchColor=RGBA(0, 112, 255, 101)))
mullion_base_curves_2 = Panel(analyze_mullion_3.AxisCurve)
curve_middle = CurveMiddle(Curve=analyze_mullion_3.AxisCurve)
path_mapper_7 = PathMapper(analyze_mullion_4.BasePoint, source="{A;B;C}(i)", target="{A;B;C;i}")
base_curve = Panel(analyze_mullion_4.AxisCurve)
type = Panel(analyze_mullion_4.Type)
cull_pattern = CullPattern(List=length, CullPattern=boolean)
point_list_2 = PointList(Points=curve_middle)
mullion_base_curve_length = Panel(cull_pattern)
path_mapper_8 = PathMapper(
    [analyze_mullion_type.MullionSystemFamily, analyze_mullion_type.Angle, analyze_mullion_type.Offset, analyze_mullion_type.Profile, analyze_mullion_type.Position, analyze_mullion_type.CornerMullion, analyze_mullion_type.Thickness, analyze_mullion_type.Depth1, analyze_mullion_type.Depth2, analyze_mullion_type.Radius],
    source="{A;B;C}(i)",
    target="{A;B;C;i}")
# = Base Point
# = Locked?
# = Lockable?
mullion_info = Panel(path_mapper_7)
equality = Equality(FirstNumber=analyze_mullion_type_2.MullionSystemFamily, SecondNumber=curtain_mullion_system_family)  # -> Equality, Inequality
mullion_type_properties = Panel(path_mapper_8)
cull_pattern_2 = CullPattern(List=analyze_curtain_grid_6.Mullions, CullPattern=equality.Equality)
panel_12 = Panel(cull_pattern_2)
# = System Family
# = Angle
# = Offset
# = Profile
# = Position
# = Corner Mullion
# = Thickness
# = Dimension 1
# = Dimension 2
# = Radius
curtain_mullion_system_family_2 = CurtainMullionSystemFamily({"Unknown": -1, "Rectangular": 0, "Circular": 1, "L Corner": 2, "Trapezoid Corner": 3, "Quad Corner": 4, "V Corner": 5}, selected="Unknown")
curtain_mullion_position = CurtainMullionPosition({"Parallel to Ground": 0, "Perpendicular to Face": 1}, selected="Parallel to Ground")
wall_system_family_17 = WallSystemFamily({"Basic": 0, "Curtain": 1, "Stacked": 2}, selected="Curtain")
wall_system_family_18 = WallSystemFamily({"Basic": 0, "Curtain": 1, "Stacked": 2}, selected="Curtain")
wall_system_family_19 = WallSystemFamily({"Basic": 0, "Curtain": 1, "Stacked": 2}, selected="Curtain")
wall_system_family_20 = WallSystemFamily({"Basic": 0, "Curtain": 1, "Stacked": 2}, selected="Curtain")
wall_system_family_21 = WallSystemFamily({"Basic": 0, "Curtain": 1, "Stacked": 2}, selected="Curtain")
wall_system_family_22 = WallSystemFamily({"Basic": 0, "Curtain": 1, "Stacked": 2}, selected="Curtain")
wall_system_family_23 = WallSystemFamily({"Basic": 0, "Curtain": 1, "Stacked": 2}, selected="Curtain")
query_walls_17 = DocumentWalls(WallSystemFamily=wall_system_family_17)
query_walls_18 = DocumentWalls(WallSystemFamily=wall_system_family_18)
# PANELS
query_walls_19 = DocumentWalls(WallSystemFamily=wall_system_family_19)
query_walls_20 = DocumentWalls(WallSystemFamily=wall_system_family_20)
query_walls_21 = DocumentWalls(WallSystemFamily=wall_system_family_21)
query_walls_22 = DocumentWalls(WallSystemFamily=wall_system_family_22)
query_walls_23 = DocumentWalls(WallSystemFamily=wall_system_family_23)
analyze_curtain_wall_13 = AnalyzeCurtainWall(CurtainWall=query_walls_17)  # -> CurtainGrid, HostWall
analyze_curtain_wall_14 = AnalyzeCurtainWall(CurtainWall=query_walls_18)  # -> CurtainGrid, HostWall
analyze_curtain_wall_15 = AnalyzeCurtainWall(CurtainWall=query_walls_19)  # -> CurtainGrid, HostWall
analyze_curtain_wall_16 = AnalyzeCurtainWall(CurtainWall=query_walls_20)  # -> CurtainGrid, HostWall
analyze_curtain_wall_17 = AnalyzeCurtainWall(CurtainWall=query_walls_21)  # -> CurtainGrid, HostWall
# TYPES
model_9 = ModelCategoriesPicker({"Air Systems": -2001008, "Air Terminals": -2008013, "Analysis Display Style": -2000304, "Analysis Results": -2000303, "Areas": -2003200, "Bridge Abutments": -2006130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}, selected="Curtain Panels": -2000170)
analyze_curtain_wall_18 = AnalyzeCurtainWall(CurtainWall=query_walls_22)  # -> CurtainGrid, HostWall
analyze_curtain_wall_19 = AnalyzeCurtainWall(CurtainWall=query_walls_23)  # -> CurtainGrid, HostWall
model_10 = ModelCategoriesPicker({"Air Systems": -2001008, "Air Terminals": -2008013, "Analysis Display Style": -2000304, "Analysis Results": -2000303, "Areas": -2003200, "Bridge Abutments": -2006130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}, selected="Curtain Panels": -2000170)
model_11 = ModelCategoriesPicker({"Air Systems": -2001008, "Air Terminals": -2008013, "Analysis Display Style": -2000304, "Analysis Results": -2000303, "Areas": -2003200, "Bridge Abutments": -2006130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}, selected="Curtain Panels": -2000170)
model_12 = ModelCategoriesPicker({"Air Systems": -2001008, "Air Terminals": -2008013, "Analysis Display Style": -2000304, "Analysis Results": -2000303, "Areas": -2003200, "Bridge Abutments": -2006130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}, selected="Curtain Panels": -2000170)
model_13 = ModelCategoriesPicker({"Air Systems": -2001008, "Air Terminals": -2008013, "Analysis Display Style": -2000304, "Analysis Results": -2000303, "Areas": -2003200, "Bridge Abutments": -2006130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}, selected="Curtain Systems": -2000340)
# CURTAIN SYSTEMS
model_14 = ModelCategoriesPicker({"Air Systems": -2001008, "Air Terminals": -2008013, "Analysis Display Style": -2000304, "Analysis Results": -2000303, "Areas": -2003200, "Bridge Abutments": -2006130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}, selected="Curtain Systems": -2000340)
model_15 = ModelCategoriesPicker({"Air Systems": -2001008, "Air Terminals": -2008013, "Analysis Display Style": -2000304, "Analysis Results": -2000303, "Areas": -2003200, "Bridge Abutments": -2006130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}, selected="Curtain Systems": -2000340)
analyze_curtain_grid_11 = AnalyzeCurtainGrid(CurtainGrid=analyze_curtain_wall_14.CurtainGrid)  # -> Cells, Mullions, Panels, VerticalLines, VerticalAngle, VerticalJustification, VerticalOffset, HorizontalLines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
analyze_curtain_grid_12 = AnalyzeCurtainGrid(CurtainGrid=analyze_curtain_wall_13.CurtainGrid)  # -> Cells, Mullions, Panels, VerticalLines, VerticalAngle, VerticalJustification, VerticalOffset, HorizontalLines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
analyze_curtain_grid_13 = AnalyzeCurtainGrid(CurtainGrid=analyze_curtain_wall_15.CurtainGrid)  # -> Cells, Mullions, Panels, VerticalLines, VerticalAngle, VerticalJustification, VerticalOffset, HorizontalLines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
analyze_curtain_grid_14 = AnalyzeCurtainGrid(CurtainGrid=analyze_curtain_wall_16.CurtainGrid)  # -> Cells, Mullions, Panels, VerticalLines, VerticalAngle, VerticalJustification, VerticalOffset, HorizontalLines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
analyze_curtain_grid_15 = AnalyzeCurtainGrid(CurtainGrid=analyze_curtain_wall_17.CurtainGrid)  # -> Cells, Mullions, Panels, VerticalLines, VerticalAngle, VerticalJustification, VerticalOffset, HorizontalLines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
analyze_curtain_grid_16 = AnalyzeCurtainGrid(CurtainGrid=analyze_curtain_wall_18.CurtainGrid)  # -> Cells, Mullions, Panels, VerticalLines, VerticalAngle, VerticalJustification, VerticalOffset, HorizontalLines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
analyze_curtain_grid_17 = AnalyzeCurtainGrid(CurtainGrid=analyze_curtain_wall_19.CurtainGrid)  # -> Cells, Mullions, Panels, VerticalLines, VerticalAngle, VerticalJustification, VerticalOffset, HorizontalLines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
bycategory_9 = CategoryFilter(Categories=model_9, Inverted=False)
bycategory_10 = CategoryFilter(Categories=model_10, Inverted=False)
bycategory_11 = CategoryFilter(Categories=model_11, Inverted=False)
bycategory_12 = CategoryFilter(Categories=model_12, Inverted=False)
bycategory_13 = ElementCategoryFilter(Categories=model_13, Inverted=False)
bycategory_14 = ElementCategoryFilter(Categories=model_14, Inverted=False)
bycategory_15 = ElementCategoryFilter(Categories=model_15, Inverted=False)
panel_13 = Panel(analyze_curtain_grid_12.Panels)
analyze_panel = AnalyzePanel(Panel=analyze_curtain_grid_14.Panels)  # -> Type, HostPanel, BasePoint, Orientation, Width, Height
element_geometry_3 = ElementGeometry(Elements=analyze_curtain_grid_13.Panels)
filter_element = FilterElement(Elements=analyze_curtain_grid_15.Panels, Filter=bycategory_10)
filter_element_2 = FilterElement(Elements=analyze_curtain_grid_11.Panels, Filter=bycategory_9)
query_types_5 = QueryTypes(Filter=bycategory_13)
filter_element_3 = FilterElement(Elements=analyze_curtain_grid_16.Panels, Filter=bycategory_11)
filter_element_4 = FilterElement(Elements=analyze_curtain_grid_17.Panels, Filter=bycategory_12)
query_elements_5 = DocumentElements(Filter=bycategory_14)
query_elements_6 = DocumentElements(Filter=bycategory_15)
cull_pattern_3 = CullPattern(List=analyze_curtain_grid_15.Panels, CullPattern=filter_element)
grid_insert_geom = CustomPreview(Geometry=element_geometry_3, Material=ColourSwatch(SwatchColor=RGBA(219, 0, 255, 23)))
cull_pattern_4 = CullPattern(List=analyze_curtain_grid_11.Panels, CullPattern=filter_element_2)
analyze_curtain_system_type = AnalyzeCurtainSystemType(CurtainSystemType=query_types_5)  # -> CurtainPanel, JoinCondition, Grid1Layout, Grid1Spacing, Grid1AdjustForMullionSize, Grid2Layout, Grid2Spacing, Grid2AdjustForMullionSize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
cull_pattern_5 = CullPattern(List=analyze_curtain_grid_16.Panels, CullPattern=filter_element_3)
panel_symbol = Panel(analyze_panel.Type)
host_panel = Panel(analyze_panel.HostPanel)
panel_base_point = Panel(analyze_panel.BasePoint)
panel_orientation_vector = Panel(analyze_panel.Orientation)
cull_pattern_6 = CullPattern(List=analyze_curtain_grid_17.Panels, CullPattern=filter_element_4)
path_mapper_9 = PathMapper([analyze_panel.Width, analyze_panel.Height], source="{A;B;C;D}(i)", target="{A;B;C;D;i}")
analyze_curtain_system = AnalyzeCurtainSystem(CurtainSystem=query_elements_5)
analyze_curtain_system_2 = AnalyzeCurtainSystem(CurtainSystem=query_elements_6)
analyze_panel_2 = AnalyzePanel(Panel=cull_pattern_3)  # -> Type, HostPanel, BasePoint, Orientation, Width, Height
create_set = CreateSet(List=panel_13)  # -> Set, Map
analyze_panel_3 = AnalyzePanel(Panel=cull_pattern_5)  # -> Type, HostPanel, BasePoint, Orientation, Width, Height
element_geometry_4 = ElementGeometry(Elements=cull_pattern_4)
analyze_panel_4 = AnalyzePanel(Panel=cull_pattern_4)  # -> Type, HostPanel, BasePoint, Orientation, Width, Height
analyze_panel_5 = AnalyzePanel(Panel=cull_pattern_6)  # -> Type, HostPanel, BasePoint, Orientation, Width, Height
grid_insert_types = Panel(create_set.Set)
panel_14 = Panel(analyze_curtain_system)
panel_symbol_2 = Panel(analyze_panel_2.Type)
analyze_curtain_grid_18 = AnalyzeCurtainGrid(CurtainGrid=analyze_curtain_system_2)  # -> Cells, Mullions, Panels, VerticalLines, VerticalAngle, VerticalJustification, VerticalOffset, HorizontalLines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
analyze_panel_type = AnalyzePanelType(PanelType=analyze_panel_3.Type)  # -> Family, Offset, Thickness
panel_symbol_3 = Panel(analyze_panel_5.Type)
# = Width
# = Height
panel_size = Panel(path_mapper_9)
list_item = ListItem(List=element_geometry_4, Index=0, Wrap=True)
grid_insert_geom_2 = CustomPreview(Geometry=element_geometry_4, Material=ColourSwatch(SwatchColor=RGBA(219, 0, 255, 23)))
path_mapper_10 = PathMapper(
    [analyze_curtain_system_type.Grid1Layout, analyze_curtain_system_type.Grid1Spacing, analyze_curtain_system_type.Grid1AdjustForMullionSize],
    source="{A;B}(i)",
    target="{A;B;i}")
path_mapper_11 = PathMapper(
    [analyze_curtain_system_type.Grid2Layout, analyze_curtain_system_type.Grid2Spacing, analyze_curtain_system_type.Grid2AdjustForMullionSize],
    source="{A;B}(i)",
    target="{A;B;i}")
path_mapper_12 = PathMapper(
    [analyze_curtain_system_type.Grid1MullionsInteriorType, analyze_curtain_system_type.Grid1MullionsBorder1Type, analyze_curtain_system_type.Grid1MullionsBorder2Type],
    source="{A;B}(i)",
    target="{A;B;i}")
path_mapper_13 = PathMapper(
    [analyze_curtain_system_type.Grid2MullionsInteriorType, analyze_curtain_system_type.Grid2MullionsBorder1Type, analyze_curtain_system_type.Grid2MullionsBorder2Type],
    source="{A;B}(i)",
    target="{A;B;i}")
curtain_join_condition_2 = Panel(analyze_curtain_system_type.JoinCondition)
curtain_panel_type_2 = Panel(analyze_curtain_system_type.CurtainPanel)
shift_paths_2 = ShiftPaths(Data=list_item, Offset=-1)
path_mapper_14 = PathMapper(
    [analyze_panel_type.Family, analyze_panel_type.Offset, analyze_panel_type.Thickness],
    source="{A;B;C;D}(i)",
    target="{A;B;C;D;i}")
panel_15 = Panel(analyze_curtain_grid_18.Panels)
u_grid_info_3 = Panel(path_mapper_10)
v_grid_info_3 = Panel(path_mapper_11)
u_mullion_info_2 = Panel(path_mapper_12)
v_mullion_info_2 = Panel(path_mapper_13)
panel_centroids = VolumeMoments(Geometry=shift_paths_2, UseTasks=True)  # -> Volume, Centroid, Inertia, InertiaError, Secondary, SecondaryError, Gyration
create_set_2 = CreateSet(List=panel_symbol_3)  # -> Set, Map
# = Panel System Family
# = Offset
# = Thickness
mullion_type_properties_2 = Panel(path_mapper_14)
unique_panel_types = Panel(create_set_2.Set)
curtain_grid_join_condition_2 = CurtainGridJoinCondition({"Not Defined": 0, "Vertical Grid Continuous": 1, "Horizontal Grid Continuous": 2, "Border & Vertical Grid Continuous": 3, "Border & Horizontal Grid Continuous": 4}, selected="Not Defined")
panel_normals = VectorDisplayEx(
    Point=panel_centroids.Centroid,
    Vector=analyze_panel_4.Orientation,
    Colour=ColourSwatch(SwatchColor=RGB(255, 255, 0)),
    Width=1)
panel_normals_2 = VectorDisplayEx(
    Point=analyze_panel_4.BasePoint,
    Vector=analyze_panel_4.Orientation,
    Colour=ColourSwatch(SwatchColor=RGB(89, 0, 255)),
    Width=1)
# = Layout
# = Spacing
# = Adjust for Mullion Size
# = Grid 1 Inteiror Mullion Type
# = Start Mullion Type (Border 1)
# = End Mullion Type (Border 2)
# = Grid 2 Inteiror Mullion Type
# = Start Mullion Type (Border 1)
# = End Mullion Type (Border 2)
curtain_grid_layout_3 = CurtainGridLayout({"None": 0, "Fixed Distance": 1, "Fixed Number": 2, "Maximum Spacing": 3, "Minimum Spacing": 4}, selected="None")
# = Layout
# = Spacing
# = Adjust for Mullion Size
curtain_grid_layout_4 = CurtainGridLayout({"None": 0, "Fixed Distance": 1, "Fixed Number": 2, "Maximum Spacing": 3, "Minimum Spacing": 4}, selected="None")
wall_system_family_24 = WallSystemFamily({"Basic": 0, "Curtain": 1, "Stacked": 2}, selected="Curtain")
wall_system_family_25 = WallSystemFamily({"Basic": 0, "Curtain": 1, "Stacked": 2}, selected="Curtain")
wall_system_family_26 = WallSystemFamily({"Basic": 0, "Curtain": 1, "Stacked": 2}, selected="Curtain")
wall_system_family_27 = WallSystemFamily({"Basic": 0, "Curtain": 1, "Stacked": 2}, selected="Curtain")
wall_system_family_28 = WallSystemFamily({"Basic": 0, "Curtain": 1, "Stacked": 2}, selected="Curtain")
wall_system_family_29 = WallSystemFamily({"Basic": 0, "Curtain": 1, "Stacked": 2}, selected="Curtain")
# GRID LINES - MULLIONS AND PANELS
query_walls_24 = DocumentWalls(WallSystemFamily=wall_system_family_24)
query_walls_25 = DocumentWalls(WallSystemFamily=wall_system_family_25)
query_walls_26 = DocumentWalls(WallSystemFamily=wall_system_family_26)
query_walls_27 = DocumentWalls(WallSystemFamily=wall_system_family_27)
query_walls_28 = DocumentWalls(WallSystemFamily=wall_system_family_28)
# GRID LINES
query_walls_29 = DocumentWalls(WallSystemFamily=wall_system_family_29)
analyze_curtain_wall_20 = AnalyzeCurtainWall(CurtainWall=query_walls_24)  # -> CurtainGrid, HostWall
analyze_curtain_wall_21 = AnalyzeCurtainWall(CurtainWall=query_walls_25)  # -> CurtainGrid, HostWall
analyze_curtain_wall_22 = AnalyzeCurtainWall(CurtainWall=query_walls_26)  # -> CurtainGrid, HostWall
analyze_curtain_wall_23 = AnalyzeCurtainWall(CurtainWall=query_walls_27)  # -> CurtainGrid, HostWall
analyze_curtain_wall_24 = AnalyzeCurtainWall(CurtainWall=query_walls_28)  # -> CurtainGrid, HostWall
analyze_curtain_wall_25 = AnalyzeCurtainWall(CurtainWall=query_walls_29)  # -> CurtainGrid, HostWall
analyze_curtain_grid_19 = AnalyzeCurtainGrid(CurtainGrid=analyze_curtain_wall_20.CurtainGrid)  # -> Cells, Mullions, Panels, VerticalLines, VerticalAngle, VerticalJustification, VerticalOffset, HorizontalLines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
analyze_curtain_grid_20 = AnalyzeCurtainGrid(CurtainGrid=analyze_curtain_wall_21.CurtainGrid)  # -> Cells, Mullions, Panels, VerticalLines, VerticalAngle, VerticalJustification, VerticalOffset, HorizontalLines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
analyze_curtain_grid_21 = AnalyzeCurtainGrid(CurtainGrid=analyze_curtain_wall_22.CurtainGrid)  # -> Cells, Mullions, Panels, VerticalLines, VerticalAngle, VerticalJustification, VerticalOffset, HorizontalLines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
analyze_curtain_grid_22 = AnalyzeCurtainGrid(CurtainGrid=analyze_curtain_wall_23.CurtainGrid)  # -> Cells, Mullions, Panels, VerticalLines, VerticalAngle, VerticalJustification, VerticalOffset, HorizontalLines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
analyze_curtain_grid_23 = AnalyzeCurtainGrid(CurtainGrid=analyze_curtain_wall_24.CurtainGrid)  # -> Cells, Mullions, Panels, VerticalLines, VerticalAngle, VerticalJustification, VerticalOffset, HorizontalLines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
analyze_curtain_grid_24 = AnalyzeCurtainGrid(CurtainGrid=analyze_curtain_wall_25.CurtainGrid)  # -> Cells, Mullions, Panels, VerticalLines, VerticalAngle, VerticalJustification, VerticalOffset, HorizontalLines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; disabled
analyze_curtain_grid_line = AnalyzeCurtainGridLine(CurtainGridLine=analyze_curtain_grid_19.VerticalLines)  # -> Curve, Segments, ExistingSegments, SkippedSegments, AttachedMullions, AttachedPanels
analyze_curtain_grid_line_2 = AnalyzeCurtainGridLine(CurtainGridLine=analyze_curtain_grid_19.HorizontalLines)  # -> Curve, Segments, ExistingSegments, SkippedSegments, AttachedMullions, AttachedPanels
list_item_2 = ListItem(List=analyze_curtain_grid_20.VerticalLines, Index=Slider(1, range=0..1), Wrap=True)
analyze_curtain_grid_line_3 = AnalyzeCurtainGridLine(CurtainGridLine=analyze_curtain_grid_22.VerticalLines)  # -> Curve, Segments, ExistingSegments, SkippedSegments, AttachedMullions, AttachedPanels
list_item_3 = ListItem(List=analyze_curtain_grid_20.HorizontalLines, Index=Slider(0, range=0..5), Wrap=True)
curve_2 = Curve(analyze_curtain_grid_24.HorizontalLines)  # disabled
curve_3 = Curve(analyze_curtain_grid_24.VerticalLines)  # disabled
analyze_curtain_grid_line_4 = AnalyzeCurtainGridLine(CurtainGridLine=analyze_curtain_grid_21.VerticalLines)  # -> Curve, Segments, ExistingSegments, SkippedSegments, AttachedMullions, AttachedPanels
analyze_curtain_grid_line_5 = AnalyzeCurtainGridLine(CurtainGridLine=analyze_curtain_grid_21.HorizontalLines)  # -> Curve, Segments, ExistingSegments, SkippedSegments, AttachedMullions, AttachedPanels
analyze_curtain_grid_line_6 = AnalyzeCurtainGridLine(CurtainGridLine=analyze_curtain_grid_23.VerticalLines)  # -> Curve, Segments, ExistingSegments, SkippedSegments, AttachedMullions, AttachedPanels
analyze_curtain_grid_line_7 = AnalyzeCurtainGridLine(CurtainGridLine=analyze_curtain_grid_23.HorizontalLines)  # -> Curve, Segments, ExistingSegments, SkippedSegments, AttachedMullions, AttachedPanels
colour_swatch = ColourSwatch(SwatchColor=RGB(255, 255, 255))  # disabled
grid_cell_geom_2 = CustomPreview(Geometry=curve_3, Material=colour_swatch)  # disabled
colour_swatch_2 = ColourSwatch(SwatchColor=RGB(255, 255, 255))  # disabled
grid_cell_geom_3 = CustomPreview(Geometry=curve_2, Material=colour_swatch_2)  # disabled
analyze_curtain_grid_line_8 = AnalyzeCurtainGridLine(CurtainGridLine=list_item_2)  # -> Curve, Segments, ExistingSegments, SkippedSegments, AttachedMullions, AttachedPanels
analyze_curtain_grid_line_9 = AnalyzeCurtainGridLine(CurtainGridLine=list_item_3)  # -> Curve, Segments, ExistingSegments, SkippedSegments, AttachedMullions, AttachedPanels
element_geometry_5 = ElementGeometry(Elements=analyze_curtain_grid_line_2.AttachedMullions)
element_geometry_6 = ElementGeometry(Elements=analyze_curtain_grid_line.AttachedMullions)
mullion_geom = CustomPreview(Geometry=analyze_curtain_grid_line.Curve, Material=ColourSwatch(SwatchColor=RGB(76, 76, 76)))
grid_cell_geom_4 = CustomPreview(Geometry=analyze_curtain_grid_line_4.Curve, Material=ColourSwatch(SwatchColor=RGB(255, 255, 255)))
grid_cell_geom_5 = CustomPreview(Geometry=analyze_curtain_grid_line_5.Curve, Material=ColourSwatch(SwatchColor=RGB(222, 222, 222)))
grid_cell_geom_6 = CustomPreview(Geometry=analyze_curtain_grid_line_6.Segments, Material=ColourSwatch(SwatchColor=RGB(255, 255, 255)))
grid_cell_geom_7 = CustomPreview(Geometry=analyze_curtain_grid_line_7.Segments, Material=ColourSwatch(SwatchColor=RGB(222, 222, 222)))
grid_line_curve = Panel(analyze_curtain_grid_line_3.Curve)
grid_line_segments = Panel(analyze_curtain_grid_line_3.Segments)
kept_line_segments = Panel(analyze_curtain_grid_line_3.ExistingSegments)
skipped_line_segments = Panel(analyze_curtain_grid_line_3.SkippedSegments)
attached_mullions = Panel(analyze_curtain_grid_line_3.AttachedMullions)
attached_panels = Panel(analyze_curtain_grid_line_3.AttachedPanels)
element_geometry_7 = ElementGeometry(Elements=analyze_curtain_grid_line_8.AttachedPanels)
element_geometry_8 = ElementGeometry(Elements=analyze_curtain_grid_line_9.AttachedPanels)
mullion_geom_2 = CustomPreview(Geometry=element_geometry_6, Material=ColourSwatch(SwatchColor=RGBA(0, 111, 255, 23)))
mullion_geom_3 = CustomPreview(Geometry=element_geometry_5, Material=ColourSwatch(SwatchColor=RGBA(0, 242, 255, 23)))
mullion_geom_4 = CustomPreview(Geometry=element_geometry_7, Material=ColourSwatch(SwatchColor=RGBA(221, 0, 255, 23)))
mullion_geom_5 = CustomPreview(Geometry=element_geometry_8, Material=ColourSwatch(SwatchColor=RGBA(255, 0, 119, 23)))
