# Grasshopper definition revit-params.ghx (Grasshopper 1.0.7)
# plug-ins: Rhino.Inside for Autodesk Revit

shared_parameter_guid = Panel("0a8f2769-7031-47d8-b2e3-cb6345608516")
parameter_name = Panel("Volume")
graphical_element = GraphicalElement(<wall referenced from the Revit model>)
graphical_element_2 = GraphicalElement(<wall referenced from the Revit model>)
graphical_element_3 = GraphicalElement(<wall referenced from the Revit model>)
graphical_element_4 = GraphicalElement(<wall referenced from the Revit model>)
parameterkey = ParameterKey(<parameterkey referenced from the Revit model>)
graphical_element_5 = GraphicalElement(<wall referenced from the Revit model>)
inspect_element = InspectElement(Element=graphical_element_3)  # -> DimensionsVolume, DimensionsArea
inspect_element_2 = InspectElement(Element=graphical_element)
inspect_element_3 = InspectElement(Element=graphical_element_2)  # -> ConstraintsBaseExtensionDistance, ConstraintsTopExtensionDistance, ConstraintsRelatedToMass, ConstraintsLocationLine, ConstraintsBaseIsAttached, ConstraintsTopIsAttached, ConstraintsTopOffset, ConstraintsBaseOffset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
get_element_parameter = GetElementParameter(Element=graphical_element_5, ParameterKey=parameter_name)
get_element_parameter_2 = GetElementParameter(Element=graphical_element_4, ParameterKey=parameterkey)
graphical_element_6 = GraphicalElement(<wall referenced from the Revit model>)
guid = Guid(shared_parameter_guid)
volume = Panel(inspect_element.DimensionsVolume)
area = Panel(inspect_element.DimensionsArea)
panel = Panel(get_element_parameter_2)
panel_2 = Panel(get_element_parameter)
get_element_parameter_3 = GetElementParameter(Element=graphical_element_6, ParameterKey=guid)
parameter_name_2 = Panel("Base Constraint")
panel_3 = Panel(get_element_parameter_3)
graphical_element_7 = GraphicalElement(<wall referenced from the Revit model>)
find_builtinparameter = FindBuiltInParameter(E=graphical_element_7, N=parameter_name_2)  # -> BIP
# ---------- find_builtinparameter: Python ----------
import clr
clr.AddReference('System.Core')
clr.AddReference('RhinoInside.Revit')
clr.AddReference('RevitAPI') 
clr.AddReference('RevitAPIUI')

from System import Enum

import rhinoscriptsyntax as rs
import Rhino
import RhinoInside
import Grasshopper
from RhinoInside.Revit import Revit, Convert
from Autodesk.Revit import DB

doc = Revit.ActiveDBDocument

def get_builtinparameter(element, param_name):
    eparam = element.LookupParameter(param_name)
    if eparam:
        for biparam in DB.BuiltInParameter.GetValues(DB.BuiltInParameter):
            if int(biparam) == eparam.Definition.Id.IntegerValue:
                return biparam

BIP = get_builtinparameter(E, N)
# ---------- end find_builtinparameter ----------
db_builtinparameter = Panel(find_builtinparameter)
parameter_name_3 = Panel("Unconnected Height")
parameter_name_4 = Panel("Unconnected Height")
graphical_element_8 = GraphicalElement(<wall referenced from the Revit model>)
graphical_element_9 = GraphicalElement(<wall referenced from the Revit model>)
set_element_parameter = SetElementParameter(Element=graphical_element_8, ParameterKey=parameter_name_3, ParameterValue=Slider(8, range=0..10))
set_element_parameter_2 = SetElementParameter(Element=graphical_element_9, ParameterKey=parameter_name_4, ParameterValue=Slider(8, range=0..10))
panel_4 = Panel(set_element_parameter)
panel_5 = Panel(set_element_parameter_2)
get_element_parameter_4 = GetElementParameter(Element=set_element_parameter_2, ParameterKey=parameter_name_4)
unconnected_height = Panel(get_element_parameter_4)
parameter_name_5 = Panel("My Custom Parameter")
parameter_name_6 = Panel("My Custom Parameter")
graphical_element_10 = GraphicalElement(<wall referenced from the Revit model>)
get_element_parameter_5 = GetElementParameter(Element=graphical_element_10, ParameterKey=parameter_name_6)
define_shared_parameter = DefineSharedParameter(Name=parameter_name_5, Overwrite=Toggle(True))
deconstruct_parametervalue = DeconstructParameterValue(ParameterValue=get_element_parameter_5)  # -> Group, Type, Binding, Unit, IsReadOnly, UserModifiable
parameterkey_identity = ParameterKeyIdentity(ParameterKey=define_shared_parameter)  # -> Name, StorageType, Class, Guid
custom_shared_parameter = Panel(define_shared_parameter)
parameter_info = Panel([parameterkey_identity.Name, parameterkey_identity.StorageType, parameterkey_identity.Class, parameterkey_identity.Guid])
parameter_value_info = Panel([deconstruct_parametervalue.Group, deconstruct_parametervalue.Type, deconstruct_parametervalue.Binding, deconstruct_parametervalue.Unit, deconstruct_parametervalue.IsReadOnly, deconstruct_parametervalue.UserModifiable])
