# Grasshopper definition revit-walls.ghx (Grasshopper 1.0.7)
# plug-ins: Rhino.Inside for Autodesk Revit

model = ModelCategoriesPicker({"Air Systems": -2001008, "Air Terminals": -2008013, "Analysis Display Style": -2000304, "Analysis Results": -2000303, "Areas": -2003200, "Bridge Abutments": -2006130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}, selected="Walls": -2000011)
wall_system_family = WallSystemFamily({"Basic": 0, "Curtain": 1, "Stacked": 2}, selected="Basic")
model_2 = ModelCategoriesPicker({"Air Systems": -2001008, "Air Terminals": -2008013, "Analysis Display Style": -2000304, "Analysis Results": -2000303, "Areas": -2003200, "Bridge Abutments": -2006130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}, selected="Walls": -2000011)
# WALLS
model_3 = ModelCategoriesPicker({"Air Systems": -2001008, "Air Terminals": -2008013, "Analysis Display Style": -2000304, "Analysis Results": -2000303, "Areas": -2003200, "Bridge Abutments": -2006130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}, selected="Walls": -2000011)
model_4 = ModelCategoriesPicker({"Air Systems": -2001008, "Air Terminals": -2008013, "Analysis Display Style": -2000304, "Analysis Results": -2000303, "Areas": -2003200, "Bridge Abutments": -2006130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}, selected="Walls": -2000011)
wall_system_family_2 = WallSystemFamily({"Basic": 0, "Curtain": 1, "Stacked": 2}, selected=["Basic", "Curtain", "Stacked"])
wall_system_family_3 = WallSystemFamily({"Basic": 0, "Curtain": 1, "Stacked": 2}, selected=["Basic", "Curtain", "Stacked"])
model_5 = ModelCategoriesPicker({"Air Systems": -2001008, "Air Terminals": -2008013, "Analysis Display Style": -2000304, "Analysis Results": -2000303, "Areas": -2003200, "Bridge Abutments": -2006130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}, selected="Walls": -2000011)
model_6 = ModelCategoriesPicker({"Air Systems": -2001008, "Air Terminals": -2008013, "Analysis Display Style": -2000304, "Analysis Results": -2000303, "Areas": -2003200, "Bridge Abutments": -2006130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}, selected="Walls": -2000011)
model_7 = ModelCategoriesPicker({"Air Systems": -2001008, "Air Terminals": -2008013, "Analysis Display Style": -2000304, "Analysis Results": -2000303, "Areas": -2003200, "Bridge Abutments": -2006130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}, selected="Walls": -2000011)
query_walls = DocumentWalls(WallSystemFamily=wall_system_family)
bycategory = ElementCategoryFilter(Categories=model, Inverted=False)
bycategory_2 = ElementCategoryFilter(Categories=model_2, Inverted=False)
query_walls_2 = DocumentWalls(WallSystemFamily=wall_system_family_2)
query_walls_3 = DocumentWalls(WallSystemFamily=wall_system_family_3)
bycategory_3 = ElementCategoryFilter(Categories=model_4, Inverted=False)
bycategory_4 = ElementCategoryFilter(Categories=model_3, Inverted=False)
bycategory_5 = ElementCategoryFilter(Categories=model_5, Inverted=False)
level_of_detail = ValueList({"Coarse": 1, "Medium": 2, "Fine": 3}, selected="Fine")
query_elements = DocumentElements(Filter=bycategory)
bycategory_6 = ElementCategoryFilter(Categories=model_6, Inverted=False)
elementtype_byname = ElementTypeByName(
    model_7,
    {"Basic Wall : Wall 1": "446b5203-4968-4da7-940a-b32debc02868-47a110e3-8998-46b9-b589-5c597a2f4f14-000006ae", "Basic Wall : Wall 2": "446b5203-4968-4da7-940a-b32debc02868-3d36998f-6406-4270-a669-6bf59b967eb3-00000adf", "Basic Wall : Wall 3": "446b5203-4968-4da7-940a-b32debc02868-e7965944-b489-451c-a6fa-77451802bad9-0000111a", "Curtain Wall : Curtain Wall 1": "446b5203-4968-4da7-940a-b32debc02868-47a110e3-8998-46b9-b589-5c597a2f4f14-000006af"}, selected="Basic Wall : Wall 1")
element_type = ElementType(Element=query_walls)  # -> Element, Type
wall_instances = Panel(query_walls)
query_types = QueryTypes(Filter=bycategory_2)
query_elements_2 = DocumentElements(Filter=bycategory_3)
query_elements_3 = QueryElements(Filter=bycategory_4)
curve = Curve(query_walls_3)
curve_2 = Curve(query_walls_2)
query_elements_4 = DocumentElements(Filter=bycategory_5)
element_geometry = ElementGeometry(DetailLevel=level_of_detail, Elements=query_elements)
query_elements_5 = DocumentElements(Filter=bycategory_6)
wall_types = Panel(element_type.Type)
end_points = EndPoints(Curve=curve_2)  # -> Start, End
center_curve = Panel(curve)
panel = Panel(query_types)
bytype = ElementTypeFilter(Types=elementtype_byname, Inverted=False)
analyze_wall = AnalyzeWall(Wall=query_elements_2)  # -> WallSystemFamily, WallType, ParentStackedWall, BaseLevel, BaseLevelOffset, BottomIsAttached, TopLevel, TopLevelOffset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
panel_2 = Panel(query_elements_3)
analyze_wall_2 = AnalyzeWall(Wall=query_elements_4)  # -> WallSystemFamily, WallType, ParentStackedWall, BaseLevel, BaseLevelOffset, BottomIsAttached, TopLevel, TopLevelOffset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
panel_3 = Panel(element_geometry)
start_points = Panel(end_points.Start)
end_points_2 = Panel(end_points.End)
query_elements_6 = QueryElements(Filter=bytype)
analyze_wall_3 = AnalyzeWall(Wall=query_elements_5)  # -> WallSystemFamily, WallType, ParentStackedWall, BaseLevel, BaseLevelOffset, BottomIsAttached, TopLevel, TopLevelOffset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

# ---- group: Get Wall Start Point
curve_3 = Curve(query_elements_5)
end_points_3 = EndPoints(Curve=curve_3)  # -> Start, End

# ----
panel_4 = Panel(query_elements_6)
wall_structural_usage = WallStructuralUsage({"Non-Bearing": 0, "Bearing": 1, "Shear": 2, "Combined": 3}, selected="Shear")
path_mapper = PathMapper(
    [analyze_wall.WallSystemFamily, analyze_wall.WallType, analyze_wall.ParentStackedWall, analyze_wall.BaseLevel, analyze_wall.BaseLevelOffset, analyze_wall.BottomIsAttached, analyze_wall.TopLevel, analyze_wall.TopLevelOffset, analyze_wall.TopIsAttached, analyze_wall.Height, analyze_wall.Length, analyze_wall.Width, analyze_wall.SlantAngle, analyze_wall.Area, analyze_wall.Volume, analyze_wall.IsRoomBounding, analyze_wall.Structural, analyze_wall.StructuralUsage, analyze_wall.Orientation],
    source="{A;B}(i)",
    target="{A;B;i}")
panel_5 = Panel(path_mapper)
scale_vector = Multiplication(A=analyze_wall_3.Orientation, B=2)
wall_orientation_vector = VectorDisplayEx(Point=end_points_3.Start, Vector=scale_vector, Colour=ColourSwatch(SwatchColor=RGB(255, 255, 0)), Width=2)
equality = Equality(FirstNumber=analyze_wall_2.StructuralUsage, SecondNumber=wall_structural_usage)  # -> Equality, Inequality
cull_pattern = CullPattern(List=query_elements_4, CullPattern=equality.Equality)
wall_structural_usage_2 = WallStructuralUsage({"Non-Bearing": 0, "Bearing": 1, "Shear": 2, "Combined": 3}, selected="Non-Bearing")
# = Wall System Family
# = Wall Type
# = Parent Stacked Wall
# = Base Level (Constraint)
# = Base Offset
# = Is Base Attached?
# = Top Level  (Constraint)
# = Top Offset
# = Is Top Attached?
# = Height
# = Length
# = Width
# = Slant Angle
# = Area
# = Volume
# = Room Bounding
# = Structural?
# = Structural Usage
# = Orientation Vector
wall_system_family_4 = WallSystemFamily({"Basic": 0, "Curtain": 1, "Stacked": 2}, selected="Basic")
panel_6 = Panel(cull_pattern)
wall_system_family_5 = WallSystemFamily({"Basic": 0, "Curtain": 1, "Stacked": 2}, selected="Basic")
wall_system_family_6 = WallSystemFamily({"Basic": 0, "Curtain": 1, "Stacked": 2}, selected="Basic")
wall_system_family_7 = WallSystemFamily({"Basic": 0, "Curtain": 1, "Stacked": 2}, selected="Basic")
wall_system_family_8 = WallSystemFamily({"Basic": 0, "Curtain": 1, "Stacked": 2}, selected="Stacked")
wall_system_family_9 = WallSystemFamily({"Basic": 0, "Curtain": 1, "Stacked": 2}, selected="Basic")
query_walls_4 = DocumentWalls(WallSystemFamily=wall_system_family_5)
query_walls_5 = DocumentWalls(WallSystemFamily=wall_system_family_6)
query_walls_6 = DocumentWalls(WallSystemFamily=wall_system_family_7)
query_walls_7 = DocumentWalls(WallSystemFamily=wall_system_family_8)
# BASIC WALLS
query_walls_8 = DocumentWalls(WallSystemFamily=wall_system_family_9)
element_type_2 = ElementType(Element=query_walls_4)  # -> Element, Type
element_type_3 = ElementType(Element=query_walls_5)  # -> Element, Type
element_type_4 = ElementType(Element=query_walls_6)  # -> Element, Type
wall_system_family_10 = WallSystemFamily({"Basic": 0, "Curtain": 1, "Stacked": 2}, selected="Basic")
wall_system_family_11 = WallSystemFamily({"Basic": 0, "Curtain": 1, "Stacked": 2}, selected="Basic")
wall_system_family_12 = WallSystemFamily({"Basic": 0, "Curtain": 1, "Stacked": 2}, selected="Basic")
wall_system_family_13 = WallSystemFamily({"Basic": 0, "Curtain": 1, "Stacked": 2}, selected="Basic")
analyze_basic_wall_type = AnalyzeBasicWallType(BasicWallType=element_type_2.Type)  # -> Structure, WrappingAtInserts, WrappingAtEnds, Width, Function
csg = ElementCompoundStructureGeometry(Element=query_walls_8)
csg_2 = ElementCompoundStructureGeometry(Element=query_walls_7)
analyze_basic_wall_type_2 = AnalyzeBasicWallType(BasicWallType=element_type_3.Type)  # -> Structure, WrappingAtInserts, WrappingAtEnds, Width, Function
analyze_basic_wall_type_3 = AnalyzeBasicWallType(BasicWallType=element_type_4.Type)  # -> Structure, WrappingAtInserts, WrappingAtEnds, Width, Function
wall_wrapping = WallWrapping({"Do Not Wrap": 0, "Exterior": 1, "Interior": 2, "Both": 3}, selected="Do Not Wrap")
wall_function = WallFunction({"Interior": 0, "Exterior": 1, "Foundation": 2, "Retaining": 3, "Soffit": 4, "Core-Shaft": 5}, selected="Exterior")
query_walls_9 = DocumentWalls(WallSystemFamily=wall_system_family_10)
query_walls_10 = DocumentWalls(WallSystemFamily=wall_system_family_11)
query_walls_11 = DocumentWalls(WallSystemFamily=wall_system_family_12)
query_walls_12 = DocumentWalls(WallSystemFamily=wall_system_family_13)
# ▼ Exterior
# ▲ Interior
panel_7 = Panel(csg)
panel_8 = Panel(csg_2)
graphical_element = GraphicalElement(<wall referenced from the Revit model>)
element_type_5 = ElementType(Element=query_walls_9)  # -> Element, Type
equality_2 = Equality(FirstNumber=analyze_basic_wall_type_2.WrappingAtInserts, SecondNumber=wall_wrapping)  # -> Equality, Inequality
wall_structure = Panel(analyze_basic_wall_type.Structure)
wall_function_2 = Panel(analyze_basic_wall_type.Function)
element_type_6 = ElementType(Element=query_walls_10)  # -> Element, Type
equality_3 = Equality(FirstNumber=analyze_basic_wall_type_3.Function, SecondNumber=wall_function)  # -> Equality, Inequality
wall_width = Panel(analyze_basic_wall_type.Width)
wrapping_at_inserts = Panel(analyze_basic_wall_type.WrappingAtInserts)
wrapping_at_ends = Panel(analyze_basic_wall_type.WrappingAtEnds)
element_type_7 = ElementType(Element=graphical_element)  # -> Element, Type
element_type_8 = ElementType(Element=query_walls_12)  # -> Element, Type
analyze_basic_wall_type_4 = AnalyzeBasicWallType(BasicWallType=element_type_5.Type)  # -> Structure, WrappingAtInserts, WrappingAtEnds, Width, Function
analyze_basic_wall_type_5 = AnalyzeBasicWallType(BasicWallType=element_type_6.Type)  # -> Structure, WrappingAtInserts, WrappingAtEnds, Width, Function
analyze_basic_wall_type_6 = AnalyzeBasicWallType(BasicWallType=element_type_8.Type)  # -> Structure, WrappingAtInserts, WrappingAtEnds, Width, Function
cull_pattern_2 = CullPattern(List=element_type_3.Type, CullPattern=equality_2.Equality)
cull_pattern_3 = CullPattern(List=element_type_4.Type, CullPattern=equality_3.Equality)
analyze_basic_wall_type_7 = AnalyzeBasicWallType(BasicWallType=element_type_7.Type)  # -> Structure, WrappingAtInserts, WrappingAtEnds, Width, Function
panel_9 = Panel(cull_pattern_2)
panel_10 = Panel(cull_pattern_3)
wall_function_3 = WallFunction({"Interior": 0, "Exterior": 1, "Foundation": 2, "Retaining": 3, "Soffit": 4, "Core-Shaft": 5}, selected="Interior")
dcs = DeconstructCompoundStructure(CompoundStructure=analyze_basic_wall_type_4.Structure)  # -> TotalThickness, SampleHeight, CutoffHeight, MinimumSampleHeight, MinimumLayerThickness, Layers, FirstCoreLayerIndex, LastCoreLayerIndex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
wall_wrapping_2 = WallWrapping({"Do Not Wrap": 0, "Exterior": 1, "Interior": 2, "Both": 3}, selected="Do Not Wrap")
dcs_2 = DeconstructCompoundStructure(CompoundStructure=analyze_basic_wall_type_5.Structure)  # -> TotalThickness, SampleHeight, CutoffHeight, MinimumSampleHeight, MinimumLayerThickness, Layers, FirstCoreLayerIndex, LastCoreLayerIndex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
wall_wrapping_3 = WallWrapping({"Do Not Wrap": 0, "Exterior": 1, "Interior": 2, "Both": 3}, selected="Do Not Wrap")
dcs_3 = DeconstructCompoundStructure(CompoundStructure=analyze_basic_wall_type_6.Structure)  # -> TotalThickness, SampleHeight, CutoffHeight, MinimumSampleHeight, MinimumLayerThickness, Layers, FirstCoreLayerIndex, LastCoreLayerIndex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
dcs_4 = DeconstructCompoundStructure(CompoundStructure=analyze_basic_wall_type_7.Structure)  # -> TotalThickness, SampleHeight, CutoffHeight, MinimumSampleHeight, MinimumLayerThickness, Layers, FirstCoreLayerIndex, LastCoreLayerIndex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
analyze_wall_4 = AnalyzeWall(Wall=element_type_7.Element)  # -> WallSystemFamily, WallType, ParentStackedWall, BaseLevel, BaseLevelOffset, BottomIsAttached, TopLevel, TopLevelOffset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
csg_3 = ElementCompoundStructureGeometry(Element=element_type_7.Element)
total_thickness = Panel(dcs_3.TotalThickness)
# ▼ Exterior
structure_layers = Panel(dcs_3.Layers)

# ---- group: Sort layer geometry by distance from exterior
scale_vector_2 = Multiplication(A=analyze_wall_4.Orientation, B=2)
multiplication = Multiplication(A=analyze_wall_4.Width, B=scale_vector_2)
volume = Volume(Geometry=csg_3)  # -> Volume, Centroid
distance = Distance(PointA=volume.Centroid, PointB=multiplication)
sort_list = SortList(Keys=distance, ValuesValuesA=csg_3)  # -> Keys, ValuesValuesA

# ---- group: Previews
curve_4 = Curve(element_type_7.Element)
element_geometry_2 = ElementGeometry(Elements=element_type_7.Element)
end_points_4 = EndPoints(Curve=curve_4)  # -> Start, End
custom_preview = CustomPreview(Geometry=element_geometry_2, Material=ColourSwatch(SwatchColor=RGBA(66, 66, 66, 0)))
wall_orientation_vector_2 = VectorDisplayEx(Point=end_points_4.Start, Vector=multiplication, Colour=ColourSwatch(SwatchColor=RGB(255, 255, 0)), Width=2)

# ----
list_length = ListLength(List=dcs_4.Layers)
path_mapper_2 = PathMapper(
    [dcs_3.SampleHeight, dcs_3.CutoffHeight, dcs_3.MinimumSampleHeight, dcs_3.MinimumLayerThickness, dcs_3.FirstCoreLayerIndex, dcs_3.LastCoreLayerIndex, dcs_3.StructuralMaterialIndex, dcs_3.VariableLayerIndex, dcs_3.WrappingAtInserts, dcs_3.WrappingAtEnds, dcs_3.HasStructuralDeck, dcs_3.IsVerticallyCompound, dcs_3.IsVerticallyHomogeneous],
    source="{A;B}(i)",
    target="{A;B;i}")
# ▲ Interior
misc_data = Panel(path_mapper_2)
list_item = ListItem(List=dcs_2.Layers, Index=Slider(2, range=0..6), Wrap=True)
list_item_2 = ListItem(List=dcs.Layers, Index=Slider(2, range=0..6), Wrap=True)
of_layers = Panel(list_length)
dcsl = DeconstructCompoundStructureLayer(CompoundStructureLayer=list_item)  # -> Index, Function, Material, Thickness, Wraps, DeckProfile, DeckEmbeddingType
# BASIC WALLS
# AND STACKED WALLS
wall_system_family_14 = WallSystemFamily({"Basic": 0, "Curtain": 1, "Stacked": 2}, selected=["Basic", "Stacked"])
structure_layer = Panel(list_item_2)
wall_system_family_15 = WallSystemFamily({"Basic": 0, "Curtain": 1, "Stacked": 2}, selected="Stacked")
wall_system_family_16 = WallSystemFamily({"Basic": 0, "Curtain": 1, "Stacked": 2}, selected=["Basic", "Stacked"])
query_walls_13 = DocumentWalls(WallSystemFamily=wall_system_family_14)
number_slider = Slider(0, range=0..4)
query_walls_14 = DocumentWalls(WallSystemFamily=wall_system_family_15)
# = Sample Height
# = Cuttoff Hight
# = Min Sample Height
# = Min Layer Thickness
# = First Core Layer Index
# = Last Core Layer Index
# = Structural Material Index
# = Variable Layer Index
# = Wrapping at Inserts
# = Wrapping at Ends
# = Has Structural Deck
# = Is Vertically Compund
# = Is Vertically Homogeneous
opening_wrapping_condition = OpeningWrappingCondition({"None": 0, "Exterior": 1, "Interior": 2, "Exterior and Interior": 3}, selected="None")
end_cap_condition = EndCapCondition({"Exterior": 1, "Interior": 2, "NoEndCap": 3}, selected="Exterior")
query_walls_15 = DocumentWalls(WallSystemFamily=wall_system_family_16)
layer_material = Panel(dcsl.Material)
misc_data_2 = Panel([dcsl.Index, dcsl.Function, dcsl.Thickness, dcsl.Wraps, dcsl.DeckProfile, dcsl.DeckEmbeddingType])
wall_location_line = WallLocationLine({"Wall Centerline": 0, "Core Centerline": 1, "Finish (Exterior Face)": 2, "Finish (Interior Face)": 3, "Core (Exterior Face)": 4, "Core (Interior Face)": 5}, selected="Core (Exterior Face)")
analyze_wall_location_curve = AnalyseWallLocationCurve(Wall=query_walls_13)  # -> LocationLine, CenterCurve, LocationCurve, OffsetValue
analyze_wall_location_curve_2 = AnalyseWallLocationCurve(Wall=query_walls_14)  # -> LocationLine, CenterCurve, LocationCurve, OffsetValue
list_item_3 = ListItem(List=dcs_4.Layers, Index=number_slider, Wrap=True)
analyze_wall_profile = AnalyseWallProfile(Wall=query_walls_15)
list_item_4 = ListItem(List=sort_list.ValuesValuesA, Index=number_slider, Wrap=True)
location_line = Panel(analyze_wall_location_curve.LocationLine)
center_curve_2 = Panel(analyze_wall_location_curve.CenterCurve)
location_line_curve = Panel(analyze_wall_location_curve.LocationCurve)
location_line_offset = Panel(analyze_wall_location_curve.OffsetValue)
panel_11 = Panel(list_item_3)
panel_12 = Panel(list_item_4)
equality_4 = Equality(FirstNumber=analyze_wall_location_curve_2.LocationLine, SecondNumber=wall_location_line)  # -> Equality, Inequality
panel_13 = Panel(analyze_wall_profile)
deck_embedding_type = DeckEmbeddingType({"Merge with Layer Above": 0, "Standalone": 1}, selected="Merge with Layer Above")
# = Layer Id
# = Function
# = Width
# = Wraps
# = Deck Profile Id
# = Deck Embedding Type
layer_function = LayerFunction({"Structure": 1, "Substrate": 2, "Insulation": 3, "Finish 1": 4, "Finish 2": 5, "Membrane": 100, "StructuralDeck": 200}, selected="Structure")
cull_pattern_4 = CullPattern(List=query_walls_14, CullPattern=equality_4.Equality)
panel_14 = Panel(cull_pattern_4)
wall_location_line_2 = WallLocationLine({"Wall Centerline": 0, "Core Centerline": 1, "Finish (Exterior Face)": 2, "Finish (Interior Face)": 3, "Core (Exterior Face)": 4, "Core (Interior Face)": 5}, selected="Wall Centerline")
# CREATE
model_8 = ModelCategoriesPicker({"Air Systems": -2001008, "Air Terminals": -2008013, "Analysis Display Style": -2000304, "Analysis Results": -2000303, "Areas": -2003200, "Bridge Abutments": -2006130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}, selected="Walls": -2000011)
model_9 = ModelCategoriesPicker({"Air Systems": -2001008, "Air Terminals": -2008013, "Analysis Display Style": -2000304, "Analysis Results": -2000303, "Areas": -2003200, "Bridge Abutments": -2006130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}, selected="Walls": -2000011)
wall_system_family_17 = WallSystemFamily({"Basic": 0, "Curtain": 1, "Stacked": 2}, selected="Stacked")
wall_system_family_18 = WallSystemFamily({"Basic": 0, "Curtain": 1, "Stacked": 2}, selected="Basic")
graphical_element_2 = GraphicalElement([<curveelement referenced from the Revit model> x9])
curve_5 = Curve(graphical_element_2)
# STACKED WALLS
wall_system_family_19 = WallSystemFamily({"Basic": 0, "Curtain": 1, "Stacked": 2}, selected="Stacked")
elementtype_picker = ElementTypePicker(
    model_8,
    {"Basic Wall : Wall 1": "446b5203-4968-4da7-940a-b32debc02868-47a110e3-8998-46b9-b589-5c597a2f4f14-000006ae", "Basic Wall : Wall 2": "446b5203-4968-4da7-940a-b32debc02868-3d36998f-6406-4270-a669-6bf59b967eb3-00000adf", "Basic Wall : Wall 3": "446b5203-4968-4da7-940a-b32debc02868-e7965944-b489-451c-a6fa-77451802bad9-0000111a", "Curtain Wall : Curtain Wall 1": "446b5203-4968-4da7-940a-b32debc02868-47a110e3-8998-46b9-b589-5c597a2f4f14-000006af"}, selected="Basic Wall : Wall 2")
elementtype_picker_2 = ElementTypePicker(
    model_9,
    {"Basic Wall : Wall 1": "446b5203-4968-4da7-940a-b32debc02868-47a110e3-8998-46b9-b589-5c597a2f4f14-000006ae", "Basic Wall : Wall 2": "446b5203-4968-4da7-940a-b32debc02868-3d36998f-6406-4270-a669-6bf59b967eb3-00000adf", "Basic Wall : Wall 3": "446b5203-4968-4da7-940a-b32debc02868-e7965944-b489-451c-a6fa-77451802bad9-0000111a", "Curtain Wall : Curtain Wall 1": "446b5203-4968-4da7-940a-b32debc02868-47a110e3-8998-46b9-b589-5c597a2f4f14-000006af"}, selected="Basic Wall : Wall 2")
graphical_element_3 = GraphicalElement([<curveelement referenced from the Revit model> x2])
join_curves = JoinCurves(Curves=curve_5, Preserve=False)
level = LevelsPicker({"Level 1": "446b5203-4968-4da7-940a-b32debc02868-47a110e3-8998-46b9-b589-5c597a2f4f14-0000068f"}, selected="Level 1")
level_2 = LevelsPicker({"Level 1": "446b5203-4968-4da7-940a-b32debc02868-47a110e3-8998-46b9-b589-5c597a2f4f14-0000068f"}, selected="Level 1")
query_walls_16 = DocumentWalls(WallSystemFamily=wall_system_family_18)
query_walls_17 = DocumentWalls(WallSystemFamily=wall_system_family_17)
curve_6 = Curve(graphical_element_3)
query_walls_18 = DocumentWalls(WallSystemFamily=wall_system_family_19)
panel_15 = Panel(join_curves)
add_wall_curve = AddWallCurve(Curve=curve_6, Type=elementtype_picker, Level=level, Height=Slider(10, range=0..10))
add_wall_profile = AddWallProfile(Profile=join_curves, Type=elementtype_picker_2, Level=level_2)
analyze_stacked_wall = AnalyseStackedWall(StackedWall=query_walls_17)
analyze_stacked_wall_2 = AnalyseStackedWall(StackedWall=query_walls_18)
panel_16 = Panel(add_wall_profile)
panel_17 = Panel(add_wall_curve)
entwine = Entwine(Branch0X=query_walls_16, Branch1X=analyze_stacked_wall, FlattenInputs=False)
panel_18 = Panel(analyze_stacked_wall_2)
simplify_tree = SimplifyTree(Tree=entwine, Front=False)
csg_4 = ElementCompoundStructureGeometry(Element=simplify_tree)
# ▼ Exterior
# ▲ Interior
panel_19 = Panel(csg_4)
# BOUNDING GEOM
wall_system_family_20 = WallSystemFamily({"Basic": 0, "Curtain": 1, "Stacked": 2}, selected=["Basic", "Curtain", "Stacked"])
query_walls_19 = DocumentWalls(WallSystemFamily=wall_system_family_20)
element_bounding_geometry = ElementBoundingGeometry(Element=query_walls_19)
