# Grasshopper definition update_components_data.gh (Grasshopper 1.0.7)

ghpython_script = GhPythonScript(DocsPath="Z:\gits\McNeel\rhino.inside-revit\docs\")  # -> CompsData
# ---------- ghpython_script: Python ----------
import os.path as op
import json
from collections import namedtuple, defaultdict

import clr
clr.AddReference('System.Core')
clr.AddReference('RhinoInside.Revit')
clr.AddReference('RevitAPI') 
clr.AddReference('RevitAPIUI')

from System import Enum
from System.Reflection import BindingFlags

import rhinoscriptsyntax as rs
import Rhino
import RhinoInside
import Grasshopper
from Grasshopper.Kernel import GH_RuntimeMessageLevel as RML
from RhinoInside.Revit import Revit, Convert
from Autodesk.Revit import DB

from Rhino.NodeInCode import Components as ghc

# =============================================================================
# configs
# script assumes the GH def file is in root of docs/ folder
DOCS_PATH = op.dirname(ghdoc.Path)
# target components data file, to be generated
DATA_FILE = r'_data\components.json'
# =============================================================================

class ComplexEncoder(json.JSONEncoder):
    """Json serializer to be passed to json.dumps()"""
    def default(self, obj):
        return {
            "uuid": obj.uuid,
            "title": obj.title,
            "desc": obj.desc,
            "iconsrc": obj.iconsrc,
            "icontag": obj.icontag
        }

class Component(object):
    """Component data type. Extracts properties from given type"""
    def __init__(self, ctype):
        self._valid = True
        self._exposure = int(Grasshopper.Kernel.GH_Exposure.primary)
        try:
            t = ctype()
            # component uuid
            self.uuid = str(t.ComponentGuid)
            # name as title
            self.title = t.Name
            self.desc = t.Description
            # assymes icon file name matches stripped version of type name
            # e.g. Add Wall --> AddWall.png
            icon_file = 'static/images/GH/{}.png'.format(''.join(str(t.Name).strip().split()))
            full_icon_path = op.normpath(op.join(DOCS_PATH, icon_file))
            self.iconsrc = '/' + icon_file if op.exists(full_icon_path) else None
            self.icontag = None
            # if no icon exits, get the icon tag
            if not self.iconsrc:
                self.icontag = t.IconTag if hasattr(t, 'IconTag') else str(t.Name)[0].upper()
            # component group
            self.tab = t.Category
            self.panel = t.SubCategory
        except:
            self._valid = False

    @property
    def is_valid(self):
        """If component has extracted all the availabe info"""
        return self._valid

    @property
    def is_hidden(self):
        """If component is marked as hidden in GH GUI"""
        return self._exposure == int(Grasshopper.Kernel.GH_Exposure.hidden)


def get_nodes_from_assm():
    """Extract GH types from RhinoInside.Revit.GH assembly"""
    comps = []
    for t in clr.LoadAssemblyByName("RhinoInside.Revit.GH").GetExportedTypes():
        namespace = str(t.Namespace)
        if namespace in ['RhinoInside.Revit.GH.Components',
                         'RhinoInside.Revit.GH.Parameters']:
            c = Component(t)
            # if component is valid and not hidden,
            # then filter for the onces in Revit tab or panel only
            if c.is_valid and not c.is_hidden \
                    and (c.tab == 'Revit' or c.panel == 'Revit'):
                comps.append(c)
    return comps

# group components by panel name
# e.g. {"panel": [c1, c2, c3]}
comps_by_panel = defaultdict(list)
for comp in get_nodes_from_assm():
    if comp.panel:
        comps_by_panel[comp.panel].append(comp)

# create data struct from component groups
# e.g. {"title": "panel",
#       "comps:: [c1, c2, c3]}
comps_by_panel_data = [{"title":k, "comps":v} for k,v in comps_by_panel.items()]

# dump to json
comps_data = json.dumps(
    comps_by_panel_data,
    cls=ComplexEncoder,
    sort_keys=True,
    indent=2
    )

# set output
CompsData = comps_data
# write to data file
with open(op.join(DOCS_PATH, DATA_FILE), 'w') as f:
    f.write(comps_data)
# ---------- end ghpython_script ----------
panel = Panel(ghpython_script)
