# Grasshopper definition update_components_data.ghx (Grasshopper 1.0.7)

ghpython_script = GhPythonScript()  # -> CompsData
# ---------- ghpython_script: Python ----------
import os
import os.path as op
import shutil
import json
from collections import namedtuple, defaultdict

import clr
clr.AddReference('System.Core')
clr.AddReference('RhinoInside.Revit')
clr.AddReference('RhinoInside.Revit.GH')
clr.AddReference('RevitAPI') 
clr.AddReference('RevitAPIUI')

from System import Enum
from System import ObsoleteAttribute
from System.Reflection import BindingFlags

import rhinoscriptsyntax as rs
import Rhino
import RhinoInside
import Grasshopper
from Grasshopper.Kernel import GH_RuntimeMessageLevel as RML
from RhinoInside.Revit import Revit, Convert
from Autodesk.Revit import DB

from Rhino.NodeInCode import Components as ghc

import RhinoInside.Revit.GH.Kernel.Attributes as attrs

# =============================================================================
# configs
# script assumes the GH def file is in root of docs/ folder
DOCS_PATH = op.dirname(ghdoc.Path)
# target components data file, to be generated
DATA_FILE = r'_data\components.json'
ICONS_SRC = r'../art/gh-icons/'
ICONS_DST = r'static/images/GH'
ICONS_ROOT = r'static/images/GH/{}.png'
# =============================================================================

class ComplexEncoder(json.JSONEncoder):
    """Json serializer to be passed to json.dumps()"""
    def default(self, obj):
        return {
            "uuid": obj.uuid,
            "typename": obj.typename,
            "title": obj.title,
            "desc": obj.desc,
            "iconsrc": obj.iconsrc,
            "icontag": obj.icontag,
            "tab": obj.tab,
            "panel": obj.panel,
            "since": obj.since_message,
            "until": obj.until_message,
        }

class Component(object):
    """Component data type. Extracts properties from given type"""
    def __init__(self, ctype):
        self._valid = True
        self._exposure = -1
        try:
            t = ctype()
            # component uuid
            self.uuid = str(t.ComponentGuid)
            self.typename = ctype.Name
            # name as title
            self.title = t.Name
            self.desc = str(t.Description).replace(".", "")
            # assymes icon file name matches stripped version of type name
            # e.g. Add Wall --> AddWall.png
            icon_file = ICONS_ROOT.format(''.join(self.typename.strip().split()))
            type_icon_file = ICONS_ROOT.format(self.typename)
            self.iconsrc = None
            for icon_opt in [icon_file, type_icon_file]:
                full_icon_path = op.normpath(op.join(DOCS_PATH, icon_opt))
                if op.exists(full_icon_path):
                    self.iconsrc = '/' + icon_opt
                    break
            # if no icon exits, get the icon tag
            self.icontag = None
            if not self.iconsrc:
                self.icontag = t.IconTag if hasattr(t, 'IconTag') else self.typename[0].upper()
            # component group
            self.tab = t.Category
            self.panel = t.SubCategory
            # component exposure
            self._exposure = int(t.Exposure) if hasattr(t, 'Exposure') else int(Grasshopper.Kernel.GH_Exposure.primary)
            # messages
            self.since_message = Component.extract_added_message(t)
            self.until_message = Component.extract_removed_message(t)
        except Exception as ex:
            self._valid = False

    @property
    def is_valid(self):
        """If component has extracted all the availabe info"""
        return self._valid

    @property
    def is_hidden(self):
        """If component is marked as hidden in GH GUI"""
        return self._exposure == int(Grasshopper.Kernel.GH_Exposure.hidden)
        
    @staticmethod
    def extract_added_message(ctype):
        sinceAttr = getattr(attrs, "SinceAttribute", None)
        if sinceAttr:
            for attr in ctype.GetType().GetCustomAttributes(sinceAttr, False):
                return attr.Message
        return None

    @staticmethod
    def extract_removed_message(ctype):
        for attr in ctype.GetType().GetCustomAttributes(ObsoleteAttribute, False):
            return attr.Message
        return None


def get_nodes_from_assm():
    """Extract GH types from RhinoInside.Revit.GH assembly"""
    comps = []
    for t in clr.LoadAssemblyByName("RhinoInside.Revit.GH").GetExportedTypes():
        namespace = str(t.Namespace)
        if any(namespace.startswith(x) for x in ['RhinoInside.Revit.GH.Components', 'RhinoInside.Revit.GH.Parameters']):
            c = Component(t)
            # if component is valid and not hidden,
            # then filter for the onces in Revit tab or panel only
            if c.is_valid and (c.tab == 'Revit' or c.panel == 'Revit Primitives'):
                comps.append(c)
    return comps

# copy all icons into docs
for iconsdir in ['comps', 'params']:
    iconsdir_path = op.abspath(op.join(DOCS_PATH, ICONS_SRC, iconsdir))
    icons_dest = op.join(DOCS_PATH, ICONS_DST)
    for file_name in os.listdir(iconsdir_path):
        if file_name.endswith('.png'):
            full_file_name = os.path.join(iconsdir_path, file_name)
            if os.path.isfile(full_file_name):
                shutil.copy(full_file_name, icons_dest)

# dump to json
comps_data = json.dumps(
    get_nodes_from_assm(),
    cls=ComplexEncoder,
    sort_keys=True,
    indent=2
    )

# set output
CompsData = comps_data
# write to data file
with open(op.join(DOCS_PATH, DATA_FILE), 'w') as f:
    f.write(comps_data)
# ---------- end ghpython_script ----------
panel = Panel(ghpython_script)
