# Grasshopper definition Sample3.ghx (Grasshopper 1.0.7)
# plug-ins: Rhino.Inside for Autodesk Revit

surface = Surface()
samples = Slider(35, range=2..50)
live_update = BooleanToggle(True)
update_now = Button()
mesh_surface = MeshSurface(Surface=surface, UCount=samples, VCount=samples, Overhang=True, Equalize=False)
deconstruct_mesh = DeconstructMesh(Mesh=mesh_surface)  # -> Vertices, Faces, Colours, Normals
gate_or = GateOr(A=live_update, B=update_now)
create_topography_surface = CSharpScript(
    Points=deconstruct_mesh.Vertices,
    Update=gate_or,
    Reference=["C:\Program Files\Autodesk\Revit 2020\RevitAPI.dll", "C:\Program Files\Autodesk\Revit 2020\RevitAPIUI.dll", "%APPDATA%\Autodesk\Revit\Addins\2020\RhinoInside.Revit\RhinoInside.Revit.dll"])  # -> out, Topography; inputs Points: list of Point3d, Update: Boolean
# ---------- create_topography_surface: C# usings ----------
using System.Linq;
using Autodesk.Revit.DB;
using Autodesk.Revit.DB.Architecture;
using RhinoInside.Revit;
using RhinoInside.Revit.Convert.Geometry;
using RhinoInside.Revit.Convert.System.Collections.Generic;
using RhinoInside.Revit.External.DB.Extensions;
# ---------- create_topography_surface: C# ----------
    var document = Revit.ActiveDBDocument;
    if(document == null)
      return;

    if(Points == null || Points.Count == 0)
      return;

    // Find previous TopographySurface
    TopographySurface topographySurface;
    using(var collector = new FilteredElementCollector(document))
    {
      collector.OfClass(typeof(TopographySurface)).
        WhereParameterEqualsTo(BuiltInParameter.ALL_MODEL_INSTANCE_COMMENTS, Component.InstanceGuid.ToString()).
        WhereParameterEqualsTo(BuiltInParameter.ALL_MODEL_MARK, Component.RunCount.ToString());
      topographySurface = collector.FirstElement() as TopographySurface;
    }

    if(Update)
    {
      // Convert Rhino.Geometry.Point3d to Autodesk.Revit.DB.XYZ
      var xyz = Points.ConvertAll(GeometryEncoder.ToXYZ);

      if(topographySurface != null)
      {
        if(xyz.Count < 3)
        {
          using(var tx = new Transaction(document, Component.NickName))
          {
            tx.Start();
            document.Delete(topographySurface.Id);
            tx.Commit();
            topographySurface = null;
          }
        }
        else
        {
          using(var scope = new TopographyEditScope(document, Component.NickName))
          {
            scope.Start(topographySurface.Id);

            var boundaryPoints = topographySurface.GetBoundaryPoints();
            var bbox = new BoundingBox(boundaryPoints.Convert(GeometryDecoder.ToPoint3d));
            bbox.Inflate(Revit.VertexTolerance * Revit.ModelUnits * 10.0);
            var bboxCorners = bbox.GetCorners().Take(4).Convert(GeometryEncoder.ToXYZ).ToArray();

            using(var tx = new Transaction(document, Component.NickName))
            {
              tx.Start();

              topographySurface.AddPoints(bboxCorners);
              topographySurface.DeletePoints(topographySurface.GetPoints());

              tx.Commit();
            }

            using(var tx = new Transaction(document, Component.NickName))
            {
              tx.Start();

              topographySurface.AddPoints(xyz);
              topographySurface.DeletePoints(bboxCorners);

              tx.Commit();
            }

            scope.Commit(new FailuresPreprocessor());
          }
        }
      }
      else
      {
        using(var tx = new Transaction(document, Component.NickName))
        {
          tx.Start();

          // Create a new TopographySurface
          topographySurface = TopographySurface.Create(document, xyz);

          // Mark topography to be updated next run
          topographySurface.get_Parameter(BuiltInParameter.ALL_MODEL_INSTANCE_COMMENTS).Set(Component.InstanceGuid.ToString());
          topographySurface.get_Parameter(BuiltInParameter.ALL_MODEL_MARK).Set(Component.RunCount.ToString());

          tx.Commit();
        }
      }
    }

    Topography = topographySurface;
# ---------- create_topography_surface: C# additional code ----------
  /// <summary>
  /// This method will be called once every solution, before any calls to RunScript.
  /// </summary>
  public override void BeforeRunScript()
  { }
  /// <summary>
  /// This method will be called once every solution, after any calls to RunScript.
  /// </summary>
  public override void AfterRunScript()
  {
    // Remove TopographySurfaces not create in that run.
    var document = Revit.ActiveDBDocument;
    if(document == null)
      return;

    using(var collector = new FilteredElementCollector(document))
    {
      collector.OfClass(typeof(TopographySurface)).
        WhereParameterEqualsTo(BuiltInParameter.ALL_MODEL_INSTANCE_COMMENTS, Component.InstanceGuid.ToString());

      var list = collector.Cast<Element>().
        Where(x => Int32.Parse(x.get_Parameter(BuiltInParameter.ALL_MODEL_MARK).AsString()) > Component.RunCount).
        Select(x => x.Id).ToList();

      if(list.Count > 0)
      {
        using(var tx = new Transaction(document, "Clean " + Component.NickName))
        {
          tx.Start();
          document.Delete(list);
          tx.Commit();
        }
      }
    }
  }

  class FailuresPreprocessor : IFailuresPreprocessor
  {
    public FailureProcessingResult PreprocessFailures(FailuresAccessor failuresAccessor)
    {
      return FailureProcessingResult.Continue;
    }
  }
# ---------- end create_topography_surface ----------
element_preview = ElementPreview(Element=create_topography_surface.Topography)  # -> Meshes, Materials, Wires
